# Grasshopper definition a3_u03_stair builder.gh (Grasshopper 1.0.7)
# Copyright: Co-de-iT

steps = ValueList({"by number": 0, "by step height": 1}, selected="by step height")
n_of_steps = Slider(58, range=10..200)
step_height = Slider(0.15, range=0..10)
rail_height = Slider(1.1, range=0..10)
stair_width = Slider(2.5, range=0..10)

flip_direction = BooleanToggle(True)
stair_global_height = Slider(7.892, range=0..30)

# ---- group: curve on the ground
# from ground curve
crv = Curve(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)

# ---- group: 3D curve
# Basic staircase builder
# 
# © a3 2018 _ Creative Commons Attribution-NonCommercial-ShareAlike3.0 UnportedLicense.
# from 3D curve
crv_2 = Curve(reparameterize(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))

# ----
flip = FlipCurve(Curve=crv)  # -> Curve, Flag
end = EndPoints(Curve=crv_2)  # -> Start, End
bbox = BoundingBox(Content=crv_2, Plane=PlaneXY(0, 0, 0))  # -> Box, Box_2
filter = StreamFilter(Gate=flip_direction, Stream0=crv, Stream1=flip.Curve)
boxprop = BoxProperties(Box=bbox.Box)  # -> Center, Diagonal, Area, Volume, Degeneracy
devec = DeconstructVector(Vector=boxprop.Diagonal)  # -> XComponent, YComponent, ZComponent
division = Division(A=devec.ZComponent, B=step_height)
division_2 = Division(A=stair_global_height, B=step_height)
int = Integer(division)
cls = Closed(Curve=filter)  # -> Closed, Periodic
int_2 = Integer(division_2)
filter_2 = StreamFilter(Gate=steps, Stream0=n_of_steps, Stream1=int_2)
int_3 = Integer(cls.Closed)
filter_3 = StreamFilter(Gate=steps, Stream0=n_of_steps, Stream1=int)
addition = Addition(A=filter_2, B=int_3)
range = Range(Domain=devec.ZComponent, Steps=filter_3)
divide = DivideCurve(Curve=filter, Count=filter_2, Kinks=False)  # -> Points, Tangents, Parameters
xy = XYPlane(Origin=end.Start)
range_2 = Range(Domain=stair_global_height, Steps=filter_2)
Z = UnitZ(Factor=range)
item = ListItem(List=divide.Points, Index=0, Wrap=True)
item_2 = ListItem(List=divide.Tangents, Index=0, Wrap=True)
Z_2 = UnitZ(Factor=range_2)
move = Move(Geometry=xy, Motion=Z)  # -> Geometry, Transform
merge = Merge(Data1=divide.Tangents, Data2=item_2)
merge_2 = Merge(Data1=divide.Points, Data2=item)
filter_4 = StreamFilter(Gate=cls.Closed, Stream0=divide.Points, Stream1=merge_2)
pcx = CurvePlane(Curve=crv_2, Plane=move.Geometry)  # -> Points, ParamsC, ParamsP
filter_5 = StreamFilter(Gate=cls.Closed, Stream0=divide.Tangents, Stream1=merge)
eval = EvaluateCurve(Curve=crv_2, Parameter=pcx.ParamsC)  # -> Point, Tangent, Angle
move_2 = Move(Geometry=filter_4, Motion=Z_2)  # -> Geometry, Transform
Z_3 = UnitZ(Factor=1)
xprod = CrossProduct(VectorA=filter_5, VectorB=Z_3, Unitize=False)  # -> Vector, Length
project = Project(Geometry=eval.Tangent, Plane=xy)  # -> Geometry, Transform
Z_4 = UnitZ(Factor=1)
rev = Reverse(Vector=xprod.Vector)
xprod_2 = CrossProduct(VectorA=project.Geometry, VectorB=Z_4, Unitize=False)  # -> Vector, Length
filter_6 = StreamFilter(Gate=flip_direction, Stream0=xprod.Vector, Stream1=rev)
rev_2 = Reverse(Vector=xprod_2.Vector)
amp = Amplitude(Vector=filter_6, Amplitude=stair_width)
amp_2 = Amplitude(Vector=rev_2, Amplitude=stair_width)
vdisex = VectorDisplayEx(Point=move_2.Geometry, Vector=amp, Colour=RGB(0, 0, 0), Width=2)
move_3 = Move(Geometry=move_2.Geometry, Motion=amp)  # -> Geometry, Transform
vdisex_2 = VectorDisplayEx(Point=eval.Point, Vector=amp_2, Colour=RGB(0, 0, 0), Width=2)
move_4 = Move(Geometry=eval.Point, Motion=amp_2)  # -> Geometry, Transform
ln = Line(StartPoint=move_2.Geometry, EndPoint=move_3.Geometry)  # -> simplify(flatten(Line))
ln_2 = Line(StartPoint=pcx.Points, EndPoint=move_4.Geometry)  # -> simplify(flatten(Line))
f_dbshift = DoubleShift(L=ln, W="false")  # -> Fw, Bw; inputs L: list, W: Boolean
# ---------- f_dbshift: C# ----------
                                        /*
    froGH - a sparse collection of (in)utilities for Grasshopper

    Double Shift
    code by Alessio Erioli

    froGH by Co-de-iT is licensed under a Creative Commons Attribution 4.0 International License.
    http://creativecommons.org/licenses/by/4.0/

    */

    initComp();

    if (L.Count > 0){

      List<object> fW = new List<object>(L);
      List<object> bW = new List<object>(L);


      fW.RemoveAt(L.Count - 1);
      bW.RemoveAt(0);

      if (W){
        fW.Insert(0, L[L.Count - 1]);
        bW.Add(L[0]);
      }

      Fw = fW;
      Bw = bW;
    }
# ---------- f_dbshift: C# additional code ----------
  void initComp(){
    Component.Name = "Double Shift";
    Component.NickName = "f_DbShift";
    Component.Description = "Performs a double shift on a list - with optional wrap";

    Component.Params.Input[0].Name = "List";
    Component.Params.Input[0].Description = "List to shift";
    Component.Params.Input[1].Name = "Wrap";
    Component.Params.Input[1].Description = "enable-disable wrap behavior";
    Component.Params.Output[0].Name = "Forward";
    Component.Params.Output[0].Description = "forward-shifted list";
    Component.Params.Output[1].Name = "Backward";
    Component.Params.Output[1].Description = "backward-shifted list";
  }
# ---------- end f_dbshift ----------
intcrv = Interpolate(Vertices=move_2.Geometry, Degree=3, Periodic=False, KnotStyle=1)  # -> Curve, Length, Domain
intcrv_2 = Interpolate(Vertices=move_3.Geometry, Degree=3, Periodic=False, KnotStyle=1)  # -> Curve, Length, Domain
f_dbshift_2 = DoubleShift(L=ln_2, W="false")  # -> Fw, Bw; inputs L: list, W: Boolean; same code as f_dbshift
crv_3 = Curve(f_dbshift.Fw)
crv_4 = Curve(f_dbshift.Bw)
intcrv_3 = Interpolate(Vertices=flatten(move_4.Geometry), Degree=3, Periodic=False, KnotStyle=1)  # -> Curve, Length, Domain
crv_5 = Curve(f_dbshift_2.Bw)
crv_6 = Curve(f_dbshift_2.Fw)
crv_7 = Curve(crv_2)
entwine = Entwine(Branch00=intcrv.Curve, Branch01=intcrv_2.Curve, FlattenInputs=True)
end_2 = EndPoints(Curve=crv_4)  # -> Start, End
entwine_2 = Entwine(Branch00=crv_7, Branch01=intcrv_3.Curve, FlattenInputs=True)
end_3 = EndPoints(Curve=crv_5)  # -> Start, End
Z_5 = UnitZ(Factor=rail_height)
xy_2 = XYPlane(Origin=end_2.Start)
xy_3 = XYPlane(Origin=end_3.Start)
Z_6 = UnitZ(Factor=rail_height)
project_2 = Project(Geometry=crv_3, Plane=xy_2)  # -> Geometry, Transform
project_3 = Project(Geometry=crv_6, Plane=xy_3)  # -> Geometry, Transform
move_5 = Move(Geometry=entwine_2, Motion=Z_6)  # -> Geometry, Transform
move_6 = Move(Geometry=entwine, Motion=Z_5)  # -> Geometry, Transform
merge_3 = Merge(Data1=graft(crv_6), Data2=graft(project_3.Geometry), Data3=graft(crv_5))
merge_4 = Merge(Data1=graft(crv_3), Data2=graft(project_2.Geometry), Data3=graft(crv_4))
merge_5 = Merge(Data1=entwine_2, Data2=move_5.Geometry)
merge_6 = Merge(Data1=entwine, Data2=move_6.Geometry)
loft = Loft(Curves=merge_3, Options={Adjust=False, Closed=False, LoftEnds=0, LoftSimp=0, LoftType=3, Rebuild=10, Refit=0.01})
loft_2 = Loft(Curves=merge_4, Options={Adjust=False, Closed=False, LoftEnds=0, LoftSimp=0, LoftType=3, Rebuild=10, Refit=0.01})

# ---- group: staircase
join = BrepJoin(Breps=flatten(loft))  # -> Breps, Closed

join_2 = BrepJoin(Breps=flatten(loft_2))  # -> Breps, Closed

# ---- group: railings
loft_3 = Loft(Curves=merge_5, Options={Adjust=False, Closed=False, LoftEnds=0, LoftSimp=0, LoftType=3, Rebuild=10, Refit=0.01})

loft_4 = Loft(Curves=merge_6, Options={Adjust=False, Closed=False, LoftEnds=0, LoftSimp=0, LoftType=3, Rebuild=10, Refit=0.01})
