# Grasshopper definition 20181009_cXX_ArchiUnion Bamboo House.gh (Grasshopper 1.0.7)
# Copyright: Co-de-iT

# ---- group: base "8" curve
# ArchiUnion Bamboo House
# 
# © a3 2018 _ Creative Commons Attribution-NonCommercial-ShareAlike3.0 UnportedLicense.
crv = Curve(reparameterize(<curve referenced from the Rhino model>))

# ---- group: make offset curves
z_lowering = Slider(-1.5, range=-3..0)
offset = Slider(5, range=0..100)
neg = Negative(Value=offset)
Z = UnitZ(Factor=z_lowering)
offset_l = OffsetCurveLoose(Curve=crv, Distance=offset)
offset_l_2 = OffsetCurveLoose(Curve=crv, Distance=neg)
cp = ControlPoints(Curve=offset_l)  # -> Points, Weights, Knots
cp_2 = ControlPoints(Curve=offset_l_2)  # -> Points, Weights, Knots
move = Move(Geometry=cp.Points, Motion=Z)  # -> Geometry, Transform
move_2 = Move(Geometry=cp_2.Points, Motion=Z)  # -> Geometry, Transform
nurbcrv = NurbsCurvePWK(Points=move_2.Geometry, Weights=cp_2.Weights, Knots=cp_2.Knots)  # -> Curve, Length, Domain
# play with me
# this was discarded.
# It was left to help you know
# why some methods do not work sometimes
nurbcrv_2 = NurbsCurvePWK(Points=move.Geometry, Weights=cp.Weights, Knots=cp.Knots)  # -> Curve, Length, Domain

# ---- group: why can't we just use curve divisions?
merge = Merge(Data1=flatten(nurbcrv_2.Curve), Data2=flatten(crv), Data3=flatten(nurbcrv.Curve))  # -> flatten(Result)
divide = DivideCurve(Curve=merge, Count=Slider(103, range=10..200), Kinks=False)  # -> Points, Tangents, Parameters
flip = FlipMatrix(Data=divide.Points)

# ----
crv_2 = Curve([nurbcrv_2.Curve, nurbcrv.Curve])
subdivisions = Slider(200, range=10..200)
# bake, modify and reference here
crv_3 = Curve(reparameterize(graft([<curve referenced from the Rhino model> x2])))

# ---- group: why can't we just use curve divisions? / switch this on and you'll know
pline = PolyLine(Vertices=flip, Closed=False)

# ---- group: finding beam planes - alternate methods (discarded)
crv_4 = Curve(crv)
crv_5 = Curve(reparameterize(graft([<curve referenced from the Rhino model> x2])))
pframes = PerpFrames(Curve=crv_4, Count=Slider(200, range=10..200), Align=True)  # -> Frames, graft(Parameters)
pcx = CurvePlane(Curve=simplify(flatten(crv_5)), Plane=graft(pframes.Frames))  # -> simplify(Points), simplify(ParamsC), ParamsP
eval = EvaluateCurve(Curve=crv_4, Parameter=pframes.Parameters)  # -> Point, Tangent, Angle

# ---- group: sorting and filtering points / perpendicular frames
pframes_2 = PerpFrames(Curve=crv, Count=subdivisions, Align=True)  # -> Frames, Parameters

# ---- group: sorting and filtering points / intersection of each external curve with frames
pcx_2 = CurvePlane(Curve=crv_3, Plane=pframes_2.Frames)  # -> simplify(Points), simplify(ParamsC), ParamsP

# ---- group: sorting and filtering points
eval_2 = EvaluateCurve(Curve=crv, Parameter=pframes_2.Parameters)  # -> Point, Tangent, Angle
# sorting and filtering method: Since each plane extends indefinitely, a plane can intercept the same curve more than once. We need to select only the points that are "aligned" with our reference point on the center curve.
# 
# Since the curves are generated as offsets, the points we are looking for have a similar parameter t (or at least they are going to be the ones with the closer value). To find just the one we need on each curve for each section, we do the following:
# 
# . use the parameter t of each intersection point on the border curves to evaluate a point on the center curve
# 
# . calculate the distance between each of those newly evaluated points with the correspondant plane origin point
# 
# . sort the points by distance
# 
# . use list item to get only the point with shorter distance
entwine = Entwine(Branch00=eval_2.Point, Branch01=eval_2.Point, FlattenInputs=True)  # -> simplify(graft(Result))
eval_3 = EvaluateCurve(Curve=crv, Parameter=pcx_2.ParamsC)  # -> Point, Tangent, Angle
dist = Distance(PointA=entwine, PointB=eval_3.Point)
sort = SortList(Keys=dist, ValuesA=pcx_2.Points)  # -> Keys, ValuesA
item = ListItem(List=sort.ValuesA, Index=0, Wrap=True)
pshift = ShiftPaths(Data=item, Offset=-1)

# ---- group: finding beam planes - alternate methods (discarded) / simpler but does not preserve curve order
pshift_2 = ShiftPaths(Data=pcx.Points, Offset=-1)
pshift_3 = ShiftPaths(Data=pcx.ParamsC, Offset=-1)
eval_4 = EvaluateCurve(Curve=crv_4, Parameter=pshift_3)  # -> Point, Tangent, Angle
dist_2 = Distance(PointA=eval.Point, PointB=eval_4.Point)
sort_2 = SortList(Keys=dist_2, ValuesA=pshift_2)  # -> Keys, ValuesA
item_2 = ListItem(List=sort_2.ValuesA, Index=0, Wrap=True)  # -> Item, Item1
pt = Point(item_2.Item)
pt_2 = Point(item_2.Item1)

# ---- group: finding beam planes - alternate methods (discarded) / correct but too complicated
dup = DuplicateData(Data=eval.Point, Number="2", Order=True)  # -> simplify(graft(Data))
eval_5 = EvaluateCurve(Curve=crv_4, Parameter=pcx.ParamsC)  # -> Point, Tangent, Angle
dist_3 = Distance(PointA=dup, PointB=eval_5.Point)
sort_3 = SortList(Keys=dist_3, ValuesA=pcx.Points)  # -> Keys, ValuesA
item_3 = ListItem(List=sort_3.ValuesA, Index=0, Wrap=True)
path_mapper = PathMapper(item_3, source="{A;B}", target="{B;A}")
pshift_4 = ShiftPaths(Data=path_mapper, Offset=-1)
bang = ExplodeTree(Data=pshift_4)  # -> Branch0, Branch1
pt_3 = Point(bang.Branch0)
pt_4 = Point(bang.Branch1)

# ---- group: roof surface supersimple
ins = InsertItems(List=flatten(crv_3), Item=crv, Indices="1", Wrap=True)
loft = Loft(Curves=ins, Options={Adjust=False, Closed=False, LoftEnds=0, LoftSimp=0, LoftType=3, Rebuild=10, Refit=0.01})

# ----
divide_2 = DivideCurve(Curve=crv, Count=subdivisions, Kinks=False)  # -> Points, Tangents, Parameters

# ---- group: beam profile curve
flip_2 = FlipMatrix(Data=pshift)
ins_2 = InsertItems(List=flip_2, Item=graft(divide_2.Points), Indices="1", Wrap=True)  # -> simplify(List)
pline_2 = PolyLine(Vertices=ins_2, Closed=False)

# ----
pt_5 = Point(ins_2)

# ---- group: filleting
fillet = Fillet(Curve=pline_2, Radius=Slider(1.5, range=0..5))

# ---- group: roof surface simple - 1 polysurface
item_4 = ListItem(List=flatten(crv_3), Index=0, Wrap=True)  # -> Item, Item1
swp2 = Sweep2(Rail1=item_4.Item, Rail2=item_4.Item1, Sections=flatten(fillet), SameHeight=False)

# ---- group: shifts the beam curves list & make couples
shift = ShiftList(List=flatten(fillet), Shift="-1", Wrap="true")  # -> simplify(graft(List))
merge_2 = Merge(Data1=shift, Data2=fillet)

# ---- group: why we can't use the initial frames for the beams
pln = Plane(pframes_2.Frames)
deplane = DeconstructPlane(Plane=pln)  # -> Origin, XAxis, YAxis, ZAxis
line = LineSDL(Start=deplane.Origin, Direction=deplane.YAxis, Length=Slider(5.208, range=1..100))

# ---- group: beam section
half_width = Slider(0.05, range=0..2)
height = Slider(0.2, range=0..10)

# ---- group: longitudinal curves
crv_6 = Curve(fillet)
divide_3 = DivideCurve(Curve=flatten(crv_6), Count=Slider(20, range=10..100), Kinks=False)  # -> Points, Tangents, Parameters
flip_3 = FlipMatrix(Data=divide_3.Points)
intcrv = Interpolate(Vertices=flip_3, Degree=3, Periodic="true", KnotStyle=1)  # -> Curve, Length, Domain

# ----
pframe = PerpFrame(Curve=reparameterize(fillet), Parameter="1")
pframe_2 = PerpFrame(Curve=reparameterize(fillet), Parameter="0")
Z_2 = UnitZ(Factor=1)
align = AlignPlane(Plane=pframe, Direction=Z_2)  # -> Plane, Angle
align_2 = AlignPlane(Plane=pframe_2, Direction=Z_2)  # -> Plane, Angle
end = EndPoints(Curve=merge_2)  # -> Start, End

# ---- group: beam section
neg_2 = Negative(Value=half_width)
dom = ConstructDomain(DomainStart=neg_2, DomainEnd=half_width)
rectangle = Rectangle(Plane=PlaneXY(0, 0, 0), XSize=dom, YSize=height, Radius=0)  # -> Rectangle, Length

# ---- group: section plane at the other end
prot = RotatePlane(Plane=align.Plane, Angle=degrees("90"))

# ---- group: section plane at curve start - for beams
prot_2 = RotatePlane(Plane=align_2.Plane, Angle=degrees("90"))

# ----
deplane_2 = DeconstructPlane(Plane=prot)  # -> Origin, XAxis, YAxis, ZAxis
deplane_3 = DeconstructPlane(Plane=prot_2)  # -> Origin, XAxis, YAxis, ZAxis
rev = Reverse(Vector=deplane_2.YAxis)
rev_2 = Reverse(Vector=deplane_3.YAxis)

# ---- group: vault curve at start
number_slider = Slider(0.169, range=0..3)
number_slider_2 = Slider(0.335, range=0..3)

item_5 = ListItem(List=end.Start, Index=0, Wrap=True)  # -> Item, Item1
multiplication = Multiplication(A=rev_2, B=number_slider_2)
multiplication_2 = Multiplication(A=rev_2, B=number_slider)
bzspan = BezierSpan(StartPoint=item_5.Item, StartTangent=multiplication, EndPoint=item_5.Item1, EndTangent=multiplication_2)  # -> Curve, Length, Domain

# ---- group: vault curve at end
number_slider_3 = Slider(0.169, range=0..3)
number_slider_4 = Slider(0.335, range=0..3)

item_6 = ListItem(List=end.End, Index=0, Wrap=True)  # -> Item, Item1
multiplication_3 = Multiplication(A=rev, B=number_slider_4)
multiplication_4 = Multiplication(A=rev, B=number_slider_3)
bzspan_2 = BezierSpan(StartPoint=item_6.Item, StartTangent=multiplication_3, EndPoint=item_6.Item1, EndTangent=multiplication_4)  # -> Curve, Length, Domain

# ---- group: orient beam section
orient = Orient(Geometry=rectangle.Rectangle, Source=PlaneXY(0, 0, 0), Target=prot_2)  # -> Geometry, Transform

# ----
merge_3 = Merge(Data1=bzspan.Curve, Data2=bzspan_2.Curve)

# ---- group: beams
swp1 = Sweep1(Rail=fillet, Sections=orient.Geometry, Miter=1)
cap = CapHoles(Brep=swp1)

# ---- group: vaulted roof
swp2_2 = Sweep2(Rail1=shift, Rail2=fillet, Sections=merge_3, SameHeight=False)
join = BrepJoin(Breps=flatten(swp2_2))  # -> Breps, Closed

# ----
edges = BrepEdges(Brep=[join.Breps, cap])  # -> Naked, Interior, NonManifold
preview = CustomPreview(Geometry=[join.Breps, cap], Material=ColourSwatch(SwatchColor=RGB(255, 255, 255)))
