# Grasshopper definition 00_Biennale conditions Dorte Mandrup_simple.gh (Grasshopper 1.0.7)
# Copyright: Co-de-iT

# ---- group: top curves
# Dorte Mandrup Conditions simplified
# 
# © a3 2018 _ Creative Commons Attribution-NonCommercial-ShareAlike3.0 UnportedLicense.
crv = Curve([<curve referenced from the Rhino model> x2])

# ---- group: bottom curves
crv_2 = Curve([<curve referenced from the Rhino model> x2])

# ----
fillet = Slider(20, range=1..50)

# ---- group: axis
crv_3 = Curve(<curve referenced from the Rhino model>)

# ----
subtraction = Subtraction(A=fillet, B="5")
addition = Addition(A=fillet, B="5")
merge = Merge(Data1=subtraction, Data2=addition)
fillet_2 = Fillet(Curve=crv, Radius=merge)
fillet_3 = Fillet(Curve=crv_2, Radius=merge)
fillet_4 = Fillet(Curve=crv_3, Radius=fillet)
pframes = PerpFrames(Curve=fillet_4, Count=Slider(53, range=2..100), Align=True)  # -> simplify(graft(Frames)), Parameters
pcx = CurvePlane(Curve=fillet_2, Plane=pframes.Frames)  # -> Points, ParamsC, ParamsP
pcx_2 = CurvePlane(Curve=fillet_3, Plane=pframes.Frames)  # -> Points, ParamsC, ParamsP
# first index is the plane, the second is the curve the point belongs to
# 
# {0;1} - the point in plane 0 on curve 1
panel = Panel(pcx.Points)
viewer = ParamViewer(pcx.Points)
pshift = ShiftPaths(Data=pcx_2.Points, Offset=-1)
pshift_2 = ShiftPaths(Data=pcx.Points, Offset=-1)
# shift paths erases the outmost branch index, so the points are collected by plane only
panel_2 = Panel(pshift_2)
viewer_2 = ParamViewer(pshift_2)
merge_2 = Merge(Data1=pshift_2, Data2=reverse(pshift))

# ---- group: portals (polylines)
pline = PolyLine(Vertices=merge_2, Closed="true")

# ---- group: remove sections at ends
panel_3 = Panel("""0
-1""")
cull_i = CullIndex(List=flatten(pline), Indices=panel_3, Wrap=True)  # -> simplify(graft(List))
cull_i_2 = CullIndex(List=flatten(pframes.Frames), Indices=panel_3, Wrap=True)  # -> simplify(graft(List))

# ----
depth = Slider(0.27, range=0..2)
deplane = DeconstructPlane(Plane=cull_i_2)  # -> Origin, XAxis, YAxis, ZAxis
offset = OffsetCurve(Curve=cull_i, Distance=depth, Plane=cull_i_2, Corners=1)  # -> simplify(Curve)
merge_3 = Merge(Data1=cull_i, Data2=offset)
boundary = BoundarySurfaces(Edges=merge_3)

thickness = Slider(0.1, range=0..1)
amp = Amplitude(Vector=deplane.ZAxis, Amplitude=thickness)
extr = Extrude(Base=boundary, Direction=amp)
multiplication = Multiplication(A=amp, B="-0.5")
move = Move(Geometry=extr, Motion=multiplication)  # -> Geometry, Transform

cap = CapHoles(Brep=move.Geometry)

# ---- group: portals
brep = Brep(cap)
