# Grasshopper definition 01_Biennale conditions Dorte Mandrup_gh only.gh (Grasshopper 1.0.7)
# Copyright: Co-de-iT

opening_angle = Slider(45, range=0..60)
# Modeling Dorte Mandrup "Conditions"
# from Biennale 2018
# 
# © a3 2018 _ Creative Commons Attribution-NonCommercial-ShareAlike3.0 UnportedLicense.
pt = Point(Point(0, 0, 0))
X = UnitX(Factor=1)
Z = UnitZ(Factor=1)
neg = Negative(Value=opening_angle)
vrot = Rotate(Vector=X, Axis=Z, Angle=degrees([opening_angle, neg]))
line = LineSDL(Start=pt, Direction=vrot, Length=Slider(60, range=1..100))
join = JoinCurves(Curves=line, Preserve=False)

# ---- group: offset polyline both sides
offset = Slider(3.862, range=0..50)
neg_2 = Negative(Value=offset)
offset_2 = OffsetCurve(Curve=join, Distance=[offset, neg_2], Plane=PlaneXY(0, 0, 0), Corners=1)

# ----
parameters_for_end_points = Panel("""0
1""")
multiplication = Multiplication(A=offset, B="2")
eval = EvaluateCurve(Curve=reparameterize(offset_2), Parameter=parameters_for_end_points)  # -> Point, Tangent, Angle

# ---- group: rotate local tangent 90° for shifting direction
Z_2 = UnitZ(Factor=1)
rev = Reverse(Vector=Z_2)
merge = Merge(Data1=Z_2, Data2=rev)
xprod = CrossProduct(VectorA=eval.Tangent, VectorB=merge, Unitize=True)  # -> Vector, Length

# ----
point_shift = Slider(5.04, range=0..10)

# ---- group: getting elbow point
explode = Explode(Curve=offset_2, Recursive=True)  # -> Segments, Vertices
item = ListItem(List=explode.Vertices, Index=0, Wrap=True)  # -> Item, Item1, Item2

# ---- group: shifting end points
multiplication_2 = Multiplication(A=xprod.Vector, B=point_shift)
move = Move(Geometry=eval.Point, Motion=multiplication_2)  # -> Geometry, Transform

# ---- group: merging elbow with shifted points
ins = InsertItems(List=move.Geometry, Item=item.Item1, Indices="1", Wrap=True)  # -> simplify(List)

# ---- group: move up points to make upper curves
height = Slider(0.191, range=0..10)
height_2 = Slider(4, range=0..10)
merge_2 = Merge(Data1=height, Data2=height_2, Data3=height_2)
entwine = Entwine(Branch00=merge_2, Branch01=reverse(merge_2), FlattenInputs=True)
Z_3 = UnitZ(Factor=entwine)
move_2 = Move(Geometry=ins, Motion=Z_3)  # -> Geometry, Transform

# ----
min_fillet_radius = Slider(7.165, range=0..50)
addition = Addition(A=min_fillet_radius, B=multiplication)
addition_2 = Addition(A=min_fillet_radius, B=offset)
fillet = Fillet(Curve=join, Radius=addition_2)
pline = PolyLine(Vertices=move_2.Geometry, Closed=False)
entwine_2 = Entwine(Branch00=addition, Branch01=min_fillet_radius, FlattenInputs=True)
pframes = PerpFrames(Curve=fillet, Count=Slider(80, range=2..100), Align=True)  # -> graft(Frames), Parameters

# ---- group: upper curves
fillet_2 = Fillet(Curve=pline, Radius=entwine_2)  # -> flatten(Curve)

# ---- group: lower curves
fillet_3 = Fillet(Curve=offset_2, Radius=entwine_2)  # -> flatten(Curve)

# ---- group: upper surface
loft = Loft(Curves=fillet_2, Options={Adjust=False, Closed=False, LoftEnds=0, LoftSimp=0, LoftType=0, Rebuild=10, Refit=0.01})

# ---- group: lower surface
loft_2 = Loft(Curves=fillet_3, Options={Adjust=False, Closed=False, LoftEnds=0, LoftSimp=0, LoftType=0, Rebuild=10, Refit=0.01})

# ---- group: making cross frames
merge_3 = Merge(Data1=fillet_3, Data2=reverse(fillet_2))
pcx = CurvePlane(Curve=merge_3, Plane=pframes.Frames)  # -> simplify(Points), ParamsC, ParamsP
pshift = ShiftPaths(Data=pcx.Points, Offset=-1)
pline_2 = PolyLine(Vertices=pshift, Closed=True)

# ---- group: frame depth
offset_3 = OffsetCurve(Curve=pline_2, Distance=Slider(-0.156, range=-5..0), Plane=pframes.Frames, Corners=1)
merge_4 = Merge(Data1=simplify(pline_2), Data2=simplify(offset_3))
boundary = BoundarySurfaces(Edges=merge_4)
