# Grasshopper definition 02_Biennale conditions Dorte Mandrup_full model.gh (Grasshopper 1.0.7)
# Copyright: Co-de-iT

# ---- group: top curves
# Dorte Mandrup Conditions simplified
# 
# © a3 2018 _ Creative Commons Attribution-NonCommercial-ShareAlike3.0 UnportedLicense.
crv = Curve([<curve referenced from the Rhino model> x2])

# ---- group: bottom curves
crv_2 = Curve([<curve referenced from the Rhino model> x2])

# ----
fillet = Slider(20, range=1..50)

# ---- group: axis
crv_3 = Curve(<curve referenced from the Rhino model>)

# ----
subtraction = Subtraction(A=fillet, B="5")
addition = Addition(A=fillet, B="5")
merge = Merge(Data1=subtraction, Data2=addition)
number_slider = Slider(53, range=2..100)
fillet_2 = Fillet(Curve=crv, Radius=merge)
fillet_3 = Fillet(Curve=crv_2, Radius=merge)
fillet_4 = Fillet(Curve=crv_3, Radius=fillet)
pframes = PerpFrames(Curve=fillet_4, Count=number_slider, Align=True)  # -> simplify(graft(Frames)), Parameters
pcx = CurvePlane(Curve=fillet_2, Plane=pframes.Frames)  # -> Points, ParamsC, ParamsP
pcx_2 = CurvePlane(Curve=fillet_3, Plane=pframes.Frames)  # -> Points, ParamsC, ParamsP
# first index is the plane, the second is the curve the point belongs to
# 
# {0;1} - the point in plane 0 on curve 1
panel = Panel(pcx.Points)
viewer = ParamViewer(pcx.Points)
pshift = ShiftPaths(Data=pcx_2.Points, Offset=-1)
pshift_2 = ShiftPaths(Data=pcx.Points, Offset=-1)
# shift paths erases the outmost branch index, so the points are collected by plane only
panel_2 = Panel(pshift_2)
viewer_2 = ParamViewer(pshift_2)
merge_2 = Merge(Data1=pshift_2, Data2=reverse(pshift))
pline = PolyLine(Vertices=merge_2, Closed="true")

# ---- group: floor generation
crv_4 = Curve(fillet_3)
overhang = Slider(1.265, range=0..2)
ground_thickness = Slider(0.388, range=0..2)
neg = Negative(Value=overhang)
merge_3 = Merge(Data1=overhang, Data2=neg)
Z = UnitZ(Factor=ground_thickness)
offset = OffsetCurve(Curve=crv_4, Distance=merge_3, Plane=PlaneXY(0, 0, 0), Corners=1)
rev = Reverse(Vector=Z)
move = Move(Geometry=offset, Motion=rev)  # -> flatten(Geometry), Transform
merge_4 = Merge(Data1=crv_4, Data2=reverse(move.Geometry))
loft = Loft(Curves=merge_4, Options={Adjust=False, Closed=True, LoftEnds=0, LoftSimp=0, LoftType=3, Rebuild=10, Refit=0.01})

# ---- group: remove sections at ends
panel_3 = Panel("""0
-1""")
cull_i = CullIndex(List=flatten(pline), Indices=panel_3, Wrap=True)  # -> simplify(graft(List))
cull_i_2 = CullIndex(List=flatten(pframes.Frames), Indices=panel_3, Wrap=True)  # -> simplify(graft(List))

# ---- group: display section change
section_selector = Slider(0, range=0..1)
subtraction_2 = Subtraction(A=number_slider, B="2")
multiplication = Multiplication(A=subtraction_2, B=section_selector)
item = ListItem(List=flatten(cull_i), Index=multiplication, Wrap=True)
item_2 = ListItem(List=flatten(cull_i_2), Index=multiplication, Wrap=True)
move_2 = Move(Geometry=item, Motion=Vector(0, 0, 10))  # -> Geometry, Transform
explode = Explode(Curve=move_2.Geometry, Recursive=True)  # -> Segments, Vertices
pt = Point(explode.Vertices)
pt_2 = Point(<point referenced from the Rhino model>)
swatch = ColourSwatch(SwatchColor=RGB(255, 255, 255))
orient = Orient(Geometry=item, Source=item_2, Target=pt_2)  # -> Geometry, Transform
preview = CustomPreview(Geometry=pt, Material=ColourSwatch(SwatchColor=RGB(0, 0, 0)))
preview_2 = CustomPreview(Geometry=move_2.Geometry, Material=swatch)
preview_3 = CustomPreview(Geometry=orient.Geometry, Material=swatch)

# ----
depth = Slider(0.27, range=0..2)
deplane = DeconstructPlane(Plane=cull_i_2)  # -> Origin, XAxis, YAxis, ZAxis
offset_2 = OffsetCurve(Curve=cull_i, Distance=depth, Plane=cull_i_2, Corners=1)  # -> simplify(Curve)
merge_5 = Merge(Data1=cull_i, Data2=offset_2)
boundary = BoundarySurfaces(Edges=merge_5)

thickness = Slider(0.1, range=0..1)
amp = Amplitude(Vector=deplane.ZAxis, Amplitude=thickness)
extr = Extrude(Base=boundary, Direction=amp)
multiplication_2 = Multiplication(A=amp, B="-0.5")
move_3 = Move(Geometry=extr, Motion=multiplication_2)  # -> Geometry, Transform

# ---- group: floor
cap = CapHoles(Brep=loft)

# ---- group: portals
brep = Brep(move_3.Geometry)

# ----
edges = BrepEdges(Brep=brep)  # -> Naked, Interior, NonManifold

# ---- group: roof generation
pt_3 = Point(pshift_2)
overhang_2 = Slider(1.265, range=0..2)
roof_thickness = Slider(0.388, range=0..2)
deplane_2 = DeconstructPlane(Plane=pframes.Frames)  # -> Origin, XAxis, YAxis, ZAxis
item_3 = ListItem(List=fillet_2, Index=0, Wrap=True)  # -> Item, Item1

# ---- group: roof generation / transform list of points in consecutive vectors
cluster = Cluster(pt=pt_3)

# ---- group: roof generation (continued)
amp_2 = Amplitude(Vector=cluster, Amplitude=overhang_2)
xprod = CrossProduct(VectorA=cluster, VectorB=deplane_2.ZAxis, Unitize=False)  # -> Vector, Length
rev_2 = Reverse(Vector=amp_2)
merge_6 = Merge(Data1=amp_2, Data2=rev_2)
amp_3 = Amplitude(Vector=xprod.Vector, Amplitude=roof_thickness)
move_4 = Move(Geometry=pt_3, Motion=merge_6)  # -> Geometry, Transform
move_5 = Move(Geometry=move_4.Geometry, Motion=amp_3)  # -> simplify(Geometry), Transform
merge_7 = Merge(Data1=pt_3, Data2=reverse(move_5.Geometry))
pline_2 = PolyLine(Vertices=merge_7, Closed="true")  # -> flatten(Polyline)
fillet_5 = Fillet(Curve=pline_2, Radius=Slider(0.01, range=0..1))
swp2 = Sweep2(Rail1=item_3.Item, Rail2=item_3.Item1, Sections=fillet_5, SameHeight=False)

# ---- group: roof
cap_2 = CapHoles(Brep=swp2)

# ---- group: move final geometry for baking
merge_8 = Merge(Data1=cap_2, Data2=brep, Data3=cap)
Y = UnitY(Factor=Slider(50, range=0..100))
move_6 = Move(Geometry=merge_8, Motion=Y)  # -> Geometry, Transform

# ----
preview_4 = CustomPreview(Geometry=[brep, cap, cap_2], Material=ColourSwatch(SwatchColor=RGB(255, 255, 255)))

# ==== cluster Cluster
pt = ClusterInput()
pt_2 = Point(pt)
shift = ShiftList(List=pt_2, Shift="+1", Wrap="false")
shift_2 = ShiftList(List=pt_2, Shift="-1", Wrap="false")
vec2pt = Vector2Pt(PointA=shift, PointB=shift_2, Unitize=False)  # -> Vector, Length
V = ClusterOutput(vec2pt.Vector)
unit = UnitVector(Vector=vec2pt.Vector)
vdisex = VectorDisplayEx(Point=shift, Vector=vec2pt.Vector, Colour=unit, Width=2)
