# Grasshopper definition column 4pt.gh (Grasshopper 1.0.7)
# Copyright: Co-de-iT

# ---- group: Wrap
# Wrap: When wrap is active, the list is circular, and the positive or negative sign on the index tells in which direction I am going while searching an item:
# 
# 0 - element at 0
# +1 - first element after 0
# +2 - second element after 0
# 
# -1 - first element BEFORE 0 (starts from the end of the list) - this is the last element
# 
# -2 - second element before 0 (the penultimate element)
# 
# ...and so on...
number_slider = Slider(-1, range=-10..10)
wrap = BooleanToggle(True)
series = Series(Start=0, Step=1, Count=10)
item = ListItem(List=series, Index=number_slider, Wrap=wrap)
panel = Panel(series)
panel_2 = Panel(item)

# ---- group: generate Voronoi base polylines
# multiple elements on a grid
number_slider_2 = Slider(20, range=2..20)
number_slider_3 = Slider(5, range=1..100)
scale_inward = Slider(0.6, range=0..1)

# ---- group: generate Voronoi base polylines / extra points from Rhino (activate to see effect)
pt = Point([<point referenced from the Rhino model> x6])  # disabled

# ---- group: generate Voronoi base polylines / point on curve (activate to see effect
crv = Curve(reparameterize(<curve referenced from the Rhino model>))  # disabled
eval = EvaluateCurve(Curve=crv, Parameter=Slider(0.25, range=0..1))  # -> Point, Tangent, Angle

# ---- group: generate Voronoi base polylines
crv_2 = Curve(<curve referenced from the Rhino model>)
pcen = PolygonCenter(Polyline=crv_2)  # -> CenterV, CenterE, CenterA
scale = Scale(Geometry=crv_2, Center=pcen.CenterV, Factor=scale_inward)  # -> Geometry, Transform
pop2d = Populate2D(Region=scale.Geometry, Count=number_slider_2, Seed=number_slider_3)
merge = Merge(Data1=pop2d, Data2=pt, Data3=eval.Point)  # -> flatten(Result)
voronoi = Voronoi(Points=merge, Boundary=crv_2, BruteForceOverride=False)

# ---- group: scale factors
top_section = Slider(1, range=0..1)
capitol_section = Slider(0.124, range=0..1)
ground_section = Slider(0.074, range=0..1)

# ----
# 2 elements
crv_3 = Curve(graft([<curve referenced from the Rhino model> x2]))

# ---- group: moves to avoid overlapping with previous cases
# variant: variable height
number_slider_4 = Slider(50, range=10..100)
Y = UnitY(Factor=number_slider_4)
move = Move(Geometry=voronoi, Motion=Y)  # -> Geometry, Transform
move_2 = Move(Geometry=crv_2, Motion=Y)  # -> Geometry, Transform

# ----
# only ground curve from Rhino
crv_4 = Curve(<curve referenced from the Rhino model>)

# ---- group: moves to avoid overlapping with previous cases
# variant: columns & chimneys
number_slider_5 = Slider(100, range=10..100)
X = UnitX(Factor=number_slider_5)
move_3 = Move(Geometry=move_2.Geometry, Motion=X)  # -> Geometry, Transform
move_4 = Move(Geometry=move.Geometry, Motion=X)  # -> Geometry, Transform

# ---- group: scale and move in Z / scale factors
top_section_2 = Slider(0.993, range=0..1)
capitol_section_2 = Slider(0.124, range=0..1)
ground_section_2 = Slider(0.074, range=0..1)

# ---- group: center for scaling
pcen_2 = PolygonCenter(Polyline=crv_4)  # -> CenterV, CenterE, CenterA

# ----
merge_2 = Merge(Data1=top_section, Data2=capitol_section, Data3=ground_section)
scale_2 = Scale(Geometry=crv_4, Center=pcen_2.CenterV, Factor=merge_2)  # -> Geometry, Transform

# ---- group: height
top_section_3 = Slider(10, range=0..10)
capitol_section_3 = Slider(8, range=0..20)
ground_section_3 = Slider(0, range=0..10)

# ---- group: scale and move in Z / height
top_section_4 = Slider(10, range=0..10)
capitol_section_4 = Slider(8, range=0..20)
ground_section_4 = Slider(0, range=0..10)

# ---- group: scale and move in Z
pcen_3 = PolygonCenter(Polyline=crv_3)  # -> CenterV, CenterE, CenterA
merge_3 = Merge(Data1=top_section_2, Data2=capitol_section_2, Data3=ground_section_2)
scale_3 = Scale(Geometry=crv_3, Center=pcen_3.CenterV, Factor=merge_3)  # -> Geometry, Transform
merge_4 = Merge(Data1=top_section_4, Data2=capitol_section_4, Data3=ground_section_4)
Z = UnitZ(Factor=merge_4)
move_5 = Move(Geometry=scale_3.Geometry, Motion=Z)  # -> Geometry, Transform

# ----
pcen_4 = PolygonCenter(Polyline=move.Geometry)  # -> CenterV, CenterE, CenterA
merge_5 = Merge(Data1=top_section_3, Data2=capitol_section_3, Data3=ground_section_3)
scale_4 = Scale(Geometry=move.Geometry, Center=pcen_4.CenterV, Factor=Slider(0.968, range=0..1))  # -> Geometry, Transform
pcen_5 = PolygonCenter(Polyline=move_4.Geometry)  # -> CenterV, CenterE, CenterA

# ---- group: Fillet, Scale and Move in Z / scale factors
top_section_5 = Slider(0.98, range=0..1)
capitol_section_5 = Slider(0.11, range=0..1)
ground_section_5 = Slider(0.062, range=0..1)

# ----
Z_2 = UnitZ(Factor=merge_5)
explode = Explode(Curve=scale_4.Geometry, Recursive=True)  # -> Segments, Vertices
move_6 = Move(Geometry=scale_2.Geometry, Motion=Z_2)  # -> Geometry, Transform
scale_5 = Scale(Geometry=move_4.Geometry, Center=pcen_5.CenterV, Factor=Slider(0.968, range=0..1))  # -> Geometry, Transform
cull_i = CullIndex(List=explode.Vertices, Indices="-1", Wrap=True)  # -> simplify(List)
explode_2 = Explode(Curve=scale_5.Geometry, Recursive=True)  # -> Segments, Vertices
cull_i_2 = CullIndex(List=explode_2.Vertices, Indices="-1", Wrap=True)  # -> simplify(List)

# ----
# wrap is true by default here, so we don't need to specify it every time
crv_5 = Curve(move_6.Geometry)
explode_3 = Explode(Curve=crv_5, Recursive=True)  # -> Segments, Vertices
cull_i_3 = CullIndex(List=explode_3.Vertices, Indices="-1", Wrap=True)  # -> simplify(List)
flip = FlipMatrix(Data=cull_i_3)
vertical_fillet = Slider(1.45, range=0..2)
# repeats identically
pline = PolyLine(Vertices=flip, Closed=False)
fillet = Fillet(Curve=pline, Radius=vertical_fillet)  # -> flatten(Curve)
loft_type = ValueList({"Normal": 0, "Loose": 1, "Tight": 2, "Straight": 3, "Uniform": 4}, selected="Straight")
closed = BooleanToggle(True)
loft_opt = LoftOptions(Closed=closed, Adjust=False, Rebuild=0, Refit=0, Type=loft_type)
loft = Loft(Curves=fillet, Options=loft_opt)
preview = CustomPreview(Geometry=loft, Material=ColourSwatch(SwatchColor=RGB(255, 255, 255)))

# ---- group: Fillet, Scale and Move in Z / height
top_section_6 = Slider(10, range=0..10)
capitol_section_6 = Slider(8, range=0..20)
ground_section_6 = Slider(0, range=0..10)

# ---- group: Fillet, Scale and Move in Z
crv_6 = Curve(graft(voronoi))
horizontal_fillet = Slider(0, range=0..2)
fillet_2 = Fillet(Curve=crv_6, Radius=horizontal_fillet)
pcen_6 = PolygonCenter(Polyline=crv_6)  # -> CenterV, CenterE, CenterA
merge_6 = Merge(Data1=top_section_5, Data2=capitol_section_5, Data3=ground_section_5)
scale_6 = Scale(Geometry=fillet_2, Center=pcen_6.CenterV, Factor=merge_6)  # -> Geometry, Transform
merge_7 = Merge(Data1=top_section_6, Data2=capitol_section_6, Data3=ground_section_6)
Z_3 = UnitZ(Factor=merge_7)
move_7 = Move(Geometry=scale_6.Geometry, Motion=Z_3)  # -> Geometry, Transform

# ----
panel_3 = Panel("group of curves")
# A
# B
panel_4 = Panel("curve")
# i
panel_5 = Panel("points on curve")

# ---- group: modulates height as distance from border rectangle
max_added_height = Slider(4.733, range=0..5)
# repeats identically
start_height = Slider(10, range=0..10)

crv_cp = CurveClosestPoint(Point=cull_i, Curve=move_2.Geometry)  # -> Point, Parameter, Distance
num = Number(crv_cp.Distance)
bnd = Bounds(Numbers=flatten(num))
dom = ConstructDomain(DomainStart=0, DomainEnd=1)
remap = RemapNumbers(Value=num, Source=bnd, Target=dom)  # -> Mapped, Clipped
graph = GraphMapper(remap.Mapped, x0=0, x1=1, y0=0, y1=1, container_name="Sine", Equation_px=[0, 1], Equation_py=[0, 1])
multiplication = Multiplication(A=graph, B=max_added_height)
addition = Addition(A=multiplication, B=start_height)

max_added_height_2 = Slider(4.733, range=0..5)
start_height_2 = Slider(10, range=0..10)

crv_cp_2 = CurveClosestPoint(Point=cull_i_2, Curve=move_3.Geometry)  # -> Point, Parameter, Distance
num_2 = Number(crv_cp_2.Distance)
bnd_2 = Bounds(Numbers=flatten(num_2))
dom_2 = ConstructDomain(DomainStart=0, DomainEnd=1)
remap_2 = RemapNumbers(Value=num_2, Source=bnd_2, Target=dom_2)  # -> Mapped, Clipped
graph_2 = GraphMapper(remap_2.Mapped, x0=0, x1=1, y0=0, y1=1, container_name="Sine", Equation_px=[0, 1], Equation_py=[0, 1])
multiplication_2 = Multiplication(A=graph_2, B=max_added_height_2)
addition_2 = Addition(A=multiplication_2, B=start_height_2)

# ---- group: sort points, make curves & loft
explode_4 = Explode(Curve=move_7.Geometry, Recursive=True)  # -> Segments, Vertices
cull_i_4 = CullIndex(List=explode_4.Vertices, Indices="-1", Wrap=True)  # -> simplify(List)
path_mapper = PathMapper(cull_i_4, source="{A;B}(i)", target="{A;i}(B)")
vertical_fillet_2 = Slider(2, range=0..2)
pline_2 = PolyLine(Vertices=path_mapper, Closed=False)
loft_type_2 = ValueList({"Normal": 0, "Loose": 1, "Tight": 2, "Straight": 3, "Uniform": 4}, selected="Straight")
closed_2 = BooleanToggle(True)
fillet_3 = Fillet(Curve=pline_2, Radius=vertical_fillet_2)
pshift = ShiftPaths(Data=fillet_3, Offset=-1)
loft_opt_2 = LoftOptions(Closed=closed_2, Adjust=False, Rebuild=0, Refit=0, Type=loft_type_2)
loft_2 = Loft(Curves=pshift, Options=loft_opt_2)
preview_2 = CustomPreview(Geometry=loft_2, Material=ColourSwatch(SwatchColor=RGB(255, 255, 255)))

# ----
panel_6 = Panel("""0
1""")
tstat = TreeStatistics(Tree=addition_2)  # -> Paths, Length, Count
repeat = RepeatData(Data=panel_6, Length=tstat.Count)  # -> graft(Data)
avr = Average(Input=addition_2)
avr_2 = Average(Input=addition)
Z_4 = UnitZ(Factor=addition)
crv_7 = Curve(graft(move.Geometry))
dispatch = Dispatch(List=avr, DispatchPattern=repeat)  # -> ListA, ListB
move_8 = Move(Geometry=cull_i, Motion=Z_4)  # -> Geometry, Transform
multiplication_3 = Multiplication(A=avr_2, B=Slider(0.8, range=0..1))
crv_8 = Curve(graft(move_4.Geometry))
Z_5 = UnitZ(Factor=addition_2)
pline_3 = PolyLine(Vertices=move_8.Geometry, Closed=True)
horizontal_fillet_2 = Slider(0, range=0..2)
move_9 = Move(Geometry=cull_i_2, Motion=Z_5)  # -> Geometry, Transform
number_slider_6 = Slider(0.607, range=0..2)
number_slider_7 = Slider(8, range=0..10)
number_slider_8 = Slider(0, range=0..10)

# ---- group: this turns columns into chimneys
addition_3 = Addition(A=dispatch.ListB, B=Slider(5.583, range=0..10))

# ---- group: always 0
subtraction = Subtraction(A=dispatch.ListA, B=dispatch.ListA)

# ----
multiplication_4 = Multiplication(A=dispatch.ListA, B=Slider(0.8, range=0..1))
multiplication_5 = Multiplication(A=dispatch.ListB, B=Slider(1.283, range=0..2))
subtraction_2 = Subtraction(A=avr_2, B=avr_2)
pline_4 = PolyLine(Vertices=move_9.Geometry, Closed=True)
pcen_7 = PolygonCenter(Polyline=crv_7)  # -> CenterV, CenterE, CenterA
fillet_4 = Fillet(Curve=pline_3, Radius=horizontal_fillet_2)
fillet_5 = Fillet(Curve=crv_7, Radius=horizontal_fillet_2)
merge_8 = Merge(Data1=Slider(0.11, range=0..1), Data2=Slider(0.062, range=0..1))
weave = Weave(Pattern=repeat, Stream0=addition_3, Stream1=subtraction, NullGaps=False)  # -> simplify(Weave)
weave_2 = Weave(Pattern=repeat, Stream0=multiplication_5, Stream1=multiplication_4, NullGaps=False)  # -> simplify(Weave)
merge_9 = Merge(Data1=multiplication_3, Data2=subtraction_2)
fillet_6 = Fillet(Curve=pline_4, Radius=number_slider_6)
pcen_8 = PolygonCenter(Polyline=crv_8)  # -> CenterV, CenterE, CenterA
fillet_7 = Fillet(Curve=crv_8, Radius=number_slider_6)
merge_10 = Merge(Data1=Slider(0.11, range=0..1), Data2=Slider(0.062, range=0..1))
scale_7 = Scale(Geometry=fillet_5, Center=pcen_7.CenterV, Factor=merge_8)  # -> Geometry, Transform
Z_6 = UnitZ(Factor=merge_9)
merge_11 = Merge(Data1=weave_2, Data2=weave)
scale_8 = Scale(Geometry=fillet_7, Center=pcen_8.CenterV, Factor=merge_10)  # -> Geometry, Transform
Z_7 = UnitZ(Factor=merge_11)

# ---- group: extract isocurves
# repeats identically
debrep = DeconstructBrep(Brep=loft_2)  # -> graft(Faces), Edges, Vertices
range = Range(Domain=Domain(0, 1), Steps=Slider(3, range=1..20))
pt_2 = ConstructPoint(XCoordinate=range, YCoordinate=0, ZCoordinate=0)
iso = IsoCurve(Surface=reparameterize(debrep.Faces), UVPoint=pt_2)  # -> UIsocurve, VIsocurve
crv_9 = Curve(iso.VIsocurve)

# ----
move_10 = Move(Geometry=scale_7.Geometry, Motion=Z_6)  # -> simplify(Geometry), Transform
move_11 = Move(Geometry=scale_8.Geometry, Motion=Z_7)  # -> simplify(Geometry), Transform
# repeats identically
merge_12 = Merge(Data1=fillet_4, Data2=move_10.Geometry)
explode_5 = Explode(Curve=merge_12, Recursive=True)  # -> Segments, Vertices
merge_13 = Merge(Data1=fillet_6, Data2=move_11.Geometry)

# ---- group: sort points, make curves & loft
cull_i_5 = CullIndex(List=explode_5.Vertices, Indices="-1", Wrap=True)  # -> simplify(List)
path_mapper_2 = PathMapper(cull_i_5, source="{A;B}(i)", target="{A;i}(B)")
vertical_fillet_3 = Slider(2, range=0..2)
pline_5 = PolyLine(Vertices=path_mapper_2, Closed=False)
loft_type_3 = ValueList({"Normal": 0, "Loose": 1, "Tight": 2, "Straight": 3, "Uniform": 4}, selected="Straight")
closed_3 = BooleanToggle(True)
fillet_8 = Fillet(Curve=pline_5, Radius=vertical_fillet_3)
loft_opt_3 = LoftOptions(Closed=closed_3, Adjust=False, Rebuild=0, Refit=0, Type=loft_type_3)
pshift_2 = ShiftPaths(Data=fillet_8, Offset=-1)
loft_3 = Loft(Curves=pshift_2, Options=loft_opt_3)
preview_3 = CustomPreview(Geometry=loft_3, Material=ColourSwatch(SwatchColor=RGB(255, 255, 255)))

# ----
explode_6 = Explode(Curve=merge_13, Recursive=True)  # -> Segments, Vertices

# ---- group: sort points, make curves & loft
cull_i_6 = CullIndex(List=explode_6.Vertices, Indices="-1", Wrap=True)  # -> simplify(List)
# repeats identically
path_mapper_3 = PathMapper(cull_i_6, source="{A;B}(i)", target="{A;i}(B)")
pline_6 = PolyLine(Vertices=path_mapper_3, Closed=False)
loft_type_4 = ValueList({"Normal": 0, "Loose": 1, "Tight": 2, "Straight": 3, "Uniform": 4}, selected="Straight")
closed_4 = BooleanToggle(True)
fillet_9 = Fillet(Curve=pline_6, Radius=Slider(2, range=0..2))
loft_opt_4 = LoftOptions(Closed=closed_4, Adjust=False, Rebuild=0, Refit=0, Type=loft_type_4)
pshift_3 = ShiftPaths(Data=fillet_9, Offset=-1)
loft_4 = Loft(Curves=pshift_3, Options=loft_opt_4)
preview_4 = CustomPreview(Geometry=loft_4, Material=ColourSwatch(SwatchColor=RGB(255, 255, 255)))

# ---- group: extract isocurves
debrep_2 = DeconstructBrep(Brep=loft_3)  # -> graft(Faces), Edges, Vertices
range_2 = Range(Domain=Domain(0, 1), Steps=Slider(3, range=1..20))
pt_3 = ConstructPoint(XCoordinate=range_2, YCoordinate=0, ZCoordinate=0)
iso_2 = IsoCurve(Surface=reparameterize(debrep_2.Faces), UVPoint=pt_3)  # -> UIsocurve, VIsocurve
crv_10 = Curve(iso_2.VIsocurve)

# ---- group: moves to avoid overlapping
# variant: open columns
number_slider_9 = Slider(50, range=10..100)
Y_2 = UnitY(Factor=number_slider_9)
move_12 = Move(Geometry=cull_i_5, Motion=Y_2)  # -> Geometry, Transform

# ----
number_slider_10 = Slider(0.415, range=0..0.49)
shift = ShiftList(List=move_12.Geometry, Shift="-1", Wrap=True)  # -> simplify(List)
shift_2 = ShiftList(List=move_12.Geometry, Shift="1", Wrap=True)  # -> simplify(List)
merge_14 = Merge(Data1=graft(move_12.Geometry), Data2=graft(shift))
merge_15 = Merge(Data1=graft(move_12.Geometry), Data2=graft(shift_2))
interp = InterpolateData(Data=merge_14, Parameter=number_slider_10, Interpolation=2)
interp_2 = InterpolateData(Data=merge_15, Parameter=number_slider_10, Interpolation=2)
pshift_4 = ShiftPaths(Data=interp, Offset=-1)
pshift_5 = ShiftPaths(Data=interp_2, Offset=-1)
panel_7 = Panel("""0
1
2""")
weave_3 = Weave(Pattern=panel_7, Stream0=pshift_4, Stream1=move_12.Geometry, Stream2=pshift_5, NullGaps=False)

path_mapper_4 = PathMapper(weave_3, source="{A;B}(i)", target="{A;i}(B)")
pline_7 = PolyLine(Vertices=path_mapper_4, Closed=False)
fillet_10 = Fillet(Curve=pline_7, Radius=Slider(2, range=0..2))
pshift_6 = ShiftPaths(Data=fillet_10, Offset=-1)

panel_8 = Panel(pshift_6)

# ---- group: partition list makes groups of 3 curves each
partition = PartitionList(List=pshift_6, Size="3")

# ----
loft_type_5 = ValueList({"Normal": 0, "Loose": 1, "Tight": 2, "Straight": 3, "Uniform": 4}, selected="Straight")
closed_5 = BooleanToggle(False)
loft_opt_5 = LoftOptions(Closed=closed_5, Adjust=False, Rebuild=0, Refit=0, Type=loft_type_5)
panel_9 = Panel(partition)
loft_5 = Loft(Curves=partition, Options=loft_opt_5)
preview_5 = CustomPreview(Geometry=loft_5, Material=ColourSwatch(SwatchColor=RGB(255, 255, 255)))

# ---- group: extract isocurves
debrep_3 = DeconstructBrep(Brep=loft_5)  # -> graft(Faces), Edges, Vertices
range_3 = Range(Domain=Domain(0, 1), Steps=Slider(3, range=1..20))
pt_4 = ConstructPoint(XCoordinate=range_3, YCoordinate=0, ZCoordinate=0)
iso_3 = IsoCurve(Surface=reparameterize(debrep_3.Faces), UVPoint=pt_4)  # -> UIsocurve, VIsocurve
crv_11 = Curve(iso_3.VIsocurve)

# ----
# you followed the cable.... you little rebel. I like you.
panel_10 = Panel(".")

# ---- group: and this is how the matrices up there are created...
panel_11 = Panel("""0
1
2
3""")
panel_12 = Panel("""0
1
2
3
4""")
dup = DuplicateData(Data=panel_11, Number="3", Order=True)
dup_2 = DuplicateData(Data=panel_12, Number="3", Order=True)
lng = ListLength(List=panel_11)
lng_2 = ListLength(List=panel_12)
matrix = ConstructMatrix(Rows="3", Columns=lng, Values=dup)
matrix_2 = ConstructMatrix(Rows="3", Columns=lng_2, Values=dup_2)

# ----
# {A;B}(i)
# i
# basically we change the direction in which the data is structured only between the curve and point level, leaving the group untouched
# 0
# 0
# B
# 1
# DON'T
# follow
# this
# cable!
# 2
# i
# A
# 0
# 1
# B
# 1
# DON'T
# follow
# this
# cable!
# 2
# {A;i}(B)
matrix_3 = DisplayMatrix(matrix, Digits=0)
matrix_4 = DisplayMatrix(matrix_2, Digits=0)

# ----
# single element
# all curves from Rhino
# cull index and wrap: Cull index eliminates the item at the given index from a list. When wrap is tru the list is treated as circular (think of hours in a clock, when you reach 12 you start back from 0)
crv_12 = Curve([<curve referenced from the Rhino model> x3])
explode_7 = Explode(Curve=crv_12, Recursive=True)  # -> Segments, Vertices
cull_i_7 = CullIndex(List=explode_7.Vertices, Indices="-1", Wrap="true")  # -> simplify(List)
vertical_fillet_4 = Slider(1.45, range=0..2)
loft_type_6 = ValueList({"Normal": 0, "Loose": 1, "Tight": 2, "Straight": 3, "Uniform": 4}, selected="Straight")
closed_6 = BooleanToggle(True)
loft_opt_6 = LoftOptions(Closed=closed_6, Adjust=False, Rebuild=0, Refit=0, Type=loft_type_6)

# ----
# Column system from base polyline
# 
# © a3 2018 _ Creative Commons Attribution-NonCommercial-ShareAlike3.0 UnportedLicense.
# duplicate points in closed polylines: In a closed polyline the first and the last point coincide but are 2 different points (notice points at index 0 and 4). We must erase one of them fom the list.
panel_13 = Panel(explode_7.Vertices)

# ---- group: flip matrix
flip_2 = FlipMatrix(Data=cull_i_7)

# ----
pline_8 = PolyLine(Vertices=flip_2, Closed=False)
# play with me
fillet_11 = Fillet(Curve=pline_8, Radius=vertical_fillet_4)  # -> flatten(Curve)
loft_6 = Loft(Curves=fillet_11, Options=loft_opt_6)
preview_6 = CustomPreview(Geometry=loft_6, Material=ColourSwatch(SwatchColor=RGB(255, 255, 255)))

# ----
# 3
# 2
# 0
# 3
# 2
# 0
# 4
# 1
# 3
# 1
# 3
# 0
# 0
# 4
# 2
# 3
# 1
# 0
# 1
# 2
# 2
# 1
# 4
# 3
# 0
# 2
# 1
panel_14 = Panel("0.5")

# ---- group: sort points, make curves & loft
crv_13 = Curve(move_5.Geometry)
explode_8 = Explode(Curve=crv_13, Recursive=True)  # -> Segments, Vertices
cull_i_8 = CullIndex(List=explode_8.Vertices, Indices="-1", Wrap=True)  # -> simplify(List)
viewer = ParamViewer(cull_i_8)
vertical_fillet_5 = Slider(1.45, range=0..2)
# Flip Matrix works when we have just one level of branching in the tree (branch, list item). But what when the tree has multiple branchings? In this case the different indexing levels are: curve group (A), curve (B), point (i).
# 
# The indexing and names - A, B, i and the use of {} and () - are conventions used by the Data tree indexing system. See also Path Mapper help on this.
loft_type_7 = ValueList({"Normal": 0, "Loose": 1, "Tight": 2, "Straight": 3, "Uniform": 4}, selected="Straight")
closed_7 = BooleanToggle(True)
loft_opt_7 = LoftOptions(Closed=closed_7, Adjust=False, Rebuild=0, Refit=0, Type=loft_type_7)

# ----
points = PointList(Points=cull_i_8, Size=panel_14)

# ---- group: can't use this here
flip_3 = FlipMatrix(Data=cull_i_8)  # disabled

# ---- group: introducing the Path Mapper
path_mapper_5 = PathMapper(cull_i_8, source="{A;B}(i)", target="{A;i}(B)")

# ---- group: sort points, make curves & loft (continued)
pline_9 = PolyLine(Vertices=path_mapper_5, Closed=False)
fillet_12 = Fillet(Curve=pline_9, Radius=vertical_fillet_5)

# ----
pshift_7 = ShiftPaths(Data=fillet_12, Offset=-1)

# ---- group: sort points, make curves & loft (continued)
loft_7 = Loft(Curves=pshift_7, Options=loft_opt_7)
preview_7 = CustomPreview(Geometry=loft_7, Material=ColourSwatch(SwatchColor=RGB(255, 255, 255)))
