# Grasshopper definition ZHA - Nurnberg Messe roof.gh (Grasshopper 1.0.7)
# Copyright: Co-de-iT
# plug-ins: Mesh Pipe

# ---- group: two beams - connections
number_slider = Slider(100, range=10..100)
crv = Curve([<curve referenced from the Rhino model> x2])
# curve system
crv_2 = Curve([<curve referenced from the Rhino model> x2])
divide = DivideCurve(Curve=crv, Count=number_slider, Kinks=False)  # -> Points, Tangents, Parameters
divide_2 = DivideCurve(Curve=crv_2, Count=number_slider, Kinks=False)  # -> Points, Tangents, Parameters
ln = Line(StartPoint=divide.Points, EndPoint=divide_2.Points)

# ---- group: single beam - connections
number_slider_2 = Slider(100, range=10..100)
crv_3 = Curve(<curve referenced from the Rhino model>)
crv_4 = Curve(<curve referenced from the Rhino model>)
divide_3 = DivideCurve(Curve=crv_3, Count=number_slider_2, Kinks=False)  # -> Points, Tangents, Parameters
divide_4 = DivideCurve(Curve=crv_4, Count=number_slider_2, Kinks=False)  # -> Points, Tangents, Parameters
ln_2 = Line(StartPoint=divide_3.Points, EndPoint=divide_4.Points)

# ---- group: single beam loft
# ZHA Nurnberg Messe roof
# 
# © a3 2018 _ Creative Commons Attribution-NonCommercial-ShareAlike3.0 UnportedLicense.
crv_5 = Curve(<curve referenced from the Rhino model>)
crv_6 = Curve(<curve referenced from the Rhino model>)
merge = Merge(Data1=crv_5, Data2=crv_6)
# play with me
loft = Loft(Curves=merge, Options={Adjust=False, Closed=False, LoftEnds=0, LoftSimp=0, LoftType=0, Rebuild=10, Refit=0.01})

# ---- group: skewed lines / curve A
crv_7 = Curve(<curve referenced from the Rhino model>)

# ---- group: skewed lines / curve B
crv_8 = Curve(<curve referenced from the Rhino model>)

# ---- group: parallel lines / curve A
crv_9 = Curve(<curve referenced from the Rhino model>)

# ---- group: parallel lines / curve B
crv_10 = Curve(<curve referenced from the Rhino model>)

# ---- group: skewed lines / curve A
crv_11 = Curve(<curve referenced from the Rhino model>)

# ---- group: skewed lines / curve B
crv_12 = Curve(<curve referenced from the Rhino model>)

# ----
merge_2 = Merge(Data1=crv_9, Data2=crv_10)
merge_3 = Merge(Data1=crv_7, Data2=crv_8)
merge_4 = Merge(Data1=crv_11, Data2=crv_12)

# ---- group: choose the scenario
curve_sets = ValueList({"set 0": 0, "set 1": 1, "set 2": 2}, selected="set 0")

# ---- group: stream filter
# Stream Filter: filters the data stream, choosing the gate that will get through. You can add as many gates as you need
filter = StreamFilter(Gate=curve_sets, Stream0=merge_2, Stream1=merge_3, Stream2=merge_4)

# ----
steps = Slider(20, range=0..20)
crv_13 = Curve(reparameterize(filter))
expression = Expression(x=steps, Expression="(x+1)*2")
item = ListItem(List=crv_13, Index=0, Wrap=True)  # -> Item, Item1
range = Range(Domain=Domain(0, 1), Steps=expression)

# ---- group: tween curves
tweencrv = TweenCurve(CurveA=item.Item, CurveB=item.Item1, Factor=range, BlendType=0)

# ---- group: parameters 't' for the control points to move
t0 = Slider(0, range=0..0.49)
t1 = Slider(0.116, range=0..0.49)
t2 = Slider(0.337, range=0..0.49)

# ---- group: separate upper and lower beams
panel = Panel("""1
0""")
dispatch = Dispatch(List=tweencrv, DispatchPattern=panel)  # -> ListA, ListB

# ---- group: alternates lower beams
panel_2 = Panel("""1
0""")
dispatch_2 = Dispatch(List=dispatch.ListA, DispatchPattern=panel_2)  # -> ListA, ListB

# ----
merge_5 = Merge(Data1=t0, Data2=t1, Data3=t2)

start_depth = Slider(-4.608, range=-10..0)
end_depth = Slider(-1.316, range=-10..0)

subtraction = Subtraction(A="1", B=merge_5)  # -> reverse(Result)
eval = EvaluateCurve(Curve=reparameterize(graft(dispatch_2.ListA)), Parameter=merge_5)  # -> Point, Tangent, Angle
eval_2 = EvaluateCurve(Curve=reparameterize(graft(dispatch_2.ListB)), Parameter=subtraction)  # -> Point, Tangent, Angle
Z = UnitZ(Factor=start_depth)
Z_2 = UnitZ(Factor=end_depth)
move = Move(Geometry=eval.Point, Motion=Z)  # -> simplify(Geometry), Transform
move_2 = Move(Geometry=eval_2.Point, Motion=Z_2)  # -> simplify(Geometry), Transform

# ---- group: associates shifted curves
viewer = ParamViewer(move.Geometry)
viewer_2 = ParamViewer(move_2.Geometry)
shift = ShiftList(List=viewer, Shift="1", Wrap="false")
shift_2 = ShiftList(List=viewer_2, Shift="-1", Wrap="false")
panel_3 = Panel(shift)
panel_4 = Panel(shift_2)
branch = TreeBranch(Tree=move.Geometry, Path=shift, MaintainPaths=False)
branch_2 = TreeBranch(Tree=move_2.Geometry, Path=shift_2, MaintainPaths=False)
merge_6 = Merge(Data1=branch, Data2=branch_2)

# ----
merge_7 = Merge(Data1=move.Geometry, Data2=move_2.Geometry)
nurbs = NurbsCurve(Vertices=merge_7, Degree=3, Periodic=False)  # -> flatten(Curve), Length, Domain
nurbs_2 = NurbsCurve(Vertices=merge_6, Degree=3, Periodic=False)  # -> flatten(Curve), Length, Domain
panel_5 = Panel("""0
1""")

# ---- group: lower beams
weave = Weave(Pattern=panel_5, Stream0=nurbs.Curve, Stream1=nurbs_2.Curve, NullGaps=False)  # -> simplify(graft(Weave))

# ---- group: upper beams
crv_14 = Curve(simplify(graft(dispatch.ListB)))

# ----
number_slider_3 = Slider(100, range=10..100)
divide_5 = DivideCurve(Curve=weave, Count=number_slider_3, Kinks=False)  # -> Points, Tangents, Parameters
divide_6 = DivideCurve(Curve=crv_14, Count=number_slider_3, Kinks=False)  # -> Points, Tangents, Parameters

# ---- group: cross connections
ln_3 = Line(StartPoint=divide_5.Points, EndPoint=divide_6.Points)

# ---- group: thickening the curves / cross connection meshes
mpipe = MeshPipe(Curve=ln_3, Radius=Slider(0.05, range=0..1), Accuracy="0.2", Rotation=0, Segments="4", Caps="1")

# ---- group: thickening the curves
number_slider_4 = Slider(0.25, range=0..1)

# ---- group: thickening the curves / lower beams meshes
mpipe_2 = MeshPipe(Curve=weave, Radius=number_slider_4, Accuracy="0.005", Rotation=0, Segments="4", Caps="1")

# ---- group: thickening the curves / upper beams meshes
mpipe_3 = MeshPipe(Curve=crv_14, Radius=number_slider_4, Accuracy="0.05", Rotation=0, Segments="4", Caps="1")

# ---- group: thickening the curves (continued)
mjoin = MeshJoin(Meshes=flatten([mpipe, mpipe_3, mpipe_2]))
