# Grasshopper definition a3_c04_curve-connections_advanced.gh (Grasshopper 1.0.7)
# Copyright: Co-de-iT

cross_sections = Slider(34, range=10..100)

# ---- group: any number of curves, picked IN ORDER
# connecting curves - complex case
crv = Curve(reparameterize([<curve referenced from the Rhino model> x4]))

# ----
# Curves - connections - complex case
# 
# © a3 2018 _ Creative Commons Attribution-NonCommercial-ShareAlike3.0 UnportedLicense.
divide = DivideCurve(Curve=crv, Count=cross_sections, Kinks=False)  # -> Points, Tangents, Parameters
dots = DotDisplay(Point=divide.Points, Colour=RGB(0, 0, 0), Size="0.5")

# ---- group: flip data matrix (cross section)
# WARNING: this part is OPTIONAL and has VERY COMPLEX Data Tree manipulation. Study it only for in-depth comprehension.
flip = FlipMatrix(Data=divide.Points)  # -> simplify(Data)

# ---- group: sort in couples to get average points
shift = ShiftList(List=flip, Shift="-1", Wrap="false")  # -> graft(List)
shift_2 = ShiftList(List=flip, Shift="1", Wrap="false")  # -> graft(List)
merge = Merge(Data1=shift, Data2=shift_2)  # -> simplify(Result)
avr = Average(Input=merge)
pshift = ShiftPaths(Data=avr, Offset=-1)

# ----
z_movement = Slider(17.091, range=0..20)

# ---- group: move average points
neg = Negative(Value=z_movement)
Z = UnitZ(Factor=neg)
move = Move(Geometry=pshift, Motion=Z)  # -> Geometry, Transform

# ---- group: weave average with curve points
panel = Panel("""0
1""")
weave = Weave(Pattern=panel, Stream0=flip, Stream1=move.Geometry, NullGaps=False)

# ---- group: sort points to form groups of 3 (triangular section)
lng = ListLength(List=crv)  # -> expr("x-1", Length)
series = Series(Start=0, Step="2", Count=lng)
series_2 = Series(Start=series, Step=1, Count="3")  # -> simplify(flatten(Series))
item = ListItem(List=weave, Index=series_2, Wrap=True)
partition = PartitionList(List=item, Size="3")

# ---- group: sort in couples to draw underneath beams
shift_3 = ShiftList(List=move.Geometry, Shift="-1", Wrap="false")  # -> graft(List)
shift_4 = ShiftList(List=move.Geometry, Shift="1", Wrap="false")  # -> graft(List)
merge_2 = Merge(Data1=shift_3, Data2=shift_4)  # -> simplify(Result)

# ----
panel_2 = Panel(series_2)
pline = PolyLine(Vertices=merge_2, Closed=False)
pline_2 = PolyLine(Vertices=partition, Closed=Toggle(True))
pshift_2 = ShiftPaths(Data=pline, Offset="1")

# ---- group: regroup by "beam" and loft
pshift_3 = ShiftPaths(Data=pline_2, Offset=-1)
path_mapper = PathMapper(pshift_3, source="{A}(i)", target="{i}(A)")
# A - index of the "beam"
# B - index of the cross section
# C - index of the curve
# i - index of the points
# 
# I want to have the points in the following order:
# 
# . first by curve (C)
# . then by each point index (i)
# . then by cross section (B)
loft = Loft(Curves=path_mapper, Options={Adjust=False, Closed=False, LoftEnds=0, LoftSimp=0, LoftType=0, Rebuild=10, Refit=0.01})

# ----
explode = Explode(Curve=path_mapper, Recursive=True)  # -> simplify(Segments), Vertices
divide_2 = DivideCurve(Curve=explode.Segments, Count=Slider(6, range=2..20), Kinks=False)  # -> Points, Tangents, Parameters
lng_2 = ListLength(List=pshift_2)  # -> expr("x-1", Length)
lng_3 = ListLength(List=path_mapper)  # -> expr("x-1", Length)
range = Range(Domain=Domain(0, 1), Steps=lng_2)  # -> reverse(Range)
cull_i = CullIndex(List=divide_2.Points, Indices="-1", Wrap=True)  # -> simplify(List)
range_2 = Range(Domain=Domain(0, 1), Steps=lng_3)
gradient = Gradient(LowerLimit=0, UpperLimit=1, Parameter=range, stops=[0.0345: RGB(137, 205, 240), 0.98: RGB(14, 26, 76)])
path_mapper_2 = PathMapper(cull_i, source="{A;B;C}(i)", target="{A;C;i}(B)")
gradient_2 = Gradient(LowerLimit=0, UpperLimit=1, Parameter=range_2, stops=[0.0345: RGB(137, 205, 240), 0.98: RGB(14, 26, 76)])
pline_3 = PolyLine(Vertices=path_mapper_2, Closed=False)
preview = CustomPreview(Geometry=pshift_2, Material=gradient)
preview_2 = CustomPreview(Geometry=path_mapper, Material=gradient_2)
