# Grasshopper definition a3_c05_grid-attractors_simple.gh (Grasshopper 1.0.7)
# Copyright: Co-de-iT
# plug-ins: Weaverbird

# ---- group: initial base surface
srf = Surface(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)

# ---- group: find lower left base point
# grid generation
bbox = BoundingBox(Content=srf, Plane=PlaneXY(0, 0, 0), UnionBox=True)  # -> Box, Box_2
# Grid with attractors - the complete version
# 
# There are a lot of parameters to play with. Read, try them and see what happens.
# 
# © a3 2018 _ Creative Commons Attribution-NonCommercial-ShareAlike3.0 UnportedLicense.
boxprop = BoxProperties(Box=bbox.Box)  # -> Center, Diagonal, Area, Volume, Degeneracy
multiplication = Multiplication(A=boxprop.Diagonal, B="-0.5")
addition = Addition(A=boxprop.Center, B=multiplication)

# ----
mesh_uv = MeshSurface(Surface=srf, UCount=Slider(24, range=2..50), VCount=Slider(16, range=2..50), Overhang=True, Equalize=False)
mesh_uv_2 = MeshSurface(Surface=srf, UCount="1", VCount="1", Overhang=True, Equalize=False)

# ---- group: sort vertices by face
demesh = DeconstructMesh(Mesh=mesh_uv)  # -> Vertices, Faces, Colours, Normals
deface = DeconstructFace(Face=demesh.Faces)  # -> CornerA, CornerB, CornerC, CornerD
merge = Merge(Data1=graft(deface.CornerA), Data2=graft(deface.CornerB), Data3=graft(deface.CornerC), Data4=graft(deface.CornerD))
item = ListItem(List=demesh.Vertices, Index=merge, Wrap=True)

# ----
demesh_2 = DeconstructMesh(Mesh=mesh_uv_2)  # -> Vertices, Faces, Colours, Normals

# ---- group: mesh triangulation
conmesh = ConstructMesh(Vertices=demesh_2.Vertices, Faces="T{1;3;0}")
conmesh_2 = ConstructMesh(Vertices=demesh_2.Vertices, Faces="T{0;2;3}")
mjoin = MeshJoin(Meshes=flatten([conmesh_2, conmesh]))

# ----
fixed_grid_type = ValueList({"rectangular": 0, "hex": 1}, selected="rectangular")
# 3
# 3
# 2
# 0
# 0
# 1
diagonal_dir = Slider(1, range=0..1)
hexgrid = Hexagonal(Plane=addition, Size=Slider(5, range=0..10), ExtentX=Slider(19, range=1..100), ExtentY=Slider(24, range=1..100))  # -> Cells, Points
recgrid = Rectangular(
    Plane=addition,
    SizeX=Slider(6.72, range=0..10),
    SizeY=Slider(7.948, range=0..10),
    ExtentX=Slider(19, range=1..100),
    ExtentY=Slider(24, range=1..100))  # -> Cells, Points
filter = StreamFilter(Gate=fixed_grid_type, Stream0=recgrid.Cells, Stream1=hexgrid.Cells)

# ---- group: face triangulation
panel = Panel("""T{1;2;0}
T{0;1;3}""")
# 2
# 1
panel_2 = Panel("""T{3;0;2}
T{2;3;1}""")
item_2 = ListItem(List=panel_2, Index=diagonal_dir, Wrap=True)
item_3 = ListItem(List=panel, Index=diagonal_dir, Wrap=True)
conmesh_3 = ConstructMesh(Vertices=item, Faces=item_2)
conmesh_4 = ConstructMesh(Vertices=item, Faces=item_3)
# from mesh - triangulated faces
mjoin_2 = MeshJoin(Meshes=flatten([conmesh_4, conmesh_3]))

# ----
wbtriangles = WeaverbirdsSplitTrianglesSubdivision(MeshCurves=mjoin, Level=Slider(3, range=1..3))

# ---- group: check if cells are inside the perimeter
pcen = PolygonCenter(Polyline=filter)  # -> CenterV, CenterE, CenterA
crv = Curve(srf)
incurve = PointInCurve(Point=pcen.CenterV, Curve=crv)  # -> Relationship, Point
larger = LargerThan(FirstNumber=incurve.Relationship, SecondNumber="1")  # -> LargerThan, OrEqualTo

# ----
wbtriangles_2 = WeaverbirdsSplitTrianglesSubdivision(MeshCurves=wbtriangles, Level=Slider(3, range=1..3))
wbtriangles_3 = WeaverbirdsSplitTrianglesSubdivision(MeshCurves=wbtriangles_2, Level=Slider(2, range=1..3))
# from mesh - quadrangular faces
faceb = FaceBoundaries(Mesh=mesh_uv)
faceb_2 = FaceBoundaries(Mesh=mjoin_2)
# from mesh - subdivided from low poly
faceb_3 = FaceBoundaries(Mesh=wbtriangles_3)
# fixed grid (rect or hex)
cull = CullPattern(List=filter, CullPattern=larger.LargerThan)  # -> flatten(List)
# grid type selection
grid_type = ValueList({"fixed": 0, "mesh-quad": 1, "mesh-tri": 2, "mesh-subd": 3}, selected="mesh-subd")
filter_2 = StreamFilter(Gate=grid_type, Stream0=cull, Stream1=faceb, Stream2=faceb_2, Stream3=faceb_3)

# ---- group: charge
number_slider = Slider(1, range=-1..1)
number_slider_2 = Slider(1, range=-1..1)
number_slider_3 = Slider(1, range=-1..1)

# ---- group: influence radius
number_slider_4 = Slider(52.769, range=1..100)
number_slider_5 = Slider(65.608, range=1..100)
number_slider_6 = Slider(30.048, range=1..100)

# ----
# attractor modulation
explode = Explode(Curve=filter_2, Recursive=True)  # -> Segments, Vertices

# ---- group: attractor points
pt = Point(Point(-12.30921278, 6.249610847, 0))
pt_2 = Point(Point(34.6045977, -50.43221859, 0))
pt_3 = Point(Point(34.6045977, 25.09179426, 0))

# ---- group: cells vertices
cull_i = CullIndex(List=explode.Vertices, Indices="-1", Wrap=True)  # -> simplify(graft(List))

# ---- group: attractor points
merge_2 = Merge(Data1=pt, Data2=pt_2, Data3=pt_3)

# ---- group: influence radius
merge_3 = Merge(Data1=number_slider_4, Data2=number_slider_5, Data3=number_slider_6)

# ---- group: charge
merge_4 = Merge(Data1=number_slider, Data2=number_slider_2, Data3=number_slider_3)

# ---- group: display attractors
text_size = Slider(2.525, range=0..10)
merge_5 = Merge(Data1=graft(merge_3), Data2=graft(merge_4))
panel_3 = Panel(""" Radius 
 Charge """)
Z = UnitZ(Factor=1)
concat = Concatenate(FragmentA=panel_3, FragmentB=merge_5)
line = LineSDL(Start=graft(merge_2), Direction=Z, Length=Slider(50, range=0..50))
join = TextJoin(Text=concat)
end = EndPoints(Curve=line)  # -> Start, simplify(End)
xz = XZPlane(Origin=end.End)
# display attractors
swatch = ColourSwatch(SwatchColor=RGB(48, 48, 48))
cir = Circle(Plane=merge_2, Radius=merge_3)
preview = CustomPreview(Geometry=[cir, line], Material=swatch)
dots = DotDisplay(Point=merge_2, Colour=swatch, Size=1)
tag = TextTag3D(Location=xz, Text=join, Size=text_size, Colour=ColourSwatch(SwatchColor=RGB(222, 222, 222)), Justification=7)

# ----
vec2pt = Vector2Pt(PointA=merge_2, PointB=cull_i, Unitize=False)  # -> Vector, Length

# ----
# combining attractors data
# here you decide how to combine data from multiple attractors. There are essentially 2 main logics:
# 
# . one makes an average from all the attracttors data
# . the other relies on the closest attractor to each sampled point
# 
# These two ways can be combined as well (i.e. direction from closest and intensity from averaging or the other way around)
# 
# Here below are a few combinations of the two logics.
unit = UnitVector(Vector=vec2pt.Vector)
min = Minimum(A=vec2pt.Length, B=merge_3)
# direction
limit_direction_influence_within_range = BooleanToggle(True)
filter_3 = StreamFilter(Gate=limit_direction_influence_within_range, Stream0="1", Stream1=min)
multiplication_2 = Multiplication(A=unit, B=merge_4, C=filter_3)
ma = MassAddition(Input=multiplication_2)  # -> Result, PartialResults

# ----
# intensity
abs = Absolute(Value=merge_4)
multiplication_3 = Multiplication(A=abs, B=min)
avr = Average(Input=multiplication_3)

# ---- group: modulate Z displacement (height)
# Z displacement
number_slider_7 = Slider(0, range=0..50)
num = Number(avr)
bnd = Bounds(Numbers=flatten(num))
dom = ConstructDomain(DomainStart=Slider(15.32, range=0..50), DomainEnd=number_slider_7)
remap = RemapNumbers(Value=num, Source=bnd, Target=Domain(0, 1))  # -> Mapped, Clipped
graph = GraphMapper(
    remap.Mapped,
    x0=0,
    x1=1,
    y0=0,
    y1=1,
    container_name="Bezier",
    cpx=[0, 0.6485562921, 0.6412829757, 1],
    cpy=[0, 0.003743886948, 1, 1])
remap_2 = RemapNumbers(Value=graph, Source=Domain(0, 1), Target=dom)  # -> Mapped, Clipped
Z_2 = UnitZ(Factor=remap_2.Mapped)
rev = Reverse(Vector=Z_2)

# ---- group: modulate XY displacement (distortion)
# XY displacement
number_slider_8 = Slider(10.317, range=0..50)
num_2 = Number(avr)
bnd_2 = Bounds(Numbers=flatten(num_2))
dom_2 = ConstructDomain(DomainStart=number_slider_8, DomainEnd=Slider(0, range=0..50))
remap_3 = RemapNumbers(Value=num_2, Source=bnd_2, Target=Domain(0, 1))  # -> Mapped, Clipped
graph_2 = GraphMapper(
    remap_3.Mapped,
    x0=0,
    x1=1,
    y0=0,
    y1=1,
    container_name="Bezier",
    cpx=[0, 0.3542780876, 0.4224599004, 1],
    cpy=[0, 0, 1, 1])
remap_4 = RemapNumbers(Value=graph_2, Source=Domain(0, 1), Target=dom_2)  # -> Mapped, Clipped

# ---- group: boundary influence / boundary
# modulation on combined attractors data
crv_2 = Curve(srf)

# ---- group: boundary influence
# boundary
crv_cp = CurveClosestPoint(Point=cull_i, Curve=crv_2)  # -> Point, Parameter, Distance
num_3 = Number(crv_cp.Distance)
bnd_3 = Bounds(Numbers=flatten(num_3))
dom_3 = ConstructDomain(DomainStart=0, DomainEnd=1)
remap_5 = RemapNumbers(Value=num_3, Source=bnd_3, Target=dom_3)  # -> Mapped, Clipped
graph_3 = GraphMapper(
    remap_5.Mapped,
    x0=0,
    x1=1,
    y0=0,
    y1=1,
    container_name="Bezier",
    cpx=[0, 0, 0.4523341954, 1],
    cpy=[0, 0.4728979468, 1, 1])

# ----
boundary_influence = BooleanToggle(False)
# combining all data
# boundary influence depends from the distance to the boundary (then remapped and manipulated with the graph mapper curve)
filter_4 = StreamFilter(Gate=boundary_influence, Stream0="1", Stream1=graph_3)
multiplication_4 = Multiplication(A=filter_4, B=remap_4.Mapped)
multiplication_5 = Multiplication(A=filter_4, B=rev)

# ---- group: combinjed vectors
vec = Vector(ma.Result)

# ---- group: combined intensities
num_4 = Number(multiplication_4)

# ---- group: XY distortion
amp = Amplitude(Vector=vec, Amplitude=num_4)

# ---- group: Z displacement
addition_2 = Addition(A=amp, B=multiplication_5)

# ---- group: move points
# rebuild grid and display
move = Move(Geometry=cull_i, Motion=addition_2)  # -> Geometry, Transform

# ---- group: rebuild cells polylines
pshift = ShiftPaths(Data=move.Geometry, Offset=-1)
pline = PolyLine(Vertices=pshift, Closed=Toggle(True))

# ----
vlen = VectorLength(Vector=addition_2)

# ---- group: display deformation heatmap
num_5 = Number(vlen)
bnd_4 = Bounds(Numbers=flatten(num_5))
dom_4 = ConstructDomain(DomainStart=0, DomainEnd=1)
remap_6 = RemapNumbers(Value=num_5, Source=bnd_4, Target=dom_4)  # -> Mapped, Clipped
gradient = Gradient(LowerLimit=0, UpperLimit=1, Parameter=remap_6.Mapped, stops=[0: RGB(255, 255, 255), 1: RGB(255, 0, 0)])

# ---- group: display vector Z displacement field
vdisex = VectorDisplayEx(Point=cull_i, Vector=multiplication_5, Colour=ColourSwatch(SwatchColor=RGB(46, 46, 46)), Width="1")

# ---- group: display vector XY displacement field
vdisex_2 = VectorDisplayEx(Point=cull_i, Vector=amp, Colour=ColourSwatch(SwatchColor=RGB(0, 0, 0)), Width="1")

# ---- group: display polylines
preview_2 = CustomPreview(
    Geometry=pline,
    Material={diffuse=RGB(221, 160, 221), emission=RGB(66, 48, 66), shine=0.5, specular=RGB(255, 255, 255), transparency=0})

# ---- group: display deformation vectors
vdisex_3 = VectorDisplayEx(Point=cull_i, Vector=addition_2, Colour=RGB(0, 0, 0), Width=2)

# ---- group: display deformation heatmap / this might get VEEERY slow
dots_2 = DotDisplay(Point=flatten(move.Geometry), Colour=flatten(gradient), Size=1)  # disabled
