# Grasshopper definition a3_c06_grid-attractors_complete.gh (Grasshopper 1.0.7)
# Copyright: Co-de-iT
# plug-ins: Weaverbird

# ---- group: initial base surface
srf = Surface(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)

# ---- group: find lower left base point
# grid generation
bbox = BoundingBox(Content=srf, Plane=PlaneXY(0, 0, 0), UnionBox=True)  # -> Box, Box_2
# Grid with attractors - the complete version
# 
# There are a lot of parameters to play with. Read, try them and see what happens.
# 
# © a3 2018 _ Creative Commons Attribution-NonCommercial-ShareAlike3.0 UnportedLicense.
boxprop = BoxProperties(Box=bbox.Box)  # -> Center, Diagonal, Area, Volume, Degeneracy
multiplication = Multiplication(A=boxprop.Diagonal, B="-0.5")
addition = Addition(A=boxprop.Center, B=multiplication)

# ----
mesh_uv = MeshSurface(Surface=srf, UCount=Slider(24, range=2..50), VCount=Slider(16, range=2..50), Overhang=True, Equalize=False)
mesh_uv_2 = MeshSurface(Surface=srf, UCount="1", VCount="1", Overhang=True, Equalize=False)

# ---- group: sort vertices by face
demesh = DeconstructMesh(Mesh=mesh_uv)  # -> Vertices, Faces, Colours, Normals
deface = DeconstructFace(Face=demesh.Faces)  # -> CornerA, CornerB, CornerC, CornerD
merge = Merge(Data1=graft(deface.CornerA), Data2=graft(deface.CornerB), Data3=graft(deface.CornerC), Data4=graft(deface.CornerD))
item = ListItem(List=demesh.Vertices, Index=merge, Wrap=True)

# ----
demesh_2 = DeconstructMesh(Mesh=mesh_uv_2)  # -> Vertices, Faces, Colours, Normals

# ---- group: mesh triangulation
conmesh = ConstructMesh(Vertices=demesh_2.Vertices, Faces="T{1;3;0}")
conmesh_2 = ConstructMesh(Vertices=demesh_2.Vertices, Faces="T{0;2;3}")
mjoin = MeshJoin(Meshes=flatten([conmesh_2, conmesh]))

# ----
fixed_grid_type = ValueList({"rectangular": 0, "hex": 1}, selected="rectangular")
# 3
# 3
# 2
# 0
# 0
# 1
diagonal_dir = Slider(1, range=0..1)
hexgrid = Hexagonal(Plane=addition, Size=Slider(5, range=0..10), ExtentX=Slider(19, range=1..100), ExtentY=Slider(24, range=1..100))  # -> Cells, Points
recgrid = Rectangular(
    Plane=addition,
    SizeX=Slider(6.72, range=0..10),
    SizeY=Slider(7.948, range=0..10),
    ExtentX=Slider(19, range=1..100),
    ExtentY=Slider(24, range=1..100))  # -> Cells, Points
filter = StreamFilter(Gate=fixed_grid_type, Stream0=recgrid.Cells, Stream1=hexgrid.Cells)

# ---- group: face triangulation
panel = Panel("""T{1;2;0}
T{0;1;3}""")
# 2
# 1
panel_2 = Panel("""T{3;0;2}
T{2;3;1}""")
item_2 = ListItem(List=panel_2, Index=diagonal_dir, Wrap=True)
item_3 = ListItem(List=panel, Index=diagonal_dir, Wrap=True)
conmesh_3 = ConstructMesh(Vertices=item, Faces=item_2)
conmesh_4 = ConstructMesh(Vertices=item, Faces=item_3)
# from mesh - triangulated faces
mjoin_2 = MeshJoin(Meshes=flatten([conmesh_4, conmesh_3]))

# ----
wbtriangles = WeaverbirdsSplitTrianglesSubdivision(MeshCurves=mjoin, Level=Slider(3, range=1..3))

# ---- group: check if cells are inside the perimeter
pcen = PolygonCenter(Polyline=filter)  # -> CenterV, CenterE, CenterA
crv = Curve(srf)
incurve = PointInCurve(Point=pcen.CenterV, Curve=crv)  # -> Relationship, Point
larger = LargerThan(FirstNumber=incurve.Relationship, SecondNumber="1")  # -> LargerThan, OrEqualTo

# ----
wbtriangles_2 = WeaverbirdsSplitTrianglesSubdivision(MeshCurves=wbtriangles, Level=Slider(3, range=1..3))
wbtriangles_3 = WeaverbirdsSplitTrianglesSubdivision(MeshCurves=wbtriangles_2, Level=Slider(2, range=1..3))
# from mesh - quadrangular faces
faceb = FaceBoundaries(Mesh=mesh_uv)
faceb_2 = FaceBoundaries(Mesh=mjoin_2)
# from mesh - subdivided from low poly
faceb_3 = FaceBoundaries(Mesh=wbtriangles_3)
# fixed grid (rect or hex)
cull = CullPattern(List=filter, CullPattern=larger.LargerThan)  # -> flatten(List)
# grid type selection
grid_type = ValueList({"fixed": 0, "mesh-quad": 1, "mesh-tri": 2, "mesh-subd": 3}, selected="mesh-subd")
filter_2 = StreamFilter(Gate=grid_type, Stream0=cull, Stream1=faceb, Stream2=faceb_2, Stream3=faceb_3)

# ---- group: charge
number_slider = Slider(1, range=-1..1)
number_slider_2 = Slider(1, range=-1..1)
number_slider_3 = Slider(1, range=-1..1)

# ---- group: influence radius
number_slider_4 = Slider(52.769, range=1..100)
number_slider_5 = Slider(65.608, range=1..100)
number_slider_6 = Slider(30.048, range=1..100)

# ----
# attractor modulation
explode = Explode(Curve=filter_2, Recursive=True)  # -> Segments, Vertices

# ---- group: attractor points
pt = Point(Point(-12.30921278, 6.249610847, 0))
pt_2 = Point(Point(34.6045977, -50.43221859, 0))
pt_3 = Point(Point(34.6045977, 25.09179426, 0))

# ---- group: cells vertices
cull_i = CullIndex(List=explode.Vertices, Indices="-1", Wrap=True)  # -> simplify(graft(List))

# ---- group: attractor points
merge_2 = Merge(Data1=pt, Data2=pt_2, Data3=pt_3)

# ---- group: influence radius
merge_3 = Merge(Data1=number_slider_4, Data2=number_slider_5, Data3=number_slider_6)

# ---- group: charge
merge_4 = Merge(Data1=number_slider, Data2=number_slider_2, Data3=number_slider_3)

# ---- group: display attractors
text_size = Slider(2.525, range=0..10)
merge_5 = Merge(Data1=graft(merge_3), Data2=graft(merge_4))
panel_3 = Panel(""" Radius 
 Charge """)
Z = UnitZ(Factor=1)
concat = Concatenate(FragmentA=panel_3, FragmentB=merge_5)
line = LineSDL(Start=graft(merge_2), Direction=Z, Length=Slider(50, range=0..50))
join = TextJoin(Text=concat)
end = EndPoints(Curve=line)  # -> Start, simplify(End)
xz = XZPlane(Origin=end.End)
# display attractors
swatch = ColourSwatch(SwatchColor=RGB(48, 48, 48))
cir = Circle(Plane=merge_2, Radius=merge_3)
preview = CustomPreview(Geometry=[cir, line], Material=swatch)
dots = DotDisplay(Point=merge_2, Colour=swatch, Size=1)
tag = TextTag3D(Location=xz, Text=join, Size=text_size, Colour=ColourSwatch(SwatchColor=RGB(222, 222, 222)), Justification=7)

# ----
vec2pt = Vector2Pt(PointA=merge_2, PointB=cull_i, Unitize=False)  # -> Vector, Length

# ---- group: boundary influence / boundary
# modulation on combined attractors data
crv_2 = Curve(srf)

# ---- group: boundary influence
# boundary
crv_cp = CurveClosestPoint(Point=cull_i, Curve=crv_2)  # -> Point, Parameter, Distance
num = Number(crv_cp.Distance)
bnd = Bounds(Numbers=flatten(num))
dom = ConstructDomain(DomainStart=0, DomainEnd=1)
remap = RemapNumbers(Value=num, Source=bnd, Target=dom)  # -> Mapped, Clipped
graph = GraphMapper(remap.Mapped, x0=0, x1=1, y0=0, y1=1, container_name="Bezier", cpx=[0, 0, 0.4523341954, 1], cpy=[0, 0.4728979468, 1, 1])

# ----
boundary_influence = BooleanToggle(False)
# combining all data
# boundary influence depends from the distance to the boundary (then remapped and manipulated with the graph mapper curve)
filter_3 = StreamFilter(Gate=boundary_influence, Stream0="1", Stream1=graph)

# ----
# pre-modulation
# (on individual attractors)
# here you can manipulate data from individual attractors (i.e. change its decay rate, the influence curve, etc.).
# 
# You can act on the vector direction or its intensity using the attractor's raiuds of influence and its charge.
# direction
# here you can decide whether to apply or not the previous modulation (which influences the influence decay within the attractor's radius)
# power (A^B) changes the distribution of data. if set between 0 and 1 it equals to a root (0.5 is the square root). It can smooth out or narrow the attractors influence.
unit = UnitVector(Vector=vec2pt.Vector)
min = Minimum(A=vec2pt.Length, B=merge_3)
# combining attractors data
# here you decide how to combine data from multiple attractors. There are essentially 2 main logics:
# 
# . one makes an average from all the attracttors data
# . the other relies on the closest attractor to each sampled point
# 
# These two ways can be combined as well (i.e. direction from closest and intensity from averaging or the other way around)
# 
# Here below are a few combinations of the two logics.
modulate_direction_within_range = BooleanToggle(True)
power = Slider(1, range=0..3)
attractor_range_modulation_on_intensity = BooleanToggle(True)

# ----
# Average is the regular average for values.
# 
# Inverse average is made inverting data (1/x) to which previously an elevation to power has been applied. After averaging the data is inverted again.
abs = Absolute(Value=merge_4)
# intensity
multiplication_2 = Multiplication(A=abs, B=min)
power_2 = Slider(3, range=0..3)
pow = Power(A=multiplication_2, B=power_2)
one_over_x = OneOverX(Value=pow)
avr = Average(Input=one_over_x)
inverse_average = BooleanToggle(True)
avr_2 = Average(Input=multiplication_2)
one_over_x_2 = OneOverX(Value=avr)
filter_4 = StreamFilter(Gate=inverse_average, Stream0=avr_2, Stream1=one_over_x_2)

# ---- group: attractor range modulation & decay
division = Division(A=min, B=merge_3)
subtraction = Subtraction(A="1", B=division)
graph_2 = GraphMapper(subtraction, x0=0, x1=1, y0=0, y1=1, container_name="Bezier", cpx=[0, 0, 1, 1], cpy=[0, 1, 0, 1])

# ---- group: chooses nearest non zero influence
equals = Equality(FirstNumber=graph_2, SecondNumber="0")  # -> Equality, Inequality
dispatch = Dispatch(List=graph_2, DispatchPattern=equals.Equality)  # -> ListA, ListB
addition_2 = Addition(A=dispatch.ListA, B=1)
weave = Weave(Pattern=equals.Equality, Stream0=dispatch.ListB, Stream1=addition_2, NullGaps=False)
sort = SortList(Keys=weave)  # -> Keys, ValuesA
item_4 = ListItem(List=sort.Keys, Index=0, Wrap=True)

# ----
filter_5 = StreamFilter(Gate=modulate_direction_within_range, Stream0="1", Stream1=graph_2)
multiplication_3 = Multiplication(A=unit, B=merge_4, C=filter_5)
pow_2 = Power(A=item_4, B=power)
ma = MassAddition(Input=multiplication_3)  # -> Result, PartialResults
filter_6 = StreamFilter(Gate=attractor_range_modulation_on_intensity, Stream0="1", Stream1=pow_2)

# ---- group: modulate Z displacement (height)
# Z displacement
number_slider_7 = Slider(0, range=0..50)
num_2 = Number(filter_4)
bnd_2 = Bounds(Numbers=flatten(num_2))
dom_2 = ConstructDomain(DomainStart=Slider(15.32, range=0..50), DomainEnd=number_slider_7)
remap_2 = RemapNumbers(Value=num_2, Source=bnd_2, Target=Domain(0, 1))  # -> Mapped, Clipped
graph_3 = GraphMapper(
    remap_2.Mapped,
    x0=0,
    x1=1,
    y0=0,
    y1=1,
    container_name="Bezier",
    cpx=[0, 0.6485562921, 0.6412829757, 1],
    cpy=[0, 0.003743886948, 1, 1])
remap_3 = RemapNumbers(Value=graph_3, Source=Domain(0, 1), Target=dom_2)  # -> Mapped, Clipped
Z_2 = UnitZ(Factor=remap_3.Mapped)
rev = Reverse(Vector=Z_2)

# ---- group: modulate XY displacement (distortion)
# XY displacement
number_slider_8 = Slider(10.317, range=0..50)
num_3 = Number(filter_4)
bnd_3 = Bounds(Numbers=flatten(num_3))
dom_3 = ConstructDomain(DomainStart=number_slider_8, DomainEnd=Slider(0, range=0..50))
remap_4 = RemapNumbers(Value=num_3, Source=bnd_3, Target=Domain(0, 1))  # -> Mapped, Clipped
graph_4 = GraphMapper(
    remap_4.Mapped,
    x0=0,
    x1=1,
    y0=0,
    y1=1,
    container_name="Bezier",
    cpx=[0, 0.3542780876, 0.4224599004, 1],
    cpy=[0, 0, 1, 1])
remap_5 = RemapNumbers(Value=graph_4, Source=Domain(0, 1), Target=dom_3)  # -> Mapped, Clipped

# ----
multiplication_4 = Multiplication(A=filter_3, B=filter_6, C=remap_5.Mapped)
multiplication_5 = Multiplication(A=filter_3, B=rev)

# ---- group: combinjed vectors
vec = Vector(ma.Result)

# ---- group: combined intensities
num_4 = Number(multiplication_4)

# ---- group: XY distortion
amp = Amplitude(Vector=vec, Amplitude=num_4)

# ---- group: Z displacement
addition_3 = Addition(A=amp, B=multiplication_5)

# ---- group: move points
# rebuild grid and display
move = Move(Geometry=cull_i, Motion=addition_3)  # -> Geometry, Transform

# ---- group: rebuild cells polylines
pshift = ShiftPaths(Data=move.Geometry, Offset=-1)
pline = PolyLine(Vertices=pshift, Closed=Toggle(True))

# ----
vlen = VectorLength(Vector=addition_3)

# ---- group: display deformation heatmap
num_5 = Number(vlen)
bnd_4 = Bounds(Numbers=flatten(num_5))
dom_4 = ConstructDomain(DomainStart=0, DomainEnd=1)
remap_6 = RemapNumbers(Value=num_5, Source=bnd_4, Target=dom_4)  # -> Mapped, Clipped
gradient = Gradient(LowerLimit=0, UpperLimit=1, Parameter=remap_6.Mapped, stops=[0: RGB(255, 255, 255), 1: RGB(255, 0, 0)])

# ---- group: display vector Z displacement field
vdisex = VectorDisplayEx(Point=cull_i, Vector=multiplication_5, Colour=ColourSwatch(SwatchColor=RGB(46, 46, 46)), Width="1")

# ---- group: display vector XY displacement field
vdisex_2 = VectorDisplayEx(Point=cull_i, Vector=amp, Colour=ColourSwatch(SwatchColor=RGB(0, 0, 0)), Width="1")

# ---- group: display polylines
preview_2 = CustomPreview(
    Geometry=pline,
    Material={diffuse=RGB(221, 160, 221), emission=RGB(66, 48, 66), shine=0.5, specular=RGB(255, 255, 255), transparency=0})

# ---- group: display deformation vectors
vdisex_3 = VectorDisplayEx(Point=cull_i, Vector=addition_3, Colour=RGB(0, 0, 0), Width=2)

# ---- group: display deformation heatmap / this might get VEEERY slow
dots_2 = DotDisplay(Point=flatten(move.Geometry), Colour=flatten(gradient), Size=1)  # disabled
