# Grasshopper definition a3_cXX_curve proliferation_multicurve.gh (Grasshopper 1.0.7)
# Copyright: Co-de-iT

# ---- group: array di curve lineare
crv = Curve([<curve referenced from the Rhino model> x3])

# ----
toggle = BooleanToggle(False)

# ----
# curve ordinate per coppie
panel = Panel("1")
# curve proliferation - multiple curves
# 
# © a3 2018 _ Creative Commons Attribution-NonCommercial-ShareAlike3.0 UnportedLicense.
shift = ShiftList(List=crv, Shift=panel, Wrap=toggle)  # -> graft(List)
shift_2 = ShiftList(List=crv, Shift="-1", Wrap=toggle)  # -> graft(List)
merge = Merge(Data1=simplify(shift), Data2=simplify(shift_2))

divide = DivideCurve(Curve=merge, Count=Slider(63, range=2..200), Kinks=False)  # -> Points, Tangents, Parameters
# punti riordinati per direzione relativa: da un lato tutti i punti a sx delle rispettive curve, dall'altro quelli a dx
viewer = ParamViewer(divide.Points)
path_mapper = PathMapper(divide.Points, source="{A;B}(i)", target="{A;i}")
viewer_2 = ParamViewer(path_mapper)
item = ListItem(List=path_mapper, Index=0, Wrap=True)  # -> Item, Item1
threshold = Slider(15, range=0..30)
# point calculation: i punti vengono spostati verso il punto medio con la curva vicina. Se la distanza di spostamento supera la soglia si prende la soglia come spostamento, altrimenti i due punti vanno a coincidere sulla mezzeria tra le curve. In quest'ultimo caso, i punti vengono anche spostati lungo la verticale
vec2pt = Vector2Pt(PointA=item.Item, PointB=item.Item1, Unitize=False)  # -> Vector, Length
division = Division(A=vec2pt.Length, B=2)
rev = Reverse(Vector=vec2pt.Vector)
smaller = SmallerThan(FirstNumber=division, SecondNumber=threshold)  # -> SmallerThan, OrEqualTo

# ----
# i punti la cui distanza recicproca è sotto la soglia si elevano in z proporzionalmente a quanto la distanza si scosta dalla soglia stessa
z_amplifier = Slider(12.038, range=0..20)
subtraction = Subtraction(A=threshold, B=division)
dispatch = Dispatch(List=subtraction, DispatchPattern=smaller.SmallerThan)  # -> ListA, ListB
bnd = Bounds(Numbers=flatten(dispatch.ListA))
remap = RemapNumbers(Value=dispatch.ListA, Source=bnd, Target=Domain(0, 1))  # -> Mapped, Clipped
graph = GraphMapper(remap.Mapped, x0=0, x1=1, y0=0, y1=1, container_name="Bezier", cpx=[0, 0.4162856936, 0.817124486, 1], cpy=[0, 0, 1, 1])
multiplication = Multiplication(A=graph, B=z_amplifier)
Z = UnitZ(Factor=multiplication)

min = Minimum(A=division, B=threshold)
merge_2 = Merge(Data1=vec2pt.Vector, Data2=rev)
amp = Amplitude(Vector=merge_2, Amplitude=min)
dispatch_2 = Dispatch(List=amp, DispatchPattern=smaller.SmallerThan)  # -> ListA, ListB
addition = Addition(A=dispatch_2.ListA, B=Z)
weave = Weave(Pattern=smaller.SmallerThan, Stream0=dispatch_2.ListB, Stream1=addition, NullGaps=False)

# ---- group: attrattore che varia le altezze delle catenarie
crv_2 = Curve(reparameterize(<curve referenced from the Rhino model>))
eval = EvaluateCurve(Curve=crv_2, Parameter=Slider(0.293, range=0..1))  # -> Point, Tangent, Angle

# ----
move = Move(Geometry=path_mapper, Motion=weave)  # -> graft(Geometry), Transform
graft = GraftTree(Tree=path_mapper, IncludeEmptyLists=True, IncludeNullItems=True)
merge_3 = Merge(Data1=graft, Data2=move.Geometry)
avr = Average(Input=merge_3)
height = Panel("variazione dell'altezza")
preview = CustomPreview(Geometry=[crv_2, eval.Point], Shader=ColourSwatch(SwatchColor=RGB(255, 255, 255)))
item_2 = ListItem(List=merge_3, Index=0, Wrap=True)  # -> Item, Item1
dist = Distance(PointA=eval.Point, PointB=avr)

# ---- group: parametri per l'altezza
min_height = Slider(1.33, range=1..2)
variation = Slider(2.483, range=0..5)

# ----
bnd_2 = Bounds(Numbers=flatten(dist))
pshift = ShiftPaths(Data=item_2.Item1, Offset=-1)  # -> simplify(Data)
dist_2 = Distance(PointA=item_2.Item, PointB=item_2.Item1)
remap_2 = RemapNumbers(Value=dist, Source=bnd_2, Target=Domain(0, 1))  # -> Mapped, Clipped
path_mapper_2 = PathMapper(pshift, source="{A;B}(i)", target="{A;i}")
graph_2 = GraphMapper(
    remap_2.Mapped,
    x0=0,
    x1=1,
    y0=0,
    y1=1,
    container_name="Bezier",
    cpx=[0, 0.1347833127, 0.07318911701, 1],
    cpy=[1, 1, 0, 0])
intcrv = Interpolate(Vertices=path_mapper_2, Degree=3, Periodic=False, KnotStyle=1)  # -> Curve, Length, Domain
multiplication_2 = Multiplication(A=variation, B=graph_2)
addition_2 = Addition(A=multiplication_2, B=min_height)
multiplication_3 = Multiplication(A=dist_2, B=addition_2)
Z_2 = UnitZ(Factor=1)
cat = Catenary(PointA=item_2.Item, PointB=item_2.Item1, Length=multiplication_3, Gravity=Z_2)
pshift_2 = ShiftPaths(Data=cat, Offset=-1)
path_mapper_3 = PathMapper(pshift_2, source="{A;B}(i)", target="{A;i}")
item_3 = ListItem(List=path_mapper_3, Index=0, Wrap=True)
flip = FlipCurve(Curve=path_mapper_3, Guide=item_3)  # -> Curve, Flag
divide_2 = DivideCurve(Curve=flip.Curve, Count="2", Kinks=False)  # -> Points, Tangents, Parameters
item_4 = ListItem(List=divide_2.Points, Index=0, Wrap=True)  # -> Item, Item1, Item2
intcrv_2 = Interpolate(Vertices=divide_2.Points, Degree=3, Periodic=False, KnotStyle=1)  # -> Curve, Length, Domain
pshift_3 = ShiftPaths(Data=item_4.Item1, Offset=-1)
pshift_4 = ShiftPaths(Data=item_4.Item, Offset=-1)
pshift_5 = ShiftPaths(Data=item_4.Item2, Offset=-1)
pshift_6 = ShiftPaths(Data=intcrv_2.Curve, Offset=-1)
shift_3 = ShiftList(List=pshift_3, Shift=1, Wrap=False)
loft = Loft(Curves=pshift_6, Options={Adjust=False, Closed=False, LoftEnds=0, LoftSimp=0, LoftType=0, Rebuild=10, Refit=0.01})
shift_4 = ShiftList(List=pshift_4, Shift="-1", Wrap=False)
shift_5 = ShiftList(List=pshift_5, Shift="-1", Wrap=False)
merge_4 = Merge(Data1=graft(shift_4), Data2=graft(shift_3), Data3=graft(shift_5))
intcrv_3 = Interpolate(Vertices=merge_4, Degree=3, Periodic=False, KnotStyle=1)  # -> Curve, Length, Domain
preview_2 = CustomPreview(Geometry=intcrv_3.Curve, Shader=ColourSwatch(SwatchColor=RGB(150, 150, 150)))
preview_3 = CustomPreview(Geometry=intcrv_2.Curve, Shader=ColourSwatch(SwatchColor=RGB(214, 214, 214)))
