# Grasshopper definition a3_cXX_curves infill pattern.gh (Grasshopper 1.0.7)
# Copyright: Co-de-iT

number_slider = Slider(10, range=10..200)
crv = Curve(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)
crv_2 = Curve(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)
crv_3 = Curve(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)
# Curves infill pattern
# 
# © a3 2018 _ Creative Commons Attribution-NonCommercial-ShareAlike3.0 UnportedLicense.
crv_4 = Curve(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)
boundary = ValueList({"two curves": 0, "outer/inner curve": 1}, selected="outer/inner curve")
divide = DivideCurve(Curve=crv_2, Count=Slider(96, range=10..200), Kinks=False)  # -> Points, Tangents, Parameters
crv_cp = CurveClosestPoint(Point=divide.Points, Curve=crv)  # -> Point, Parameter, Distance
divide_2 = DivideCurve(Curve=crv_4, Count=number_slider, Kinks=False)  # -> Points, Tangents, Parameters
divide_3 = DivideCurve(Curve=crv_3, Count=number_slider, Kinks=False)  # -> Points, Tangents, Parameters
merge = Merge(Data1=graft(divide.Points), Data2=graft(crv_cp.Point))
merge_2 = Merge(Data1=graft(divide_2.Points), Data2=graft(divide_3.Points))
filter = StreamFilter(Gate=boundary, Stream0=[crv_4, crv_3], Stream1=[crv_2, crv])
filter_2 = StreamFilter(Gate=boundary, Stream0=merge_2, Stream1=merge)
preview = CustomPreview(Geometry=filter, Material=ColourSwatch(SwatchColor=RGB(0, 0, 0)))
range = Range(Domain=Domain(0, 1), Steps=Slider(20, range=2..50))
interp = InterpolateData(Data=filter_2, Parameter=range, Interpolation=2)
flip = FlipMatrix(Data=interp)
panel = Panel("""0
-1""")
intcrv = Interpolate(Vertices=flip, Degree=3, Periodic=False, KnotStyle=1)  # -> reparameterize(flatten(Curve)), Length, Domain
cull_i = CullIndex(List=intcrv.Curve, Indices=panel, Wrap=True)
divide_4 = DivideCurve(Curve=cull_i, Count=expr("x*2", Slider(44, range=2..50)), Kinks=False)  # -> Points, Tangents, Parameters
lng = ListLength(List=cull_i)
graph = GraphMapper(
    divide_4.Parameters,
    x0=0,
    x1=1,
    y0=0,
    y1=1,
    container_name="Sine",
    Equation_px=[0, 0.2826086879],
    Equation_py=[0, 0.5217391253])
graph_2 = GraphMapper(divide_4.Parameters, x0=0, x1=1, y0=0, y1=1, container_name="Sine", Equation_px=[0, 0.1884057969], Equation_py=[0, 1])
graph_3 = GraphMapper(
    divide_4.Parameters,
    x0=0,
    x1=1,
    y0=0,
    y1=1,
    container_name="Sine",
    Equation_px=[0, 1],
    Equation_py=[0.289855063, 0.741496563])
graph_4 = GraphMapper(
    divide_4.Parameters,
    x0=0,
    x1=1,
    y0=0,
    y1=1,
    container_name="Bezier",
    cpx=[0, 0.885338366, 0.1616541296, 1],
    cpy=[0, 0, 1, 1])
graph_5 = GraphMapper(divide_4.Parameters, x0=0, x1=1, y0=0, y1=1, container_name="Sine", Equation_px=[0.009398495778, 1], Equation_py=[0, 1])
graph_type = Slider(4, range=0..4)
filter_3 = StreamFilter(Gate=graph_type, Stream0=graph, Stream1=graph_2, Stream2=graph_3, Stream3=graph_5, Stream4=graph_4)
panel_2 = Panel("""true
false""")
repeat = RepeatData(Data=panel_2, Length=lng)  # -> graft(Data)
shatter = Shatter(Curve=graft(cull_i), Parameters=filter_3)
not = GateNot(A=repeat)
lng_2 = ListLength(List=divide_4.Parameters)  # -> expr("x-1", Length)
merge_3 = Merge(Data1=repeat, Data2=not)
repeat_2 = RepeatData(Data=merge_3, Length=lng_2)
dispatch = Dispatch(List=shatter, DispatchPattern=repeat_2)  # -> ListA, ListB
crv_5 = Curve(dispatch.ListA)
preview_2 = CustomPreview(Geometry=crv_5, Material=ColourSwatch(SwatchColor=RGB(255, 255, 255)))
