# Grasshopper definition 20181009_c01_in class.gh (Grasshopper 1.0.7)
# Copyright: Co-de-iT

pt = Point([<point referenced from the Rhino model> x6])
panel = Panel("""0
0.2
0.4
0.6
0.8
1""")
pt_2 = Point(Point(16.45694046, 50, 0))
pt_3 = Point([<point referenced from the Rhino model> x2])
line = LineSDL(Direction=Vector(0, 0, 1), Length=1)
number_slider = Slider(0.487, range=0..1)
crv = Curve(reparameterize(<curve referenced from the Rhino model>))
crv_2 = Curve(reparameterize(<curve referenced from the Rhino model>))
ln = Line(StartPoint=pt, EndPoint=pt_3)
series = Series(Start=0, Step=1, Count=10)
range = Range(Domain=Domain(0, 1), Steps=Slider(245, range=2..1000))
# File template
# 
# © a3 2018 _ Creative Commons Attribution-NonCommercial-ShareAlike3.0 UnportedLicense.
panel_2 = Panel(pt)
panel_3 = Panel(ln)
vec = Vector(ln)
crv_3 = Curve([<curve referenced from the Rhino model> x2])
domain = Domain(crv_2)
domain_2 = Domain(crv)
panel_4 = Panel(series)
graft = GraftTree(IncludeEmptyLists=True, IncludeNullItems=True)
panel_5 = Panel(domain)
eval = EvaluateCurve(Curve=crv, Parameter=range)  # -> Point, Tangent, Angle
eval_2 = EvaluateCurve(Curve=crv_2, Parameter=range)  # -> Point, Tangent, Angle
divide = DivideCurve(Curve=crv_3, Count=Slider(35, range=2..100), Kinks=False)  # -> Points, Tangents, Parameters
flatten = FlattenTree(Tree=divide.Points, Path="{0}")
panel_6 = Panel(domain_2)
panel_7 = Panel(pt_3)
viewer = ParamViewer(divide.Points)
flip = FlipMatrix(Data=divide.Points)
viewer_2 = ParamViewer(flip)
ln_2 = Line(StartPoint=eval.Point, EndPoint=eval_2.Point)
panel_8 = Panel(range)
pline = PolyLine(Vertices=divide.Points, Closed=False)
panel_9 = Panel(divide.Points)
panel_10 = Panel(pline)
panel_11 = Panel(flip)
n_divisions = Slider(98, range=1..500)
pline_2 = PolyLine(Vertices=flip, Closed=Toggle(True))
divide_2 = DivideCurve(Curve=pline_2, Count=Slider(15, range=2..20), Kinks=False)  # -> Points, Tangents, Parameters
divide_3 = DivideCurve(Curve=crv, Count="30", Kinks=False)  # -> Points, Tangents, Parameters
divide_4 = DivideCurve(Curve=crv_2, Count=n_divisions, Kinks=False)  # -> Points, Tangents, Parameters
panel_12 = Panel(pline_2)
flip_2 = FlipMatrix(Data=divide_2.Points)
ln_3 = Line(StartPoint=divide_3.Points, EndPoint=divide_4.Points)
points = PointList(Points=flip_2, Size=Slider(3.755, range=1..20))
pline_3 = PolyLine(Vertices=flip_2, Closed=False)
len = Length(Curve=ln_3)
crv_4 = Curve([<curve referenced from the Rhino model> x4])
ma = MassAddition(Input=len)  # -> Result, PartialResults
panel_13 = Panel(ma.Result)
divide_5 = DivideCurve(Curve=crv_4, Count=Slider(17, range=2..100), Kinks=False)  # -> Points, Tangents, Parameters
flip_3 = FlipMatrix(Data=divide_5.Points)
shift = ShiftList(List=flip_3, Shift="1", Wrap="false")
shift_2 = ShiftList(List=flip_3, Shift="-1", Wrap="false")
merge = Merge(Data1=graft(shift_2), Data2=graft(shift))  # -> simplify(Result)
pshift = ShiftPaths(Data=merge, Offset=-1)
avr = Average(Input=merge)
Z = UnitZ(Factor=Slider(-11.56, range=-50..0))
move = Move(Geometry=avr, Motion=Z)  # -> Geometry, Transform
viewer_3 = ParamViewer(avr)
pshift_2 = ShiftPaths(Data=move.Geometry, Offset=-1)
ins = InsertItems(List=merge, Item=move.Geometry, Indices="1", Wrap=True)
flip_4 = FlipMatrix(Data=pshift_2)
intcrv = Interpolate(Vertices=flip_4, Degree=3, Periodic=False, KnotStyle=1)  # -> Curve, Length, Domain
pline_4 = PolyLine(Vertices=ins, Closed=Toggle(True))  # -> simplify(Polyline)
pshift_3 = ShiftPaths(Data=pline_4, Offset=-1)
flip_5 = FlipMatrix(Data=pshift_3)
loft = Loft(Curves=flip_5, Options={Adjust=False, Closed=False, LoftEnds=0, LoftSimp=0, LoftType=0, Rebuild=10, Refit=0.01})
viewer_4 = ParamViewer(flip_5)
