# Grasshopper definition 20181016_c02_in class.gh (Grasshopper 1.0.7)
# Copyright: Co-de-iT

# surfaces
number_slider = Slider(0.641, range=0..1)
crv = Curve(reparameterize(<curve referenced from the Rhino model>))
# download material from:
# 
# https://iol.unibo.it/course/view.php?id=24902
# https://github.com/Co-de-iT/froGH/releases
crv_2 = Curve(reparameterize(<curve referenced from the Rhino model>))

# ---- group: trimmed
srf = Surface(<surface referenced from the Rhino model>)

# ---- group: vertical loft
srf_2 = Surface(<surface referenced from the Rhino model>)

# ---- group: hypar
srf_3 = Surface(<surface referenced from the Rhino model>)

# ---- group: planar skewed
srf_4 = Surface(<surface referenced from the Rhino model>)

# ---- group: planar rectangle
srf_5 = Surface(<surface referenced from the Rhino model>)

# ---- group: hypar
srf_6 = Surface(reparameterize(<surface referenced from the Rhino model>))

# ----
crv_3 = Curve([<curve referenced from the Rhino model> x3])
# for a more detailed version see
# 
# column4pt
# 
# modeling example
srf_7 = Surface(reparameterize(<surface referenced from the Rhino model>))
dom²num = ConstructDomain²(UMin=0, UMax=1, VMin=0, VMax=1)
range = Range(Domain=Domain(0, 1), Steps=Slider(60, range=2..200))
panel = Panel(range)
# curves (recall)
domain = Domain(crv_2)
eval = EvaluateCurve(Curve=crv, Parameter=number_slider)  # -> Point, Tangent, Angle
domain_2 = Domain(crv)
loft = Loft(Curves=crv_3, Options={Adjust=False, Closed=False, LoftEnds=0, LoftSimp=0, LoftType=0, Rebuild=10, Refit=0.01})
dom = ConstructDomain(DomainStart=0, DomainEnd=1)
domain² = Domain²(srf_7)
eval_2 = EvaluateCurve(Curve=crv_2, Parameter=Slider(0.318, range=0..1))  # -> Point, Tangent, Angle
# 16/10/2018 - in class tutorial
# 
# © a3 2018 _ Creative Commons Attribution-NonCommercial-ShareAlike3.0 UnportedLicense.
panel_2 = Panel(domain)
panel_3 = Panel(domain_2)
Y = UnitY(Factor="80")
# try connecting different surfaces in here
srf_8 = Surface(reparameterize(srf_4))
srf_9 = Surface(reparameterize(loft))
srf_10 = Surface(reparameterize(srf_9))
# Casting: So... what's going on here??
# 
# Isotrim has Surfaces as output but I can plug then into a Crve component and get no error? Why?
# 
# The thorough explanation involves progamming knowledges, so I'll be sufficinetly approximate: all geometry objects in Rhino and GH have properties (length for the curves, direction also in case of lines segments, domain etc.). Sometimes we can, for example, plug a cuve into a domain component and get its domain automatically. In other words, since the "Cuve" object type has a propety called "domain", I can CAST a curve into a domain component.
# 
# In this specific case, each NUBS surface has a perimeter curve as a property, so, casting them to a curve I can get that border perimeter for each of the isoTrim surfaces.
divide = DivideDomain²(Domain=domain², UCount=Slider(5, range=2..100), VCount=Slider(6, range=2..100))
preview = CustomPreview(Geometry=srf_6, Material=ColourSwatch(SwatchColor=RGB(255, 255, 255)))
ln = Line(StartPoint=eval_2.Point, EndPoint=eval.Point)
move = Move(Geometry=srf_10, Motion=Y)  # -> Geometry, Transform
domain²_2 = Domain²(srf_10)
pt = ConstructPoint(XCoordinate=range, YCoordinate=Slider(0.538, range=0..1), ZCoordinate=0)

# ---- group: countour
Z = UnitZ(Factor=1)
contour = Contour(Shape=srf_6, Point=Point(0, 0, 0), Direction=Z, Distance=Slider(0.1, range=0.1..10))
preview_2 = CustomPreview(Geometry=contour, Material=ColourSwatch(SwatchColor=RGB(255, 255, 255)))

# ----
subsrf = Isotrim(Surface=srf_7, Domain=divide)
domain²_3 = Domain²(srf_8)
divide_2 = DivideDomain²(Domain=domain²_2, UCount=Slider(5, range=2..100), VCount=Slider(8, range=2..100))
md_slider = MDSlider(
    SliderMode=0,
    slider_value=Point(0.493902439, 0.5754573171, 0.5),
    x_domain=Domain(0, 1),
    y_domain=Domain(0, 1),
    z_domain=Domain(0, 1))

# ---- group: divide surface
sdivide = DivideSurface(Surface=srf_9, UCount=Slider(8, range=2..100), VCount=Slider(53, range=2..100))  # -> simplify(Points), Normals, Parameters

# ---- group: hold on a sec....
crv_4 = Curve(subsrf)

# ---- group: isocurves
iso = IsoCurve(Surface=srf_6, UVPoint=pt)  # -> UIsocurve, VIsocurve
crv_5 = Curve(iso.VIsocurve)
preview_3 = CustomPreview(Geometry=crv_5, Material=ColourSwatch(SwatchColor=RGB(255, 0, 0)))

# ----
panel_4 = Panel(domain²_3)
preview_4 = CustomPreview(Geometry=srf_9, Material=ColourSwatch(SwatchColor=RGB(89, 89, 89)))

# ---- group: isotrim
subsrf_2 = Isotrim(Surface=move.Geometry, Domain=divide_2)

# ---- group: view tangent
line = LineSDL(Start=eval_2.Point, Direction=eval_2.Tangent, Length=Slider(15.903, range=0..20))
line_2 = LineSDL(Start=eval.Point, Direction=eval.Tangent, Length=Slider(10.173, range=0..20))

# ---- group: transform isosurfaces in polylines
explode = Explode(Curve=crv_4, Recursive=True)  # -> Segments, Vertices
cull_i = CullIndex(List=explode.Vertices, Indices="-1", Wrap=True)
polyline_from_surface = PolyLine(Vertices=cull_i, Closed=True)  # -> flatten(Polyline)

# ----
panel_5 = Panel(subsrf_2)

# ---- group: points
dots = DotDisplay(Point=sdivide.Points, Colour=RGB(0, 0, 0), Size="0.15")

# ----
rev = Reverse(Vector=line)
rev_2 = Reverse(Vector=line_2)
flip = FlipMatrix(Data=sdivide.Points)

# ---- group: normals
vdisex = VectorDisplayEx(Point=sdivide.Points, Vector=sdivide.Normals, Colour=sdivide.Normals, Width=2)

# ---- group: evaluate surface
evalsrf = EvaluateSurface(Surface=srf_8, Point=md_slider)  # -> Point, Normal, UDirection, VDirection, Frame

# ----
viewer = ParamViewer(sdivide.Points)

# ---- group: 2 polygons
crv_6 = Curve([<curve referenced from the Rhino model> x2])

# ---- group: single rectangle
crv_7 = Curve(<curve referenced from the Rhino model>)

# ----
pline = PolyLine(Vertices=sdivide.Points, Closed=False)
pt_2 = Point(evalsrf.Point)
bzspan = BezierSpan(StartPoint=eval_2.Point, StartTangent=[line, rev], EndPoint=eval.Point, EndTangent=[rev_2, line_2])  # -> Curve, Length, Domain
panel_6 = Panel(contour)
panel_7 = Panel(iso.UIsocurve)
panel_8 = Panel(iso.VIsocurve)
preview_5 = CustomPreview(Geometry=pline, Material=ColourSwatch(SwatchColor=RGB(255, 255, 255)))
# planar surface on tangent frame at {u,v}
planesrf = PlaneSurface(Plane=evalsrf.Frame, XSize="-1 to 1", YSize="-1 to 1")
edges = BrepEdges(Brep=subsrf_2)  # -> Naked, Interior, NonManifold
# normal
vdisex_2 = VectorDisplayEx(Point=evalsrf.Point, Vector=evalsrf.Normal, Colour="blue", Width=2)
# U direction vector
vdisex_3 = VectorDisplayEx(Point=evalsrf.Point, Vector=evalsrf.UDirection, Colour="red", Width=2)
# V direction vector
vdisex_4 = VectorDisplayEx(Point=evalsrf.Point, Vector=evalsrf.VDirection, Colour="green", Width=2)
preview_6 = CustomPreview(Geometry=subsrf_2, Material=ColourSwatch(SwatchColor=RGB(255, 255, 255)))
viewer_2 = ParamViewer(flip)
intermediate = Slider(0.042, range=0..1)
top_curve = Slider(0.939, range=0..1)
ground_curve = Slider(0.041, range=0..1)

# ---- group: plug curves here
crv_8 = Curve(graft(crv_7))

# ----
pline_2 = PolyLine(Vertices=flip, Closed=False)
preview_7 = CustomPreview(Geometry=pline_2, Material=ColourSwatch(SwatchColor=RGB(0, 0, 0)))
graft = GraftTree(Tree=crv_8, IncludeEmptyLists=True, IncludeNullItems=True)
pcen = PolygonCenter(Polyline=crv_8)  # -> CenterV, CenterE, CenterA
merge = Merge(Data1=top_curve, Data2=intermediate, Data3=ground_curve)
panel_9 = Panel(graft)
panel_10 = Panel(merge)
scale = Scale(Geometry=crv_8, Center=pcen.CenterV, Factor=merge)  # -> Geometry, Transform
merge_2 = Merge(Data1=Slider(10, range=0..10), Data2=Slider(8.269, range=0..10), Data3=Slider(0, range=0..10))
Z_2 = UnitZ(Factor=merge_2)
move_2 = Move(Geometry=scale.Geometry, Motion=Z_2)  # -> Geometry, Transform
panel_11 = Panel(move_2.Geometry)

series = Series(Start=0, Step=1, Count=10)
cull_i_2 = CullIndex(List=series, Indices="-1", Wrap=True)
item = ListItem(List=series, Index=Slider(20, range=-20..20), Wrap=Toggle(True))
panel_12 = Panel(series)
panel_13 = Panel(item)
panel_14 = Panel(cull_i_2)

explode_2 = Explode(Curve=move_2.Geometry, Recursive=True)  # -> Segments, Vertices

# ---- group: simple loft....Uuuuuggggllyyyyy!!!
loft_2 = Loft(Curves=move_2.Geometry, Options={Adjust=False, Closed=False, LoftEnds=0, LoftSimp=0, LoftType=0, Rebuild=10, Refit=0.01})

# ----
cull_i_3 = CullIndex(List=explode_2.Vertices, Indices="-1", Wrap=True)

# ---- group: can't use flip matrix with more than one curve
viewer_3 = ParamViewer(cull_i_3)
viewer_4 = ParamViewer(cull_i_3)
flip_2 = FlipMatrix(Data=cull_i_3)

# ----
# How to do it: We need to transpose the order of the points but presrve their separation by global element (I wan one pillar for each base curve). So, I need to swap only the last significant index of the Tree Banch and the list item index. Our structure here is
# 
# {A;B;C;D}(i)
# 
# BUT, since D is always 0 I need to swap C with i, so, the data is read in this order:
# 
# First by A (which is always 0 so it doesn't matter)
# Then by B (index of each starting polyline, our "block" index)
# Then by i (all points with the same list index go together in the same branch)
# 
# So:
# 
# {A;B;i}
# 
# Since C is also always 0 we can skip it (this will also ease our lives later)
# Naming Convention: A, B, C, etc. - all capital letters inside {} are Tree Branch indexes;
# 
# i - item index in each list
# see also
# column4pt
# modeling example
path_mapper = PathMapper(cull_i_3, source="{A;B;C;D}(i)", target="{A;B;i}")
viewer_5 = ParamViewer(cull_i_3)
panel_15 = Panel(cull_i_3)

# ----
# hey, this is gettin REALLY difficult!
# DON'T PANIC: Puzzled? Sounds like a martian language??
# 
# Don't worry, it kinda is. I felt quite lost for months before figuring this out and understanding how this works. Luckily, this example can be applied for most cases so you can use it also later
fillet_radius = Slider(1.27, range=0..5)
panel_16 = Panel(path_mapper)
viewer_6 = ParamViewer(path_mapper)
pline_3 = PolyLine(Vertices=path_mapper, Closed=False)
fillet = Fillet(Curve=pline_3, Radius=fillet_radius)
panel_17 = Panel(fillet)
pshift = ShiftPaths(Data=fillet, Offset=-1)

# ---- group: Flatten isn't useful with more than one curve
flatten = FlattenTree(Tree=fillet, Path="{0}")
panel_18 = Panel(flatten)

# ----
loft_3 = Loft(Curves=pshift, Options={Adjust=False, Closed=True, LoftEnds=0, LoftSimp=0, LoftType=3, Rebuild=10, Refit=0.01})
panel_19 = Panel(pshift)
preview_8 = CustomPreview(Geometry=loft_3, Material=ColourSwatch(SwatchColor=RGB(255, 255, 255)))
