# Grasshopper definition 20181023_c03_in class.gh (Grasshopper 1.0.7)
# Copyright: Co-de-iT
# plug-ins: MeshEdit Components, Weaverbird

pt = Point(<point referenced from the Rhino model>)
mesh = Mesh(<mesh referenced from the Rhino model>)
srf = Surface(<surface referenced from the Rhino model>)
yz = YZPlane(Origin=pt)
crv = Curve(<curve referenced from the Rhino model>)
mesh_uv = MeshSurface(Surface=srf, UCount=5, VCount=5, Overhang=True, Equalize=False)
series = Series(Start=0, Step=1, Count=10)
mesh_2 = Mesh(<mesh referenced from the Rhino model>)
pt_2 = Point(<point referenced from the Rhino model>)
mirror = Mirror(Geometry=mesh, Plane=yz)  # -> Geometry, Transform
triangulate = MeshTriangulate(Mesh=mesh_2, ShortDiagonal=True)
panel = Panel(series)
sdivide = DivideSurface(Surface=srf, UCount=Slider(15, range=2..200), VCount=Slider(39, range=2..200))  # -> Points, Normals, Parameters
crv_cp = CurveClosestPoint(Point=sdivide.Points, Curve=crv)  # -> Point, Parameter, Distance
panel_2 = Panel(mirror.Geometry)
panel_3 = Panel(mesh)
pt_3 = Point(<point referenced from the Rhino model>)
panel_4 = Panel(triangulate)
# 20181023 - in class
# 
# © a3 2018 _ Creative Commons Attribution-NonCommercial-ShareAlike3.0 UnportedLicense.
panel_5 = Panel(mesh_2)
demesh = DeconstructMesh(Mesh=triangulate)  # -> Vertices, Faces, Colours, Normals
hexgrid = Hexagonal(Plane=pt_2, Size=Slider(3.923, range=0..20), ExtentX=Slider(15, range=2..100), ExtentY=Slider(13, range=2..100))  # -> Cells, Points
wbjoin = WeaverbirdsJoinMeshesAndWeld(Mesh=[mesh, mirror.Geometry], Weld=True)
dist = Distance(PointA=sdivide.Points, PointB=pt_3)
vdisex = VectorDisplayEx(Point=demesh.Vertices, Vector=demesh.Normals, Colour=RGB(0, 0, 0), Width=2)
pt_4 = Point(hexgrid.Points)
crv_2 = Curve(<curve referenced from the Rhino model>)
rev = Reverse(Vector=sdivide.Normals)
wbcatmullclark = WeaverbirdsCatmullClarkSubdivision(MeshCurves=wbjoin, Level=Slider(3, range=1..3), SmoothNakedEdges=Slider(2, range=0..2))
num = Number(dist)
explode = MeshExplode(Mesh=wbcatmullclark, Interpolate=False)
panel_6 = Panel(wbjoin)
panel_7 = Panel(demesh.Vertices)
panel_8 = Panel(demesh.Faces)
incurve = PointInCurve(Point=pt_4, Curve=crv_2)  # -> Relationship, Point
bnd = Bounds(Numbers=flatten(num))
panel_9 = Panel(wbcatmullclark)
demesh_2 = DeconstructMesh(Mesh=explode)  # -> Vertices, Faces, Colours, Normals
Z = UnitZ(Factor=Slider(5.481, range=0..10))
num_2 = Number(flatten(num))
dom = ConstructDomain(DomainStart=Slider(6.815, range=0..10), DomainEnd=Slider(0.508, range=0..10))
viewer = ParamViewer(sdivide.Points)
larger = LargerThan(FirstNumber=incurve.Relationship, SecondNumber="1")  # -> LargerThan, OrEqualTo
viewer_2 = ParamViewer(num_2)
viewer_3 = ParamViewer(num)
remap = RemapNumbers(Value=num, Source=bnd, Target=dom)  # -> Mapped, Clipped
dispatch = Dispatch(List=hexgrid.Cells, DispatchPattern=larger.LargerThan)  # -> ListA, ListB
pdecon = Deconstruct(Point=demesh_2.Vertices)  # -> XComponent, YComponent, ZComponent
panel_10 = Panel(dom)
demesh_3 = DeconstructMesh(Mesh=wbcatmullclark)  # -> Vertices, Faces, Colours, Normals
item = ListItem(List=demesh_2.Vertices, Index=0, Wrap=True)  # -> Item, Item1, Item2, Item3
amp = Amplitude(Amplitude=1)
multiplication = Multiplication(A=rev, B=remap.Mapped)
sort = SortList(Keys=pdecon.ZComponent, ValuesA=demesh_2.Vertices)  # -> Keys, ValuesA
crv_3 = Curve(dispatch.ListA)
vdisex_2 = VectorDisplayEx(Point=sdivide.Points, Vector=multiplication, Colour=RGB(0, 0, 0), Width=2)
multiplication_2 = Multiplication(A=Slider(2.25, range=0..10), B=demesh_3.Normals)
item_2 = ListItem(List=sort.ValuesA, Index=0, Wrap=True)  # -> Item1, Item
X = UnitX(Factor=Slider(100, range=0..100))
move = Move(Geometry=sdivide.Points, Motion=multiplication)  # -> Geometry, Transform
panel_11 = Panel(demesh_3.Faces)
panel_12 = Panel(demesh_3.Vertices)
ln = Line(StartPoint=item.Item1, EndPoint=item.Item3)
ln_2 = Line(StartPoint=item.Item, EndPoint=item.Item2)
bar_graph = BarGraph(num, BarColor=RGB(255, 0, 90))
bar_graph_2 = BarGraph(remap.Mapped, BarColor=RGB(255, 0, 90))

# ---- group: bake and deform in Rhino with Cage Edit
move_2 = Move(Geometry=crv_3, Motion=X)  # -> Geometry, Transform

# ----
ln_3 = Line(StartPoint=item_2.Item1, EndPoint=item_2.Item)
move_3 = Move(Geometry=demesh_3.Vertices, Motion=multiplication_2)  # -> Geometry, Transform
pline = PolyLine(Closed=False)
intcrv = Interpolate(Vertices=sdivide.Points, Degree=3, Periodic=False, KnotStyle=1)  # -> Curve, Length, Domain
pline_2 = PolyLine(Closed=False)
intcrv_2 = Interpolate(Vertices=move.Geometry, Degree=3, Periodic=False, KnotStyle=1)  # -> Curve, Length, Domain
preview = CustomPreview(
    Geometry=ln_3,
    Material={diffuse=RGB(221, 160, 221), emission=RGB(66, 48, 66), shine=0.5, specular=RGB(255, 255, 255), transparency=0})
conmesh = ConstructMesh(Vertices=move_3.Geometry, Faces=demesh_3.Faces)
panel_13 = Panel(sdivide.Points)
merge = Merge(Data1=intcrv.Curve, Data2=intcrv_2.Curve)
loft = Loft(Curves=merge, Options={Adjust=False, Closed=False, LoftEnds=0, LoftSimp=0, LoftType=0, Rebuild=10, Refit=0.01})

# ---- group: deformed grid
crv_4 = Curve([<curve referenced from the Rhino model> x61])

# ----
explode_2 = Explode(Curve=crv_4, Recursive=True)  # -> Segments, Vertices
cull_i = CullIndex(List=explode_2.Vertices, Indices="-1", Wrap=True)
avr = Average(Input=cull_i)
crv_5 = Curve(<curve referenced from the Rhino model>)
crv_cp_2 = CurveClosestPoint(Point=avr, Curve=crv_5)  # -> Point, Parameter, Distance
bar_graph_3 = BarGraph(crv_cp_2.Distance, BarColor=RGB(255, 0, 90))
min = Minimum(A=crv_cp_2.Distance, B=Slider(17.599, range=0..30))
bar_graph_4 = BarGraph(min, BarColor=RGB(255, 0, 90))

num_3 = Number(min)
bnd_2 = Bounds(Numbers=flatten(num_3))
dom_2 = ConstructDomain(DomainStart=Slider(0.054, range=0..1), DomainEnd=Slider(0.728, range=0..1))
remap_2 = RemapNumbers(Value=num_3, Source=bnd_2, Target=dom_2)  # -> Mapped, Clipped

num_4 = Number(min)
bnd_3 = Bounds(Numbers=flatten(num_4))
dom_3 = ConstructDomain(DomainStart=Slider(0.751, range=0..1), DomainEnd=Slider(0.176, range=0..1))
remap_3 = RemapNumbers(Value=num_4, Source=bnd_3, Target=dom_3)  # -> Mapped, Clipped

scale = Scale(Geometry=cull_i, Center=avr, Factor=Slider(1, range=0..1))  # -> Geometry, Transform
scale_2 = Scale(Geometry=cull_i, Center=avr, Factor=remap_2.Mapped)  # -> Geometry, Transform
pline_3 = PolyLine(Vertices=cull_i, Closed=True)
Z_2 = UnitZ(Factor=Slider(2.12, range=0..20))
Z_3 = UnitZ(Factor=Slider(2.12, range=0..20))
move_4 = Move(Geometry=scale.Geometry, Motion=Z_2)  # -> Geometry, Transform
move_5 = Move(Geometry=pline_3, Motion=Z_3)  # -> Geometry, Transform
graph = GraphMapper(
    remap_3.Mapped,
    x0=0,
    x1=1,
    y0=0,
    y1=1,
    container_name="Bezier",
    cpx=[0, 0.2715604603, 0.960003376, 1],
    cpy=[0, 0.6530231237, 0.4411948323, 1])
multiplication_3 = Multiplication(A=graph, B=Slider(18.171, range=0..50))
pline_4 = PolyLine(Vertices=scale_2.Geometry, Closed=True)
pline_5 = PolyLine(Vertices=move_4.Geometry, Closed=True)
Z_4 = UnitZ(Factor=multiplication_3)
move_6 = Move(Geometry=pline_4, Motion=Z_4)  # -> Geometry, Transform
merge_2 = Merge(Data1=simplify(pline_4), Data2=simplify(pline_5), Data3=simplify(move_6.Geometry))
loft_2 = Loft(Curves=merge_2, Options={Adjust=False, Closed=False, LoftEnds=0, LoftSimp=0, LoftType=3, Rebuild=10, Refit=0.01})
preview_2 = CustomPreview(Geometry=loft_2, Material=ColourSwatch(SwatchColor=RGBA(255, 255, 255, 164)))
