# Grasshopper definition 20181030_c04_in class.gh (Grasshopper 1.0.7)
# Copyright: Co-de-iT
# plug-ins: Kangaroo2 Components

pt = Point(<point referenced from the Rhino model>)
X = UnitX(Factor="10")
X_2 = UnitX(Factor="10")
Z = UnitZ(Factor=1)
# simulation with Kangaroo
# 
# © a3 2018 _ Creative Commons Attribution-NonCommercial-ShareAlike3.0 UnportedLicense.
move = Move(Geometry=pt, Motion=X)  # -> Geometry, Transform
srf = Surface(<surface referenced from the Rhino model>)
vrot = Rotate(Vector=X_2, Axis=Z, Angle="0.2")
pt_2 = Point([<point referenced from the Rhino model> x4])
pt_3 = Point([<point referenced from the Rhino model> x2])
X_3 = UnitX(Factor="10")
Z_2 = UnitZ(Factor=1)

# ---- group: geometry
pt_4 = Point(<point referenced from the Rhino model>)
pt_5 = Point(<point referenced from the Rhino model>)
ln = Line(StartPoint=pt_5, EndPoint=pt_4)
divide = DivideCurve(Curve=ln, Count=Slider(16, range=2..50), Kinks=False)  # -> Points, Tangents, Parameters
shatter = Shatter(Curve=ln, Parameters=divide.Parameters)

# ----
move_2 = Move(Geometry=move.Geometry, Motion=vrot)  # -> Geometry, Transform
vrot_2 = Rotate(Vector=X_3, Axis=Z_2, Angle="0.2")
mesh_uv = MeshSurface(Surface=srf, UCount=Slider(21, range=2..50), VCount=Slider(21, range=2..50), Overhang=True, Equalize=False)
demesh = DeconstructMesh(Mesh=mesh_uv)  # -> Vertices, Faces, Colours, Normals
X_4 = UnitX(Factor="10")
Z_3 = UnitZ(Factor=1)
move_3 = Move(Geometry=move_2.Geometry, Motion=vrot_2)  # -> Geometry, Transform
cp = ClosestPoint(Point=pt_3, Cloud=demesh.Vertices)  # -> ClosestPoint, CPIndex, Distance
vrot_3 = Rotate(Vector=X_4, Axis=Z_3, Angle="0.2")
Z_4 = UnitZ(Factor=Slider(0.122, range=-10..10))
edgelengths = EdgeLengths(Mesh=mesh_uv, LengthFactor=Slider(0.906, range=0..2), Strength=1)
# A
# B
move_4 = Move(Geometry=move_3.Geometry, Motion=vrot_3)  # -> Geometry, Transform
end = EndPoints(Curve=shatter)  # -> Start, End
anchor = Anchor(Point=[pt_2, cp.ClosestPoint], Strength=10000)
Z_5 = UnitZ(Factor=Slider(10, range=-10..10))
load = Load(Point=demesh.Vertices, ForceVector=Z_4)
show = Show(G=mesh_uv)
len = Length(Curve=shatter)
multiplication = Multiplication(A=len, B=Slider(0.533, range=0..1))
entwine = Entwine(Branch00=show, Branch01=edgelengths, Branch02=load, Branch03=anchor, FlattenInputs=True)

# ---- group: model
anchor_2 = Anchor(Point=[pt_5, pt_4], Strength=10000)
length_line = LengthLine(Line=shatter, Length=multiplication, Strength=10)
load_2 = Load(Point=end.Start, ForceVector=Z_5)
show_2 = Show(G=shatter)

# ----
reset = Button()
on = BooleanToggle(True)
entwine_2 = Entwine(Branch00=show_2, Branch01=length_line, Branch02=anchor_2, Branch03=load_2, FlattenInputs=True)
solver = Solver(GoalObjects=entwine, Reset=reset, Threshold=1e-15, Tolerance=0.01, On=on)  # -> I, V, O
reset_2 = Button()
on_2 = BooleanToggle(False)
bang = ExplodeTree(Data=solver.O)
solver_2 = Solver(GoalObjects=entwine_2, Reset=reset_2, Threshold=1e-15, Tolerance=0.01, On=on_2)  # -> I, V, O; disabled
bang_2 = ExplodeTree(Data=solver_2.O)
join = JoinCurves(Curves=bang_2, Preserve=False)
