# Grasshopper definition 00_fields from image.gh (Grasshopper 1.0.7)
# Copyright: Co-de-iT

number_slider = Slider(80, range=10..100)
# Fields from image
# 
# © a3 2018 _ Creative Commons Attribution-NonCommercial-ShareAlike3.0 UnportedLicense.
planesrf = PlaneSurface(Plane=PlaneXY(0, 0, 0), XSize=Slider(140, range=0..200), YSize=Slider(120, range=0..200))  # -> reparameterize(Plane)
sdivide = DivideSurface(Surface=planesrf, UCount=number_slider, VCount=number_slider)  # -> Points, Normals, Parameters
image = ImageSampler(sdivide.Parameters, Filter="Value", Interpolate=False, Umax=1, Umin=0, Vmax=1, Vmin=0, Wrap=1)
brightness_values = Panel(image)

# ---- group: vector field
num = Number(image)
bnd = Bounds(Numbers=flatten(num))
dom = ConstructDomain(DomainStart=Slider(-3.142, range=-3.142..3.142), DomainEnd=Slider(3.142, range=-3.142..3.142))
remap = RemapNumbers(Value=num, Source=bnd, Target=dom)  # -> Mapped, Clipped
Z = UnitZ(Factor=1)
X = UnitX(Factor=1)
vrot = Rotate(Vector=X, Axis=Z, Angle=remap.Mapped)
multiplication = Multiplication(A=image, B=Slider(3.026, range=1..5))
amp = Amplitude(Vector=vrot, Amplitude=multiplication)
unit = UnitVector(Vector=vrot)

# ---- group: scalar field
multiplication_2 = Multiplication(A=image, B=Slider(1, range=1..5))

# ----
msphere = MeshSphere(Base=sdivide.Points, Radius=multiplication_2, UCount="8", VCount="8")
swatch = ColourSwatch(SwatchColor=RGB(0, 0, 0))
mjoin = MeshJoin(Meshes=flatten(msphere))
material = CreateMaterial(Diffuse=swatch, Specular=swatch, Emission=RGB(0, 0, 0), Transparency=0, Shine=0)

# ---- group: display scalar field
preview = CustomPreview(Geometry=mjoin, Material=material)

# ---- group: display vector field
vdisex = VectorDisplayEx(Point=sdivide.Points, Vector=amp, Colour=unit, Width=2)
