# Grasshopper definition 01_Kangaroo tensioning.gh (Grasshopper 1.0.7)
# Copyright: Co-de-iT
# plug-ins: MeshEdit Components, Kangaroo2 Components

# Kangaroo tensioning
# 
# © a3 2018 _ Creative Commons Attribution-NonCommercial-ShareAlike3.0 UnportedLicense.
# case 00 - mesh constrained to naked points
mesh = Mesh(<mesh referenced from the Rhino model>)
# case 02 - using curves as ridges
crv = Curve([<curve referenced from the Rhino model> x7])
# case 01 - anchor points selected via mesh volume inclusion
mesh_2 = Mesh(<mesh referenced from the Rhino model>)

# ---- group: mesh volumes to select fixed points
mesh_3 = Mesh([<mesh referenced from the Rhino model> x2])

# ----
loft = Loft(Curves=crv, Options={Adjust=False, Closed=False, LoftEnds=0, LoftSimp=0, LoftType=3, Rebuild=10, Refit=0.01})
nv = NakedVertices(Mesh=mesh)  # -> ClothedIndex, NakedIndex, ClothedPts, NakedPts
nv_2 = NakedVertices(Mesh=mesh_2)  # -> ClothedIndex, NakedIndex, ClothedPts, NakedPts
mjoin = MeshJoin(Meshes=mesh_3)
debrep = DeconstructBrep(Brep=loft)  # -> Faces, Edges, Vertices
minc = MeshInclusion(Mesh=mjoin, Point=nv_2.NakedPts, Strict=False)
dispatch = Dispatch(List=nv_2.NakedPts, DispatchPattern=minc)  # -> ListA, ListB
mesh_uv = MeshSurface(Surface=debrep.Faces, UCount=Slider(5, range=5..100), VCount=Slider(41, range=10..100), Overhang=True, Equalize=False)
pt = Point(dispatch.ListA)
mjoin_2 = MeshJoin(Meshes=mesh_uv)
weldvertices = MeshWeldVertices(Mesh=mjoin_2, Tolerance=0.01)  # -> RuntimeMessage, Mesh
mesh_4 = Mesh(weldvertices.Mesh)

# ---- group: find points on ridge curves
demesh = DeconstructMesh(Mesh=mesh_4)  # -> graft(Vertices), Faces, Colours, Normals
crv_cp = CurveClosestPoint(Point=demesh.Vertices, Curve=crv)  # -> Point, Parameter, Distance
sort = SortList(Keys=crv_cp.Distance)  # -> Keys, ValuesA
item = ListItem(List=sort.Keys, Index=0, Wrap=True)
smaller = SmallerThan(FirstNumber=item, SecondNumber=Slider(0.072, range=0..1))  # -> SmallerThan, OrEqualTo
cull = CullPattern(List=demesh.Vertices, CullPattern=smaller.SmallerThan)  # -> flatten(List)

# ---- group: find points on ridge curves and to which curve the point belongs to
demesh_2 = DeconstructMesh(Mesh=mesh_4)  # -> graft(Vertices), Faces, Colours, Normals
crv_cp_2 = CurveClosestPoint(Point=demesh_2.Vertices, Curve=crv)  # -> Point, Parameter, Distance
sort_2 = SortList(Keys=crv_cp_2.Distance, ValuesB=crv)  # -> Keys, ValuesA, ValuesB
item_2 = ListItem(List=sort_2.Keys, Index=0, Wrap=True)
item_3 = ListItem(List=sort_2.ValuesB, Index=0, Wrap=True)
smaller_2 = SmallerThan(FirstNumber=item_2, SecondNumber=Slider(0.072, range=0..1))  # -> SmallerThan, OrEqualTo
cull_2 = CullPattern(List=demesh_2.Vertices, CullPattern=smaller_2.SmallerThan)  # -> simplify(List)
cull_3 = CullPattern(List=item_3, CullPattern=smaller_2.SmallerThan)  # -> simplify(List)

# ----
edgelengths = EdgeLengths(Mesh=mesh, LengthFactor=Slider(0, range=0..1), Strength=1)
edgelengths_2 = EdgeLengths(Mesh=mesh_2, LengthFactor=Slider(0, range=0..1), Strength=1)
anchor = Anchor(Point=nv.NakedPts, Strength=10000)
anchor_2 = Anchor(Point=pt, Strength=10000)
nv_3 = NakedVertices(Mesh=mesh_4)  # -> ClothedIndex, NakedIndex, ClothedPts, NakedPts
# pre-processing
show = Show(G=mesh)
nv_4 = NakedVertices(Mesh=mesh_4)  # -> ClothedIndex, NakedIndex, ClothedPts, NakedPts
show_2 = Show(G=mesh_2)
entwine = Entwine(Branch00=show, Branch01=edgelengths, Branch02=anchor, FlattenInputs=True)
entwine_2 = Entwine(Branch00=show_2, Branch01=edgelengths_2, Branch02=anchor_2, FlattenInputs=True)
merge = Merge(Data1=nv_3.NakedPts, Data2=cull)  # -> flatten(Result)

# ---- group: removes empty branches
clean = CleanTree(RemoveNulls=True, RemoveInvalid=True, RemoveEmpty=True, Tree=cull_2)
clean_2 = CleanTree(RemoveNulls=True, RemoveInvalid=True, RemoveEmpty=True, Tree=cull_3)

# ----
edgelengths_3 = EdgeLengths(Mesh=mesh_4, LengthFactor=Slider(0, range=0..1), Strength=1)
edgelengths_4 = EdgeLengths(Mesh=mesh_4, LengthFactor=Slider(0, range=0..1), Strength=1)
anchor_3 = Anchor(Point=merge, Strength=10000)
anchor_4 = Anchor(Point=nv_4.NakedPts, Strength=10000)
# this component constrains points to move along a curve
oncurve = OnCurve(Points=clean, Curve=clean_2, Strength=Slider(102.898, range=1..1000))
show_3 = Show(G=mesh_4)
show_4 = Show(G=mesh_4)
entwine_3 = Entwine(Branch00=show_3, Branch01=edgelengths_3, Branch02=anchor_3, FlattenInputs=True)
entwine_4 = Entwine(Branch00=show_4, Branch01=edgelengths_4, Branch02=anchor_4, Branch03=oncurve, FlattenInputs=True)
reset = Button()
on = BooleanToggle(False)
on_2 = BooleanToggle(False)
reset_2 = Button()
on_3 = BooleanToggle(False)
reset_3 = Button()
reset_4 = Button()
on_4 = BooleanToggle(False)
# processing
solver = Solver(GoalObjects=entwine, Reset=reset, Threshold=1e-15, Tolerance=0.01, On=on)  # -> I, V, O
solver_2 = Solver(GoalObjects=entwine_2, Reset=reset_2, Threshold=1e-15, Tolerance=0.01, On=on_2)  # -> I, V, O; disabled
solver_3 = Solver(GoalObjects=entwine_3, Reset=reset_3, Threshold=1e-15, Tolerance=0.01, On=on_3)  # -> I, V, O; disabled
solver_4 = Solver(GoalObjects=entwine_4, Reset=reset_4, Threshold=1e-15, Tolerance=0.01, On=on_4)  # -> I, V, O; disabled
# post-processing
bang = ExplodeTree(Data=solver.O)
bang_2 = ExplodeTree(Data=solver_2.O)
bang_3 = ExplodeTree(Data=solver_3.O)
bang_4 = ExplodeTree(Data=solver_4.O)
X = UnitX(Factor="150")
X_2 = UnitX(Factor="150")
X_3 = UnitX(Factor="50")
X_4 = UnitX(Factor="50")
move = Move(Geometry=bang, Motion=X)  # -> Geometry, Transform
move_2 = Move(Geometry=bang_2, Motion=X_2)  # -> Geometry, Transform
move_3 = Move(Geometry=bang_3, Motion=X_3)  # -> Geometry, Transform
move_4 = Move(Geometry=bang_4, Motion=X_4)  # -> Geometry, Transform
