# Grasshopper definition 01_Karamba Field.gh (Grasshopper 1.0.7)
# plug-ins: Karamba, Weaverbird

# ---- group: triangulated
mesh = Mesh(<mesh referenced from the Rhino model>)
mirror = Mirror(Geometry=mesh, Plane=PlaneYZ(0, 0, 0))  # -> Geometry, Transform
wbjoin = WeaverbirdsJoinMeshesAndWeld(Mesh=[mirror.Geometry, mesh], Weld=True)
wbcatmullclark = WeaverbirdsCatmullClarkSubdivision(MeshCurves=wbjoin, Level=Slider(3, range=1..3), SmoothNakedEdges=Slider(2, range=0..2))
tri = Triangulate(Mesh=wbcatmullclark)  # -> Mesh, Count
Y = UnitY(Factor=Slider(20, range=0..20))
move = Move(Geometry=tri.Mesh, Motion=Y)  # -> Geometry, Transform

# ---- group: low poly-subdiv
mesh_2 = Mesh(<mesh referenced from the Rhino model>)
wbcatmullclark_2 = WeaverbirdsCatmullClarkSubdivision(MeshCurves=mesh_2, Level=Slider(3, range=1..3), SmoothNakedEdges=Slider(1, range=0..2))
Y_2 = UnitY(Factor=Slider(20, range=0..20))
move_2 = Move(Geometry=wbcatmullclark_2, Motion=Y_2)  # -> Geometry, Transform

# ---- group: from surface
number_slider = Slider(30, range=10..100)
srf = Surface(<surface referenced from the Rhino model>)
mesh_uv = MeshSurface(Surface=srf, UCount=number_slider, VCount=number_slider, Overhang=True, Equalize=False)
wbstellate = WeaverbirdsStellateCumulation(MeshPolylines=mesh_uv, Distance="0")

# ---- group: Karamba subdiv
res = Slider(0.3, range=0.05..0.6)
mesh_breps = MeshBreps(
    Brep=srf,
    MeshResolution=res,
    EdgeRefinementFactor=0.67,
    PointReduction=True,
    SmoothingStepSize=0.8,
    SmoothingIterations=5)  # -> Mesh, Info

# ----
# Karamba Shell Analysis
# 
# © a3 2018 _ Creative Commons Attribution-NonCommercial-ShareAlike3.0 UnportedLicense.
source_geometry = ValueList({"triangulated mesh": 0, "low poly-subdiv": 1, "from surface": 2, "Karamba remesh": 3}, selected="from surface")
# PRE-PROCESSING
filter = StreamFilter(Gate=source_geometry, Stream0=move.Geometry, Stream1=move_2.Geometry, Stream2=wbstellate, Stream3=mesh_breps.Mesh)

mesh_3 = Mesh(filter)
meshtoshell = MeshToShellKaramba3D(Mesh=mesh_3, Identifier="S", LimitDistance_m=0.005)  # -> Element, Points, Info
# INPUT
# BUILD MODEL
rdpoints = RemoveDuplicatePointsKaramba(Point=meshtoshell.Points, LDist=0.005)  # -> OutPoint, Info, Indexes

# ---- group: random load points (optional)
lng = ListLength(List=flatten(rdpoints.OutPoint))
random = Random(Range=lng, Number=Slider(5, range=0..10), Seed=Slider(55, range=0..1000))
item = ListItem(List=flatten(rdpoints.OutPoint), Index=random, Wrap=True)

# ----
# supports are currently selected fromm the point with z<0
# you are free to set your own criteris (ex. points that are inside a particular volume)
pdecon = Deconstruct(Point=rdpoints.OutPoint)  # -> XComponent, YComponent, ZComponent
smaller = SmallerThan(FirstNumber=pdecon.ZComponent, SecondNumber=0)  # -> SmallerThan, OrEqualTo
dispatch = Dispatch(List=rdpoints.OutPoint, DispatchPattern=smaller.SmallerThan)  # -> ListA, ListB
# SUPPORTS
pt = Point(dispatch.ListA)
supp = SupportKaramba(PosInd=pt, menu=[buttons(on, on, on, off, off, off)])

live_load = Slider(-5, range=-50..-0.04)
pt_2 = Point(flatten(item))
Z = UnitZ(Factor=live_load)
# LOADS
loads = LoadsKaramba3D(ForceVector=Z, Local=False, PosInd=pt_2, LCase=0, mode="Point")

# ----
# CROSS SECTION
cross_section = CrossSectionKaramba3D(
    FamilyNameOfCrossSection="DefaultCroSec",
    ElementIdentifier="S",
    Material=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,
    Height_cm=Slider(10, range=0..10),
    mode="Shell - Const")
panel = Panel(cross_section)

# ---- group: OPTIONAL - mesh live load
# you can apply live load as distributed uniform load on a mesh vertices, in the direction of the respective local normal (for instance, to simulate pressure)
# 
# note: low mesh density can
# result in uneven distribution of load
panel_2 = Panel("-5")  # disabled
Z_2 = UnitZ(Factor=panel_2)  # disabled
mesh_4 = Mesh()  # disabled
loads_2 = LoadsKaramba3D(Vector=Z_2, Mesh=mesh_4, LCase=0, mode="MeshLoad -Const.", menu=[buttons(off, on, off), buttons(on, on)])  # disabled

# ----
loads_3 = LoadsKaramba3D(Vector=Vector(0, 0, -1), LCase=0, mode="Gravity")

matselect = MaterialSelectionKaramba3D(menu=[dropdown(2), dropdown(6)])
# MATERIAL
panel_3 = Panel(matselect)

load = LoadKaramba(flatten([loads, loads_3]))
support = SupportKaramba(supp)

# ----
# ASSEMBLE
assemble = AssembleModelKaramba(
    Elem=meshtoshell.Element,
    Support=support,
    Load=load,
    CrossSection=cross_section,
    Material=matselect,
    LimitDistance_m=0.005)  # -> Model, Info, Mass_kg, CenterOfGravity

# ----
# PROCESSING
# ANALYZE
analyze = AnalyzeKaramba3D(Model=assemble.Model)  # -> CalculatedModel, MaximumDisplacement_cm, ResultingForceOfGravity_kN, ElasticEnergy_kNm

max_displacement_cm = Panel(analyze.MaximumDisplacement_cm)

# ----
# POST-PROCESSING
# DISPLAY
modelview = ModelViewKaramba3D(Model=analyze.CalculatedModel, LoadCaseFactorsForLinearSuperposition=1, IndexOfVisibleLoadcase=-1)  # -> Model, DeformedMesh, DeformedAxes, DeformedModel
shellview = ShellViewKaramba3D(Model=modelview.Model, IndexOfLayer=0)  # -> Model, MeshesOfRenderedShells, LegendColors, LegendTags
legend = Legend(Colour=shellview.LegendColors, Tags=shellview.LegendTags, LegendType=1)  # disabled

# ----
# reduced mesh
# point density
panel_4 = Panel("""0
0
0
0
0
0
0
0
1""")
cull = CullPattern(List=rdpoints.OutPoint, CullPattern=panel_4)

# ---- group: custom pts
pt_3 = Point([<point referenced from the Rhino model> x30])

# ---- group: point for sampling
# EXTRACT VALUES
pt_4 = Point(cull)

# ----
scale_value = Slider(0.045, range=0..1)
shelllineresults = LineResultsOnShellsKaramba3D(
    AnalyzedModel=shellview.Model,
    LayerPosition=0,
    ListOfIsoValuesValsOrSourcesOfForceFlowLinesLinesPoints=pt_4,
    SegmentLength_m=0,
    Smoothing=False,
    mode="IsoLines",
    menu=[buttons(off, off, off, on, off, off, off)])  # -> AnalyzedModel, Lines, Value
shellvecresults = ResultVectorsOnShellsKaramba(AnalyzedModel=shellview.Model, mode="PrincForce")  # -> AnalyzedModel, Points, FirstPrincipalNormalForceVector_kN_m, SecondPrincipalNormalForceVector_kN_m, FirstPrincipalMomentVector_kN, SecondPrincipalMomentVector_kN, FirstPrincipalNormalForceValue_kN_m, SecondPrincipalNormalForceValue_kN_m, FirstPrincipalMomentValue_kN, SecondPrincipalMomentValue_kN
shelllineresults_2 = LineResultsOnShellsKaramba3D(
    AnalyzedModel=shellview.Model,
    LayerPosition=0,
    ListOfSourcesOfPrincipalStressLinesLinesPoints=pt_4,
    SegmentLength_m=0.5,
    DA_deg=5,
    mode="PrincStress")  # -> AnalyzedModel, Lines1, Lines2
shellvecresults_2 = ResultVectorsOnShellsKaramba(AnalyzedModel=shellview.Model, LayerOfResults=0, mode="PrincStress")  # -> AnalyzedModel, Points, FirstPrincipalStressVector_kN_cm2, SecondPrincipalStressVector_kN_cm2, FirstPrincipalStressValue_kN_cm2, SecondPrincipalStressValue_kN_cm2
shelllineresults_3 = LineResultsOnShellsKaramba3D(
    AnalyzedModel=shellview.Model,
    ListOfSourcesOfForceFlowLinesLinesPoints=pt_4,
    SegmentLength_m=0.5,
    DA_deg=5,
    mode="PrincMoment")  # -> AnalyzedModel, Lines1, Lines2
multiplication = Multiplication(A=shellvecresults.FirstPrincipalMomentValue_kN, B=scale_value)
multiplication_2 = Multiplication(A=shellvecresults.SecondPrincipalMomentValue_kN, B=scale_value)

# ----
# DISPLACEMENT CURVES
crv = Curve(shelllineresults.Lines)
preview = CustomPreview(
    Geometry=crv,
    Shader={diffuse=RGB(255, 105, 180), emission=RGB(76, 32, 54), shine=0.5, specular=RGB(255, 255, 255), transparency=0})

amp = Amplitude(Vector=shellvecresults.FirstPrincipalMomentVector_kN, Amplitude=multiplication)
amp_2 = Amplitude(Vector=shellvecresults.SecondPrincipalMomentVector_kN, Amplitude=multiplication_2)

rgb = ColourRGB(Alpha=255, Red=0, Green=0, Blue="250")
preview_2 = CustomPreview(Geometry=shelllineresults_3.Lines1, Shader=rgb)
addition = Addition(A=shellvecresults.Points, B=amp_2)
ln = Line(StartPoint=shellvecresults.Points, EndPoint=addition)

rgb_2 = ColourRGB(Alpha=255, Red="250", Green=0, Blue=0)
preview_3 = CustomPreview(Geometry=shelllineresults_3.Lines2, Shader=rgb_2)
addition_2 = Addition(A=shellvecresults.Points, B=amp)
ln_2 = Line(StartPoint=shellvecresults.Points, EndPoint=addition_2)

rgb_3 = ColourRGB(Alpha=255, Red=0, Green=0, Blue="250")
addition_3 = Addition(A=shellvecresults_2.Points, B=shellvecresults_2.FirstPrincipalStressVector_kN_cm2)
preview_4 = CustomPreview(Geometry=shelllineresults_2.Lines1, Shader=rgb_3)
ln_3 = Line(StartPoint=shellvecresults_2.Points, EndPoint=addition_3)

rgb_4 = ColourRGB(Alpha=255, Red="250", Green=0, Blue=0)
preview_5 = CustomPreview(Geometry=shelllineresults_2.Lines2, Shader=rgb_4)
addition_4 = Addition(A=shellvecresults_2.Points, B=shellvecresults_2.SecondPrincipalStressVector_kN_cm2)
ln_4 = Line(StartPoint=shellvecresults_2.Points, EndPoint=addition_4)

# ---- group: PS 1
# PRINCIPAL STRESS CURVES, VECTORS & VALUES
crv_2 = Curve(ln_3)
num = Number(shellvecresults_2.FirstPrincipalStressValue_kN_cm2)

# ---- group: PS 2
crv_3 = Curve(ln_4)
num_2 = Number(shellvecresults_2.SecondPrincipalStressValue_kN_cm2)

# ---- group: PM 2
crv_4 = Curve(ln)
num_3 = Number(shellvecresults.SecondPrincipalMomentValue_kN)

# ---- group: PM 1
# PRINCIPAL MOMENT CURVES, VECTORS & VALUES
crv_5 = Curve(ln_2)
num_4 = Number(shellvecresults.FirstPrincipalMomentValue_kN)

# ---- group: PS 1
# next step: 1. internalize data
# 
# 2. copy these components and paste them in the definition 02_Karamba Pattern.gh
crv_6 = Curve([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])
num_5 = Number([0, 0, 0, 0, 0, 0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])

# ---- group: PS 2
crv_7 = Curve([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])
num_6 = Number([0, 0, 0, 0, 0, 0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])

# ---- group: PM 2
crv_8 = Curve([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])
num_7 = Number([-0.04483711597, -0.2173178093, -0.1898413309, 0.003561859734, -0.1861830343, 0.1344063484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])

# ---- group: PM 1
crv_9 = Curve([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])
num_8 = Number([0.03272574262, -0.06727071016, -0.03141894004, 0.04933740562, -0.02448688577, 0.4345851457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])
