# Grasshopper definition 02_Karamba Pattern.gh (Grasshopper 1.0.7)
# Copyright: Co-de-iT
# plug-ins: Weaverbird

# ---- group: data from Karamba / PM 2
crv = Curve([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])
num = Number([-0.04483711597, -0.2173178093, -0.1898413309, 0.003561859734, -0.1861830343, 0.1344063484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])

# ---- group: data from Karamba / PS 1
crv_2 = Curve([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])
num_2 = Number([0, 0, 0, 0, 0, 0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])

# ---- group: data from Karamba / PS 2
crv_3 = Curve([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])
num_3 = Number([0, 0, 0, 0, 0, 0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])

# ---- group: data from Karamba / PM 1
crv_4 = Curve([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])
num_4 = Number([0.03272574262, -0.06727071016, -0.03141894004, 0.04933740562, -0.02448688577, 0.4345851457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])

# ----
# File template
# 
# © a3 2018 _ Creative Commons Attribution-NonCommercial-ShareAlike3.0 UnportedLicense.
karamba_stress_data = ValueList({"PS 1": 0, "PS 2": 1, "PM 1": 2, "PM 2": 3}, selected="PS 1")
filter = StreamFilter(Gate=karamba_stress_data, Stream0=crv_2, Stream1=crv_3, Stream2=crv_4, Stream3=crv)
filter_2 = StreamFilter(Gate=karamba_stress_data, Stream0=num_2, Stream1=num_3, Stream2=num_4, Stream3=num)

# ---- group: display field direction and intensity
num_5 = Number(filter_2)
bnd = Bounds(Numbers=flatten(num_5))
dom = ConstructDomain(DomainStart=Slider(0, range=0..1), DomainEnd=Slider(0.103, range=0..1))
stress_dir = ColourSwatch(SwatchColor=RGB(255, 0, 0))
# field display
end = EndPoints(Curve=filter)  # -> Start, End
amp = Amplitude(Vector=filter, Amplitude=Slider(0.17, range=0..1))
remap = RemapNumbers(Value=num_5, Source=bnd, Target=dom)  # -> Mapped, Clipped
material = CreateMaterial(Diffuse="black", Specular="black", Emission=RGB(0, 0, 0), Transparency=0, Shine=0)
msphere = MeshSphere(Base=end.Start, Radius=remap.Mapped, UCount="6", VCount="6")
preview = CustomPreview(Geometry=msphere, Material=material)
vdisex = VectorDisplayEx(Point=end.Start, Vector=amp, Colour=stress_dir, Width=2)

# ----
# case 01 - scale according to stress values
srf = Surface(reparameterize(<surface referenced from the Rhino model>))
# case 02 - scale, align and move along normals
srf_2 = Surface(reparameterize(<surface referenced from the Rhino model>))

# ---- group: data from Karamba
crv_5 = Curve(filter)
num_6 = Number(filter_2)

# ----
mesh_uv = MeshSurface(Surface=srf_2, UCount=Slider(30, range=10..100), VCount=Slider(20, range=10..40), Overhang=True, Equalize=False)
mesh_uv_2 = MeshSurface(Surface=srf, UCount=Slider(50, range=10..100), VCount=Slider(20, range=10..40), Overhang=True, Equalize=False)

# ---- group: data from Karamba
crv_6 = Curve(filter)
num_7 = Number(filter_2)

# ---- group: sort vertices by face
demesh = DeconstructMesh(Mesh=mesh_uv_2)  # -> Vertices, Faces, Colours, Normals
deface = DeconstructFace(Face=graft(demesh.Faces))  # -> CornerA, CornerB, CornerC, CornerD
merge = Merge(Data1=deface.CornerA, Data2=deface.CornerB, Data3=deface.CornerC, Data4=deface.CornerD)
item = ListItem(List=demesh.Vertices, Index=merge, Wrap=True)  # -> simplify(Item)

# ---- group: sort vertices and vertex normals by face
demesh_2 = DeconstructMesh(Mesh=mesh_uv)  # -> Vertices, Faces, Colours, Normals
deface_2 = DeconstructFace(Face=graft(demesh_2.Faces))  # -> CornerA, CornerB, CornerC, CornerD
merge_2 = Merge(Data1=deface_2.CornerA, Data2=deface_2.CornerB, Data3=deface_2.CornerC, Data4=deface_2.CornerD)
item_2 = ListItem(List=demesh_2.Vertices, Index=merge_2, Wrap=True)  # -> simplify(Item)
item_3 = ListItem(List=demesh_2.Normals, Index=merge_2, Wrap=True)  # -> simplify(Item)

# ----
item_4 = ListItem(List=item, Index=0, Wrap=True)  # -> Item, Item1, Item2, Item3
item_5 = ListItem(List=item_2, Index=0, Wrap=True)  # -> Item, Item1, Item2, Item3

# ---- group: align with stress directions / determine face direction
partition = PartitionList(List=item_2, Size="2")
avr = Average(Input=partition)
pshift = ShiftPaths(Data=avr, Offset=-1)
pline = PolyLine(Vertices=pshift, Closed=False)

# ---- group: face centers
avr_2 = Average(Input=[item_4.Item, item_4.Item1, item_4.Item2, item_4.Item3])

# ----
end_2 = EndPoints(Curve=crv_5)  # -> Start, End

# ---- group: face centers
avr_3 = Average(Input=[item_5.Item, item_5.Item1, item_5.Item2, item_5.Item3])

# ----
end_3 = EndPoints(Curve=crv_6)  # -> Start, End
cp = ClosestPoint(Point=avr_2, Cloud=end_2.Start)  # -> ClosestPoint, simplify(CPIndex), Distance

# ----
# with closest point we sample the closest field data and get its index in order to retrieve the right one for each face
cp_2 = ClosestPoint(Point=avr_3, Cloud=end_3.Start)  # -> ClosestPoint, simplify(CPIndex), Distance

item_6 = ListItem(List=num_6, Index=cp.CPIndex, Wrap=True)
item_7 = ListItem(List=num_7, Index=cp_2.CPIndex, Wrap=True)
num_8 = Number(item_6)

# ---- group: align with stress directions / determine face direction / face directions
vec = Vector(unitize(pline))

# ---- group: align with stress directions / stress directions from Karamba
vec_2 = Vector(unitize(crv_6))

# ---- group: scale points
num_9 = Number(item_7)
bnd_2 = Bounds(Numbers=flatten(num_9))
dom_2 = ConstructDomain(DomainStart=Slider(0.828, range=0..1), DomainEnd=Slider(0.038, range=0..1))
remap_2 = RemapNumbers(Value=num_9, Source=bnd_2, Target=dom_2)  # -> Mapped, Clipped
scale = Scale(Geometry=item_2, Center=avr_3, Factor=remap_2.Mapped)  # -> Geometry, Transform

# ----
bnd_3 = Bounds(Numbers=flatten(num_8))
dom_3 = ConstructDomain(DomainStart=Slider(0.828, range=0..1), DomainEnd=Slider(0.038, range=0..1))

# ---- group: align with stress directions
# this might turn red since some stress values can be 0. It's not a problem in this case.
item_8 = ListItem(List=vec_2, Index=cp_2.CPIndex, Wrap=True)
rev = Reverse(Vector=item_8)
angle = Angle(VectorA=vec, VectorB=item_8)  # -> Angle, Reflex
angle_2 = Angle(VectorA=vec, VectorB=rev)  # -> Angle, Reflex
merge_3 = Merge(Data1=angle.Angle, Data2=angle_2.Angle)
panel = Panel("""1
-1""")
sort = SortList(Keys=merge_3, ValuesA=panel)  # -> Keys, ValuesA
multiplication = Multiplication(A=sort.Keys, B=sort.ValuesA)
item_9 = ListItem(List=multiplication, Index=0, Wrap=True)
deg = Degrees(Radians=item_9)
num_10 = Number(deg)
bnd_4 = Bounds(Numbers=flatten(num_10))
dom_4 = ConstructDomain(DomainStart=Slider(-45, range=-90..0), DomainEnd=Slider(45, range=0..90))
remap_3 = RemapNumbers(Value=num_10, Source=bnd_4, Target=dom_4)  # -> Mapped, Clipped
rad = Radians(Degrees=remap_3.Mapped)
pl = PlaneNormal(Origin=avr_3, ZAxis=item_3)
bar_graph = BarGraph(remap_3.Mapped, BarColor=RGB(255, 0, 90))
rotate = Rotate(Geometry=scale.Geometry, Angle=rad, Plane=pl)  # -> Geometry, Transform

# ---- group: display face directions and stress directions
face_dir = ColourSwatch(SwatchColor=RGB(0, 0, 0))
stress_dir_2 = ColourSwatch(SwatchColor=RGB(255, 0, 0))
merge_4 = Merge(Data1=face_dir, Data2=stress_dir_2)
amp_2 = Amplitude(Vector=[vec, item_8], Amplitude=Slider(0.25, range=0..1))
vdisex_2 = VectorDisplayEx(Point=avr_3, Vector=amp_2, Colour=merge_4, Width=2)

# ----
remap_4 = RemapNumbers(Value=num_8, Source=bnd_3, Target=dom_3)  # -> Mapped, Clipped
scale_2 = Scale(Geometry=item, Center=avr_2, Factor=remap_4.Mapped)  # -> Geometry, Transform
f_mbridge = MeshBridge(Pa=item, Pb=scale_2.Geometry, S="1", W="true")  # -> M; inputs Pa: list of Point3d, Pb: list of Point3d, S: Int32, W: Boolean
# ---------- f_mbridge: C# ----------
           /*
    froGH - a sparse collection of (in)utilities for Grasshopper

    Mesh Bridge

    code by Alessio Erioli

    froGH by Co-de-iT is licensed under a Creative Commons Attribution 4.0 International License.
    http://creativecommons.org/licenses/by/4.0/

    */

    initComp();

    Mesh mesh = new Mesh();
    Mesh mFace = new Mesh();
    if (Pa.Count != Pb.Count) {
      Print("Pa and Pb MUST have the same number of points");
    }else{
      Point3d[][] pts = new Point3d[S + 1][];
      pts[0] = Pa.ToArray();
      pts[S] = Pb.ToArray();
      for (int i = 1; i < S; i++){
        pts[i] = new Point3d[Pa.Count];
        for (int j = 0; j < Pa.Count; j++){
          Vector3d v = Vector3d.Subtract((Vector3d) Pb[j], (Vector3d) Pa[j]);
          v = Vector3d.Divide(v, S);
          pts[i][j] = Point3d.Add(pts[i - 1][j], v);
        }
      }

      for (int i = 0; i < pts.Length - 1; i++){

        for(int j = 0; j < pts[i].Length; j++){
          mFace = new Mesh();
          int ind = (j + 1) % pts[i].Length;
          mFace.Vertices.Add(pts[i][j]);
          mFace.Vertices.Add(pts[i][ind]);
          mFace.Vertices.Add(pts[i + 1][ind]);
          mFace.Vertices.Add(pts[i + 1][j]);
          mFace.Faces.AddFace(0, 1, 2, 3);
          mesh.Append(mFace);
        }

      }
    }
    if(mesh != null && W) mesh.Weld(0.01);
    M = mesh;
# ---------- f_mbridge: C# additional code ----------
  void initComp(){
    Component.Name = "Mesh Bridge";
    Component.NickName = "f_MBridge";
    Component.Description = "Builds a Mesh Bridge between lists of points";
    Component.Params.Input[0].Name = "Points A";
    Component.Params.Input[0].Description = "the first set of points";
    Component.Params.Input[1].Name = "Points B";
    Component.Params.Input[1].Description = "the second set of points";
    Component.Params.Input[2].Name = "Subdivisions";
    Component.Params.Input[2].Description = "n. of subdivisions";
    Component.Params.Input[3].Name = "Wrap";
    Component.Params.Input[3].Description = "consider points as a closed loop (boolean)";
    Component.Params.Output[0].Name = "Mesh";
    Component.Params.Output[0].Description = "The output Mesh";
  }
# ---------- end f_mbridge ----------
wbjoin = WeaverbirdsJoinMeshesAndWeld(Mesh=flatten(f_mbridge), Weld=True)

# ---- group: move along face normals
num_11 = Number(item_7)
bnd_5 = Bounds(Numbers=flatten(num_11))
dom_5 = ConstructDomain(DomainStart=Slider(0.8, range=0..1), DomainEnd=Slider(0.005, range=0..1))
remap_5 = RemapNumbers(Value=num_11, Source=bnd_5, Target=dom_5)  # -> Mapped, Clipped
multiplication_2 = Multiplication(A=item_3, B=remap_5.Mapped)
rev_2 = Reverse(Vector=multiplication_2)
move = Move(Geometry=rotate.Geometry, Motion=rev_2)  # -> Geometry, Transform

# ----
f_mbridge_2 = MeshBridge(Pa=item_2, Pb=move.Geometry, S="1", W="true")  # -> M; inputs Pa: list of Point3d, Pb: list of Point3d, S: Int32, W: Boolean; same code as f_mbridge
wbjoin_2 = WeaverbirdsJoinMeshesAndWeld(Mesh=flatten(f_mbridge_2), Weld=True)

# ---- group: move in new position for display
Y = UnitY(Factor="10")
move_2 = Move(Geometry=wbjoin_2, Motion=Y)  # -> Geometry, Transform
