# Grasshopper definition a3_cXX_Rhino6 SubD workflow.gh (Grasshopper 1.0.7)
# Copyright: Co-de-iT

# ---- group: NURBS from SubD
brep = Brep(<brep referenced from the Rhino model>)

# ---- group: Mesh from SubD
mesh = Mesh(<mesh referenced from the Rhino model>)

# ----
# post-processing SubD surfaces
# 
# © a3 2018 _ Creative Commons Attribution-NonCommercial-ShareAlike3.0 UnportedLicense.
debrep = DeconstructBrep(Brep=brep)  # -> Faces, Edges, Vertices
demesh = DeconstructMesh(Mesh=mesh)  # -> Vertices, Faces, Colours, Normals
# WARNING: DO NOT SET THIS TOO LOW
# (NOT BELOW 0.05)
number_slider = Slider(10, range=1..10)
srf = Surface(reparameterize(graft(debrep.Faces)))
conmesh = ConstructMesh(Vertices=demesh.Vertices, Faces=demesh.Faces)
range = Range(Domain=Domain(0, 1), Steps=number_slider)
Y = UnitY(Factor="60")
move = Move(Geometry=conmesh, Motion=Y)  # -> Geometry, Transform
vec = VectorXYZ(XComponent=range, YComponent=range, ZComponent=0)  # -> Vector, Length
demesh_2 = DeconstructMesh(Mesh=move.Geometry)  # -> Vertices, Faces, Colours, Normals
sdivide = DivideSurface(Surface=srf, UCount=10, VCount=10)  # -> Points, Normals, Parameters

# ---- group: Subdivide by curvature (from froGH)
f_sqtreek = SurfaceQuadtreeByCurvature(S=simplify(srf), t=Slider(0.05, range=0.05..10))  # -> Ss; inputs S: Surface, t: Double
# ---------- f_sqtreek: C# ----------
                                            /*
    froGH - a sparse collection of (in)utilities for Grasshopper

    Surface QuadTree by Curvature
    code by Alessio Erioli

    froGH by Co-de-iT is licensed under a Creative Commons Attribution 4.0 International License.
    http://creativecommons.org/licenses/by/4.0/

    */

    initComp();

    if (S != null && t > 0){
      // clears surface list
      surfs.Clear();
      // reparametrize surface
      S.SetDomain(0, new Interval(0, 1));
      S.SetDomain(1, new Interval(0, 1));

      // calls subdivision
      subdivide(S, t);

      Ss = surfs;
    }
# ---------- f_sqtreek: C# additional code ----------
  public List <Surface> surfs = new List<Surface>();
  void initComp(){
    Component.Name = "Surface Quadtree by Curvature";
    Component.NickName = "f_SQTreeK";
    Component.Description = "Subdivides iteratively a surface based on local curvature";
    Component.Params.Input[0].Name = "Surface";
    Component.Params.Input[0].Description = "Surface to subdivide";
    Component.Params.Input[1].Name = "Tolerance";
    Component.Params.Input[1].Description = "Subdivision tolerance (WARNING: do not set this too small - start large and diminish gradually)";
    Component.Params.Output[0].Name = "Surfaces";
    Component.Params.Output[0].Description = "Surfaces obtained by subdivision";
  }

  /// <summary>
  /// Subdivides surface according to curvature, tolerance method
  /// </summary>
  /// <param name="tsurf">the input surf</param>
  /// <param name="_tol">tolerance</param>
  /// <returns></returns>
  public void subdivide(Surface tsurf, double _tol)
  {

    Surface[] sur4 = new Surface[4];
    Vector3d[] vec = new Vector3d[1];
    Point3d p0,p1,pm0,pms = new Point3d();

    // get surface domain in u & v
    Interval u = tsurf.Domain(0);
    Interval v = tsurf.Domain(1);

    // get domain edge values
    double umin = u.Min;
    double umax = u.Max;
    double vmin = v.Min;
    double vmax = v.Max;

    // evaluate corner points
    tsurf.Evaluate(umin, vmin, 0, out p0, out vec);
    tsurf.Evaluate(umax, vmax, 0, out p1, out vec);

    // evaluate surface parametric midpoint
    tsurf.Evaluate((umax + umin) / 2, (vmax + vmin) / 2, 0, out pms, out vec);

    // get diagonal midpoint
    pm0 = (p0 + p1) / 2;

    if ((pm0.DistanceTo(pms)) < _tol)
    {
      surfs.Add(tsurf);
      return;
    }
    else
    {

      // calculate average values
      double um = (umax + umin) / 2;
      double vm = (vmax + vmin) / 2;

      // build division intervals
      Interval u0 = new Interval(umin, um);
      Interval u1 = new Interval(um, umax);
      Interval v0 = new Interval(vmin, vm);
      Interval v1 = new Interval(vm, vmax);

      // trim surface with intervals
      sur4[0] = tsurf.Trim(u0, v0);
      // if anything goes wrong, throw an exception!
      // if (sur4[0] == null)
      //  throw new Exception("found a null, pirla!!! " + u0 + " " + v0);
      sur4[1] = tsurf.Trim(u1, v0);
      sur4[2] = tsurf.Trim(u0, v1);
      sur4[3] = tsurf.Trim(u1, v1);

      subdivide(sur4[0], _tol);
      subdivide(sur4[1], _tol);
      subdivide(sur4[2], _tol);
      subdivide(sur4[3], _tol);

    }

  }
# ---------- end f_sqtreek ----------

# ----
iso = IsoCurve(Surface=srf, UVPoint=vec.Vector)  # -> UIsocurve, VIsocurve
deface = DeconstructFace(Face=graft(demesh_2.Faces))  # -> CornerA, CornerB, CornerC, CornerD
merge = Merge(Data1=deface.CornerA, Data2=deface.CornerB, Data3=deface.CornerC, Data4=deface.CornerD)
crv = Curve(iso.UIsocurve)
crv_2 = Curve(iso.VIsocurve)
srf_2 = Surface(reparameterize(flatten(f_sqtreek)))
pline = PolyLine(Vertices=sdivide.Points, Closed=False)
item = ListItem(List=demesh_2.Vertices, Index=merge, Wrap=True)  # -> simplify(Item)
lng = ListLength(List=srf_2)
iso_2 = IsoCurve(Surface=graft(srf_2), UVPoint=vec.Vector)  # -> UIsocurve, VIsocurve
pdecon = Deconstruct(Point=item)  # -> XComponent, YComponent, ZComponent
wheel = ColourWheel(
    lng,
    ColourGrips_Style=10,
    ColourGrips_Grip=[5.511012431, 2.094395102, 4.188790205, 3.141592654],
    ColourGrips_Lum=[0.1, 0.3847889898],
    ColourGrips_Range=[0.1250755416, 0.1250755416, 0.1250755416, 0.1250755416],
    ColourGrips_Sat=[0.2554725233, 0.810022284])
sort = SortList(Keys=pdecon.ZComponent, ValuesA=item)  # -> Keys, ValuesA
item_2 = ListItem(List=sort.ValuesA, Index=0, Wrap=True)  # -> Item1, Item
crv_3 = Curve(iso_2.UIsocurve)
crv_4 = Curve(iso_2.VIsocurve)

join = JoinCurves(Curves=flatten(crv_3), Preserve=False)
# switch on to see subdivision lines
# switch on only one of these groups at the time
preview = CustomPreview(Geometry=srf_2, Material=ColourSwatch(SwatchColor=RGB(255, 255, 255)))

ln = Line(StartPoint=item_2.Item1, EndPoint=item_2.Item)
# switch on to see subdivision surfaces
preview_2 = CustomPreview(Geometry=srf_2, Material=wheel)
