# Grasshopper definition Box morph + orientation.gh (Grasshopper 1.0.7)
# Copyright: Co-de-iT
# plug-ins: Kangaroo2 Components

# ---- group: surface for population
# creation of cells to be populated
srf = Surface(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)

# ----
number_slider = Slider(20, range=2..20)
mesh_uv = MeshSurface(Surface=srf, UCount=number_slider, VCount=number_slider, Overhang=True, Equalize=False)
nv = NakedVertices(Mesh=mesh_uv)  # -> ClothedIndex, NakedIndex, ClothedPts, NakedPts
demesh = DeconstructMesh(Mesh=mesh_uv)  # -> Vertices, Faces, Colours, Normals
cp = ClosestPoint(Point=demesh.Vertices, Cloud=nv.NakedPts)  # -> ClosestPoint, CPIndex, Distance
num = Number(cp.Distance)
bnd = Bounds(Numbers=flatten(num))
dom = ConstructDomain(DomainStart=0, DomainEnd=1)
remap = RemapNumbers(Value=num, Source=bnd, Target=dom)  # -> Mapped, Clipped
graph = GraphMapper(
    remap.Mapped,
    x0=0,
    x1=1,
    y0=0,
    y1=1,
    container_name="Bezier",
    cpx=[0, 0.4380435646, 0.8094208241, 1],
    cpy=[0, 0.01340562105, 0.950724721, 1])
dom_2 = ConstructDomain(DomainStart=Slider(3.616, range=0..20), DomainEnd=Slider(12.032, range=0..20))
remap_2 = RemapNumbers(Value=graph, Source=Domain(0, 1), Target=dom_2)  # -> Mapped, Clipped
multiplication = Multiplication(A=demesh.Normals, B=remap_2.Mapped)
move = Move(Geometry=demesh.Vertices, Motion=multiplication)  # -> Geometry, Transform
conmesh = ConstructMesh(Vertices=move.Geometry, Faces=demesh.Faces)

# ---- group: sort vertex indices by face
# Box morph with orientation
# 
# © a3 2018 _ Creative Commons Attribution-NonCommercial-ShareAlike3.0 UnportedLicense.
deface = DeconstructFace(Face=graft(demesh.Faces))  # -> CornerA, CornerB, CornerC, CornerD
merge = Merge(Data1=deface.CornerA, Data2=deface.CornerB, Data3=deface.CornerC, Data4=deface.CornerD)

# ---- group: attractor curve
crv = Curve(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)

# ----
preview = CustomPreview(Geometry=crv, Material=ColourSwatch(SwatchColor=RGB(255, 255, 255)))

# ---- group: vertices by face - lower mesh
item = ListItem(List=demesh.Vertices, Index=merge, Wrap=True)  # -> simplify(Item)

# ---- group: cells centers
avr = Average(Input=item)

# ---- group: vertices by face - upper mesh
item_2 = ListItem(List=move.Geometry, Index=merge, Wrap=True)  # -> simplify(Item)

# ---- group: generate a vector field using curve direction
crv_cp = CurveClosestPoint(Point=avr, Curve=crv)  # -> Point, Parameter, Distance
eval = EvaluateCurve(Curve=crv, Parameter=crv_cp.Parameter)  # -> Point, Tangent, Angle
multiplication_2 = Multiplication(A=Slider(2.219, range=0..10), B=eval.Tangent)
vdisex = VectorDisplayEx(Point=avr, Vector=multiplication_2, Colour=RGB(0, 0, 0), Width=2)

# ---- group: make twisted boxes
item_3 = ListItem(List=item, Index=0, Wrap=True)  # -> Item, Item1, Item2, Item3
item_4 = ListItem(List=item_2, Index=0, Wrap=True)  # -> Item, Item1, Item2, Item3
tbox = TwistedBox(
    CornerA=item_3.Item,
    CornerB=item_3.Item1,
    CornerC=item_3.Item2,
    CornerD=item_3.Item3,
    CornerE=item_4.Item,
    CornerF=item_4.Item1,
    CornerG=item_4.Item2,
    CornerH=item_4.Item3)

# ----
crv_cp_2 = CurveClosestPoint(Point=avr, Curve=crv)  # -> Point, Parameter, Distance
num_2 = Number(crv_cp_2.Distance)
bnd_2 = Bounds(Numbers=flatten(num_2))
dom_3 = ConstructDomain(DomainStart=0, DomainEnd=1)
remap_3 = RemapNumbers(Value=num_2, Source=bnd_2, Target=dom_3)  # -> Mapped, Clipped

# ---- group: play with rotation angle to see the effect
rotation = Slider(0, range=0..4)

# ---- group: curves for twisted box
crv_2 = Curve([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])

# ---- group: geometry in bounding box
# case 0 - single box morph
geo = Geometry(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)

# ---- group: curves for bounding box
crv_3 = Curve([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])

crv_4 = Curve([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])

# ---- group: geometry in bounding box
# case 1 - simple box morph
geo_2 = Geometry(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)

# ---- group: curves for bounding box
crv_5 = Curve([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])

# ---- group: twisted boxes
tbox_2 = TwistedBox(tbox)

# ---- group: geometry in bounding box
# case 2 - box morph with 2 orientations by distance
geo_3 = Geometry(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)

# ---- group: twisted boxes
tbox_3 = TwistedBox(tbox)

# ---- group: geometry in bounding box
# case 3 - box morph with 4 orientations (by attractor curve direction)
geo_4 = Geometry(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)

# ---- group: curves for bounding box
crv_6 = Curve([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])

# ---- group: twisted boxes
tbox_4 = TwistedBox(tbox)

# ----
graph_2 = GraphMapper(
    remap_3.Mapped,
    x0=0,
    x1=1,
    y0=0,
    y1=1,
    container_name="Bezier",
    cpx=[0, 0.1521739066, 0.4130434692, 1],
    cpy=[0, 0.5, 1, 1])
disc = Discontinuity(Curve=crv_2, Level=1)  # -> Points, Parameters
mesh = Mesh(geo_4)
bbox = BoundingBox(Content=crv_3, Plane=PlaneXY(0, 0, 0), UnionBox=True)  # -> Box, Box_2
bbox_2 = BoundingBox(Content=crv_6, Plane=PlaneXY(0, 0, 0), UnionBox=True)  # -> Box, Box_2
mesh_2 = Mesh(geo_3)
mesh_3 = Mesh(geo)
bbox_3 = BoundingBox(Content=crv_5, Plane=PlaneXY(0, 0, 0), UnionBox=True)  # -> Box, Box_2
mesh_4 = Mesh(geo_2)
bbox_4 = BoundingBox(Content=crv_4, Plane=PlaneXY(0, 0, 0), UnionBox=True)  # -> Box, Box_2
bang = ExplodeTree(Data=disc.Points)  # -> flatten(Branch0), flatten(Branch1)

# ---- group: corresponding rotations
pi = Pi(Factor=1)
panel = Panel("""0
0.5
1
1.5""")
multiplication_3 = Multiplication(A=panel, B=pi)
deg = Degrees(Radians=multiplication_3)
radians = Panel(multiplication_3)
degrees = Panel(deg)

# ----
group = Group(Objects=mesh)
box = EvaluateBox(Box=bbox.Box, UParameter=0.5, VParameter=0.5, WParameter=0.5)  # -> Plane, Point, Include
larger = LargerThan(FirstNumber=graph_2, SecondNumber="0.5")  # -> LargerThan, OrEqualTo
group_2 = Group(Objects=mesh_2)
group_3 = Group(Objects=mesh_3)
group_4 = Group(Objects=mesh_4)
box_2 = EvaluateBox(Box=bbox_2.Box, UParameter=0.5, VParameter=0.5, WParameter=0.5)  # -> Plane, Point, Include

# ---- group: vectors for possible rotation of box (x, y, -x, -y)
X = UnitX(Factor=1)
Y = UnitY(Factor=1)
merge_2 = Merge(Data1=X, Data2=Y)
rev = Reverse(Vector=merge_2)
merge_3 = Merge(Data1=merge_2, Data2=rev)
vdisex_2 = VectorDisplayEx(Point=box_2.Point, Vector=merge_3, Colour=RGB(0, 0, 0), Width="3")

# ---- group: make twisted box
item_5 = ListItem(List=bang.Branch0, Index=0, Wrap=True)  # -> Item, Item1, Item2, Item3
item_6 = ListItem(List=bang.Branch1, Index=0, Wrap=True)  # -> Item, Item1, Item2, Item3
tbox_5 = TwistedBox(
    CornerA=item_5.Item,
    CornerB=item_5.Item1,
    CornerC=item_5.Item2,
    CornerD=item_5.Item3,
    CornerE=item_6.Item,
    CornerF=item_6.Item1,
    CornerG=item_6.Item2,
    CornerH=item_6.Item3)

# ----
multiplication_4 = Multiplication(A=rotation, B="Pi*0.5")
box_3 = EvaluateBox(Box=bbox_4.Box, UParameter=0.5, VParameter=0.5, WParameter=0.5)  # -> Plane, Point, Include

# ---- group: vector field generated by the curve shown in the box center
vec = Vector(eval.Tangent)
vdisex_3 = VectorDisplayEx(Point=box_2.Point, Vector=vec, Colour=vec, Width="1")

# ----
deg_2 = Degrees(Radians=multiplication_4)
rotate = Rotate(Geometry=bbox.Box, Angle=multiplication_4, Plane=box.Point)  # -> Geometry, Transform

# ---- group: choose rotation by curve distance
weave = Weave(Pattern=larger.LargerThan, Stream0="0", Stream1="Pi*0.5", NullGaps=False)

# ----
reference_box_rotation_degrees = Panel(deg_2)

# ---- group: invert rotations
# rotation angles are inverted so that the geometry follows the field. Remember: to rotate the geometry by 90° is the same as rotating its reference box by -90°
panel_2 = Panel("-1")
multiplication_5 = Multiplication(A=multiplication_3, B=panel_2)

# ---- group: looking for smallest angle between vector to find discrete directions
xy = XYPlane(Origin=Point(0, 0, 0))
angle = Angle(VectorA=vec, VectorB=merge_3, Plane=xy)  # -> Angle, Reflex
sort = SortList(Keys=angle.Angle, ValuesA=merge_3, ValuesB=multiplication_5, ValuesC=panel)  # -> Keys, ValuesA, ValuesB, ValuesC

# ----
morph = BoxMorph(Geometry=group_3, Reference=rotate.Geometry, Target=tbox_5)
# strategy: for each "cell" (twisted boxes):
# 
# .find the center
# . evaluate closest point on curve
# . remap distances to 0-1
# . modulate with graph (optional)
# . check with 0.5 threshold: the values above induce a 90° rotation in the reference bounding box before the box morph, the ones below maintain the original orientation
rotate_2 = Rotate(Geometry=bbox_4.Box, Angle=weave, Plane=box_3.Plane)  # -> Geometry, Transform
box_corners = BoxCorners(Box=rotate.Geometry)  # -> CornerA, CornerB, CornerC, CornerD, CornerE, CornerF, CornerG, CornerH
merge_4 = Merge(
    Data1=box_corners.CornerA,
    Data2=box_corners.CornerB,
    Data3=box_corners.CornerC,
    Data4=box_corners.CornerD,
    Data5=box_corners.CornerE,
    Data6=box_corners.CornerF,
    Data7=box_corners.CornerG,
    Data8=box_corners.CornerH)
merge_5 = Merge(
    Data1=item_5.Item,
    Data2=item_5.Item1,
    Data3=item_5.Item2,
    Data4=item_5.Item3,
    Data5=item_6.Item,
    Data6=item_6.Item1,
    Data7=item_6.Item2,
    Data8=item_6.Item3)
morph_2 = BoxMorph(Geometry=group_4, Reference=bbox_3.Box, Target=tbox_2)
morph_3 = BoxMorph(Geometry=group_2, Reference=rotate_2.Geometry, Target=tbox_3)
original = ColourSwatch(SwatchColor=RGB(255, 255, 255))
rotated = ColourSwatch(SwatchColor=RGB(39, 184, 162))

# ---- group: rotation angle
item_7 = ListItem(List=sort.ValuesB, Index=0, Wrap=True)

# ----
panel_3 = Panel("""A
B
C
D
E
F
G
H""")

# ---- group: index
item_8 = ListItem(List=sort.ValuesC, Index=0, Wrap=True)
multiplication_6 = Multiplication(A=item_8, B="2")
int = Integer(multiplication_6)

# ---- group: discretized vector
item_9 = ListItem(List=sort.ValuesA, Index=0, Wrap=True)

# ----
weave_2 = Weave(Pattern=larger.LargerThan, Stream0=original, Stream1=rotated, NullGaps=False)
# strategy: for each "cell" (twisted boxes):
# 
# .find the center
# . evaluate closest point on curve
# . extract the tangent in that point
# . use that vector as a reference direction in the reference bounding box
# . find the closest vector among the possible box orientations (a 0° rotation corresponds to the X axis vector, 90° to Y, 180° to -X and 270° to -Y)
# . rotate the reference bounding box of the corresponding angle so that the internal geometry is oriented approximating the direction inherited from the curve
rotate_3 = Rotate(Geometry=bbox_2.Box, Angle=item_7, Plane=box_2.Plane)  # -> Geometry, Transform
vdisex_4 = VectorDisplayEx(Point=box_2.Point, Vector=item_9, Colour=vec, Width="5")
# NOTA: Anche se vengono usate delle rotazioni nelle geometrie iniziali è più corretto parlare di ORIENTAMENTO degli oggetti rispetto a vettori direzione di riferimento. Le rotazioni vengono usate per convenienza dato che si lavora su un cubo come oggetto di riferimento, ma in realtà quello che conta è che viene cambiato l'orientamento relativo degli 8 punti di riferimento con cui si ricostruisce il twisted box.
# 
# Bisogna però ricordarsi che tutte le trasformazioni che vengono fatte con il box morph sono TOPOLOGICHE, e quindi in generale incompatibili con trasformazioni rigide (rototraslazioni)
# spiegazione: il box iniziale di riferimento deve essere un cubo per poter rimanere coerente una volta fatta la rotazione. Il box può ruotare di angoli multipli di 90° (Pi*0.5 espresso in radianti).
# 
# Il principio è che il box di riferimento ha un orientamento (definito dalla sequenza dei vertici ABCD-EFGH. Le geometrie contenute nel box verranno trasformate nei twisted boxes mantenendo il loro orientamento relativo ai vertici corrispondenti (vedi il caso qui a fianco, verificando le posizioni relative dei punti quando si agisce sullo slider).
# 
# Se ci manteniamo nel caso delle rotazioni possibili sul solo piano XY abbiamo a disposizione 4 rotazioni. Se le geometrie all'interno del box sono simmetriche rispetto ad una diagonale allora bastano 2 rotazioni (0 e 90°, come nelle piastrelle di Truchet).
# 
# Se voglio controllare l'orientamento della geometria nel box di destinazione ho 2 modi:
# 
# a. il più comprensibile: ruoto la geometria all'interno del box iniziale di riferimento con un angolo multiplo di 90° in modo da ottenere l'orientamento desiderato all'arrivo (basta testare gli angoli possibili per capire a quale angolo corrisponde la configurazione desiderata)
# 
# b. quello meno intuitivo ma più snello nei casi pratici in cui aumenta la complessità: dato che quello che conta è l'orientamento delle geometrie rispetto al box di riferimento iniziale, anzichè ruotare la geometria posso ottenere lo stesso effetto ruotando il box in direzione opposta (ovvero: se la geometria deve ruotare di 90°, ottengo lo stesso effetto ruotando il box di -90°). Il vantaggio è che se le geometrie all'interno del box sono complesse e devo distribuirle su un numero molto grande di twisted box di destinazione, così facendo ruoto sempre e solo un oggetto (il box) anzichè tutte le geometrie.
# 
# Dal punto di vista dei risultati non c'è differenza tra i due modi a e b; L'effetto del risparmio in termini di calcolo del modo b si fa vedere quando cresce la complessità delle geometrie interne e il numero di componenti con cui ho a che fare.
# Ad esempio, se il box contiene una mesh con 1200 vertici e devo distribuirla su 200 twisted boxes, ruotando la geometria (modo a) effettuo 200x1200 = 240000 rotazioni, mentre (modo b) ruotando il box (che ha 8 vertici) ne effettuo 1600.
tag = TextTag3D(Location=merge_4, Text=panel_3, Size=1, Colour=ColourSwatch(SwatchColor=RGB(255, 255, 255)), Justification=5)
tag_2 = TextTag3D(Location=merge_5, Text=panel_3, Size=1, Colour=ColourSwatch(SwatchColor=RGB(224, 255, 20)), Justification=5)
preview_2 = CustomPreview(Geometry=morph_2, Material=ColourSwatch(SwatchColor=RGB(0, 0, 0)))
preview_3 = CustomPreview(Geometry=morph_3, Material=weave_2)
morph_4 = BoxMorph(Geometry=group, Reference=rotate_3.Geometry, Target=tbox_4)
_0 = ColourSwatch(SwatchColor=RGB(255, 0, 0))
_90 = ColourSwatch(SwatchColor=RGB(0, 255, 34))
_180 = ColourSwatch(SwatchColor=RGB(0, 255, 255))
_270 = ColourSwatch(SwatchColor=RGB(255, 0, 255))
weave_3 = Weave(Pattern=int, Stream0=_0, Stream1=_90, Stream2=_180, Stream3=_270, NullGaps=False)
preview_4 = CustomPreview(Geometry=morph_4, Material=weave_3)
