# Grasshopper definition 00_circle pack to 2D cells.gh (Grasshopper 1.0.7)
# Copyright: Co-de-iT
# plug-ins: Kangaroo2 Components

min_radius = Slider(5.314, range=0..12)
max_radius = Slider(10.901, range=0..12)

# ---- group: circles base points
# Circle packing based system - 00
# 
# circle packing to 2D cells
# 
# © a3 2018 _ Creative Commons Attribution-NonCommercial-ShareAlike3.0 UnportedLicense.
# 00 - simulate
pt = Point([<point referenced from the Rhino model> x12])

# ---- group: springs anchor point
pt_2 = Point(Point(0, 0, 0))

# ---- group: constraining surface
srf = Surface(<surface referenced from the Rhino model>)

# ----
dom = ConstructDomain(DomainStart=min_radius, DomainEnd=max_radius)
radius_multiplier = Slider(0.765, range=0..1)
lng = ListLength(List=pt)

# ---- group: quick conversion to mesh
mesh = Mesh(srf)

# ----
range = Range(Domain=dom, Steps=expr("x-1", lng))
multiplication = Multiplication(A=range, B=radius_multiplier)
ln = Line(StartPoint=pt, EndPoint=pt_2)
collider = Collider(Objects=pt, Radii=multiplication, Strength=Slider(1.322, range=1..5))
anchor = Anchor(Point=pt_2, Strength=10000)
length_line = LengthLine(Line=ln, Length="0", Strength=Slider(0.01, range=0..1))
onmesh = OnMesh(Points=pt, Mesh=mesh, Strength=1)
show = Show(G=pt)

# ---- group: radiuses
num = Number(multiplication)

# ----
reset = Button()
boolean_toggle = BooleanToggle(False)
entwine = Entwine(Branch00=show, Branch01=collider, Branch02=length_line, Branch03=anchor, Branch04=onmesh, FlattenInputs=True)
solver = Solver(GoalObjects=entwine, Reset=reset, Threshold=1e-15, Tolerance=0.01, On=boolean_toggle)  # -> I, V, O

# ---- group: circles pre-packing
cir = Circle(Plane=pt, Radius=num)

# ----
bang = ExplodeTree(Data=solver.O)

# ---- group: points
dots = DotDisplay(Point=bang, Colour=RGB(0, 0, 0), Size=Slider(0.5, range=0..1))

# ---- group: circles post packing
cir_2 = Circle(Plane=bang, Radius=num)

# ----
preview = CustomPreview(Geometry=cir_2, Material=ColourSwatch(SwatchColor=RGB(41, 41, 41)))

# ---- group: press play once done with Kangaroo
# 01 - build system topology
dam = DataDam(DataA=bang, BufferDelay=10000000, BufferMode=0)

# ---- group: scale inner radiuses by attractor point / attractor point for scaling radiuses
crv = Curve(reparameterize(<curve referenced from the Rhino model>))
eval = EvaluateCurve(Curve=crv, Parameter=Slider(0.568, range=0..1))  # -> Point, Tangent, Angle

# ----
pt_3 = Point(dam)

# ---- group: scale inner radiuses by attractor point
dots_2 = DotDisplay(Point=eval.Point, Colour=ColourSwatch(SwatchColor=RGB(255, 255, 255)), Size=Slider(0.75, range=0..1))
vec2pt = Vector2Pt(PointA=pt_3, PointB=eval.Point, Unitize=False)  # -> Vector, Length
num_2 = Number(vec2pt.Length)
bnd = Bounds(Numbers=flatten(num_2))
dom_2 = ConstructDomain(DomainStart=Slider(0.282, range=0..1), DomainEnd=Slider(0.873, range=0..1))
remap = RemapNumbers(Value=num_2, Source=bnd, Target=dom_2)  # -> Mapped, Clipped

# ---- group: make triangular cells
del = DelaunayMesh(Points=pt_3, Plane=PlaneXY(0, 0, 0))
faceb = FaceBoundaries(Mesh=del)

# ---- group: exclude stretched triangles
# excludes triangles if one of their angle is below a certain threshold (triangles too strecthed)
explode = Explode(Curve=faceb, Recursive=True)  # -> simplify(Segments), Vertices
item = ListItem(List=explode.Segments, Index=0, Wrap=True)  # -> Item, Item1, Item2
# use exclusion points to filter unwanted Delaunay triangles
number_slider = Slider(25, range=0..100)
trig = TriangleTrigonometry(ALength=item.Item, BLength=item.Item1, CLength=item.Item2)  # -> Alpha, Beta, Gamma, ALength, BLength, CLength
rad = Radians(Degrees=number_slider)
merge = Merge(Data1=trig.Alpha, Data2=trig.Beta, Data3=trig.Gamma)
larger = LargerThan(FirstNumber=merge, SecondNumber=rad)  # -> LargerThan, OrEqualTo
f_massbool = MassBoolean(V=larger.LargerThan, type="0")  # -> flatten(B); inputs V: list of Boolean, type: Int32
# ---------- f_massbool: C# ----------
  /*
    froGH - a sparse collection of (in)utilities for Grasshopper

    mass boolean
    code by Alessio Erioli

    froGH by Co-de-iT is licensed under a Creative Commons Attribution 4.0 International License.
    http://creativecommons.org/licenses/by/4.0/

    */
    initComp();

    bool r;
    if (type == 0) {
      Component.Message = "AND";
      r = true;
    }else{
      Component.Message = "OR";
      r = false;
    }


    for (int i = 0; i < V.Count; i++){
      if (type == 0) {
        r = r && V[i];
      }
      else{
        r = r || V[i];
      }
    }
    B = r;
# ---------- f_massbool: C# additional code ----------
  void initComp(){
    Component.Name = "Mass Boolean";
    Component.NickName = "f_MassBool";
    Component.Description = "Mass boolean operator on a list of values";
    Component.Params.Input[0].Name = "Values";
    Component.Params.Input[0].Description = "boolean values as list";
    Component.Params.Input[1].Name = "Boolean operator";
    Component.Params.Input[1].Description = "type of operator: 0 AND, 1 OR";
    Component.Params.Output[0].Name = "Boolean result";
    Component.Params.Output[0].Description = "the result";

  }
# ---------- end f_massbool ----------

# ----
multiplication_2 = Multiplication(A=num, B=remap.Mapped)

# ---- group: filtering triangles by exclusion points / exclusion points
pt_4 = Point([<point referenced from the Rhino model> x3])

# ---- group: filtering triangles by exclusion points
incurve = PointInCurve(Point=pt_4, Curve=graft(faceb))  # -> Relationship, Point
ma = MassAddition(Input=incurve.Relationship)  # -> flatten(Result), PartialResults
larger_2 = LargerThan(FirstNumber=ma.Result, SecondNumber="0")  # -> LargerThan, OrEqualTo
not = GateNot(A=larger_2.LargerThan)

# ----
cir_3 = Circle(Plane=pt_3, Radius=multiplication_2)

# ---- group: inner circles
crv_2 = Curve(reparameterize(cir_3))

# ---- group: combine filtering criteria
and = GateAnd(A=f_massbool, B=not)

# ---- group: selected triangular cells
cull = CullPattern(List=faceb, CullPattern=and)

# ---- group: another way of getting arcs by triangle (slightly more complicated)
ccx = CurveCurve(CurveA=graft(crv_2), CurveB=cull)  # -> simplify(Points), simplify(ParamsA), simplify(ParamsB); disabled
pshift = ShiftPaths(Data=ccx.ParamsA, Offset=-1)  # disabled
shatter = Shatter(Curve=simplify(graft(crv_2)), Parameters=pshift)  # -> simplify(flatten(Segments)); disabled
curvepoint = PointOnCurve(shatter, parameter=0.5)  # disabled
panel = Panel("2")  # disabled
incurve_2 = PointInCurve(Point=curvepoint, Curve=graft(cull))  # -> Relationship, Point; disabled
int = Integer(panel)  # disabled
mindex = MemberIndex(Set=incurve_2.Relationship, Member=int)  # -> simplify(Index), Count; disabled
item_2 = ListItem(List=shatter, Index=mindex.Index, Wrap=True)  # disabled

# ---- group: getting arcs by triangle (brute force but fast)
trim = TrimWithRegion(Curve=crv_2, Region=graft(cull))  # -> simplify(Inside), Outside
pshift_2 = ShiftPaths(Data=trim.Inside, Offset=-1)

# ----
material = CreateMaterial(
    Diffuse=ColourSwatch(SwatchColor=RGB(255, 230, 102)),
    Specular=RGB(255, 255, 255),
    Emission=RGB(0, 0, 0),
    Transparency=".8",
    Shine=0)
mesh_2 = Mesh(cull)

# ---- group: turn on to show selected triangles
# 02 - build cells and patterns
preview_2 = CustomPreview(Geometry=cull, Material=ColourSwatch(SwatchColor=RGB(0, 0, 0)))
preview_3 = CustomPreview(Geometry=mesh_2, Material=material)

# ---- group: sort arcs counterclockwise
curvepoint_2 = PointOnCurve(pshift_2, parameter=0.5)
xy = XYPlane(Origin=Point(0, 0, 0))
f_ptsbyang = SortPointsByAngle(points=curvepoint_2, plane=xy)  # -> angles, points_2, points_indexes
item_3 = ListItem(List=pshift_2, Index=f_ptsbyang.points_indexes, Wrap=True)  # -> simplify(Item)

# ---- group: arcs endpoints
end = EndPoints(Curve=item_3)  # -> Start, End

# ---- group: cells centers
avr = Average(Input=f_ptsbyang.points_2)

# ----
shift = ShiftList(List=end.End, Shift="1", Wrap=True)  # -> simplify(List)
merge_2 = Merge(Data1=graft(end.Start), Data2=graft(shift))

# ---- group: border lines midpoints
avr_2 = Average(Input=merge_2)

# ---- group: arcs
crv_3 = Curve(reparameterize(item_3))

# ----
pshift_3 = ShiftPaths(Data=avr_2, Offset=-1)
shatter_2 = Shatter(Curve=crv_3, Parameters="0.5")  # -> reverse(Segments)
number_slider_2 = Slider(0.28, range=0..1)
pshift_4 = ShiftPaths(Data=shatter_2, Offset=-1)
ln_2 = Line(StartPoint=pshift_3, EndPoint=end.Start)
ln_3 = Line(StartPoint=pshift_3, EndPoint=shift)
ln_4 = Line(StartPoint=pshift_3, EndPoint=avr)  # -> simplify(Line)
ln_5 = Line(StartPoint=avr, EndPoint=f_ptsbyang.points_2)  # -> simplify(Line)
weave = Weave(Pattern=[0, 1], Stream0=ln_2, Stream1=ln_3, NullGaps=False)

# ---- group: spine path pattern
eval_2 = EvaluateCurve(Curve=ln_2, Parameter=number_slider_2)  # -> Point, Tangent, Angle
eval_3 = EvaluateCurve(Curve=ln_5, Parameter=number_slider_2)  # -> simplify(Point), Tangent, Angle
eval_4 = EvaluateCurve(Curve=ln_3, Parameter=number_slider_2)  # -> Point, Tangent, Angle
shift_2 = ShiftList(List=eval_4.Point, Shift=-1, Wrap=True)  # -> simplify(List)
merge_3 = Merge(Data1=graft(eval_2.Point), Data2=graft(eval_3.Point), Data3=graft(shift_2))
pline = PolyLine(Vertices=merge_3, Closed=False)
join = JoinCurves(Curves=flatten(pline), Preserve=False)
fillet = Fillet(Curve=join, Radius=Slider(5, range=0..5))
preview_4 = CustomPreview(Geometry=fillet, Material=ColourSwatch(SwatchColor=RGB(255, 255, 255)))

# ---- group: other patterns
# play with the seed or use the same value (0 or 1) for all cells and see what changes
# NOTE: this random pattern is only an example to test the system capacity. It can (and should) be substituted with a more design-based criteria (ex by condition or mapped by an attractor)
number_slider_3 = Slider(36, range=0..100)
tstat = TreeStatistics(Tree=ln_5)  # -> Paths, Length, Count
number_slider_4 = Slider(1, range=0..1)
pline_2 = PolyLine(Vertices=eval_2.Point, Closed=True)
pline_3 = PolyLine(Vertices=eval_4.Point, Closed=True)
number_slider_5 = Slider(0.49, range=0..5)

# ---- group: other patterns / random 0-1 pattern
random = Random(Range=Domain(0, 1), Number=tstat.Count, Seed=number_slider_3, Integers=True)  # -> graft(Random)

# ---- group: border lines
join_2 = JoinCurves(Curves=weave, Preserve=False)  # -> simplify(Curves)

# ---- group: central spine curves
shift_3 = ShiftList(List=ln_4, Shift=1, Wrap=True)
merge_4 = Merge(Data1=simplify(graft(ln_4)), Data2=simplify(graft(shift_3)))
join_3 = JoinCurves(Curves=merge_4, Preserve=False)
fillet_2 = Fillet(Curve=join_3, Radius=Slider(2.646, range=0..5))
preview_5 = CustomPreview(Geometry=fillet_2, Material=ColourSwatch(SwatchColor=RGB(97, 97, 97)))

# ---- group: other patterns / alternate curve pattern (possible floor pattern)
shift_4 = ShiftList(List=ln_5, Shift=random, Wrap=True)
merge_5 = Merge(Data1=simplify(graft(ln_4)), Data2=simplify(graft(shift_4)))
join_4 = JoinCurves(Curves=merge_5, Preserve=False)
disc = Discontinuity(Curve=join_4, Level=1)  # -> Points, Parameters
nurbs = NurbsCurve(Vertices=disc.Points, Degree="2", Periodic=False)  # -> Curve, Length, Domain
preview_6 = CustomPreview(Geometry=nurbs.Curve, Material=ColourSwatch(SwatchColor=RGB(105, 105, 105)))

# ----
merge_6 = Merge(Data1=crv_3, Data2=join_2)

panel_2 = Panel("internalized data (sample)")

# ---- group: component contour
join_5 = JoinCurves(Curves=merge_6, Preserve=False)

# ---- group: border demi-lines
crv_4 = Curve(weave)

# ---- group: demi-arcs
crv_5 = Curve(pshift_4)

# ---- group: border demi-lines
crv_6 = Curve(Tree({0}: [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], {1}: [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], {2}: [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], {3}: [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], {4}: [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], {5}: [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]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))

# ---- group: demi-arcs
crv_7 = Curve(Tree({0}: [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], {1}: [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], {2}: [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], {3}: [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], {4}: [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], {5}: [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]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))

# ---- group: center to mid line
crv_8 = Curve(ln_4)

# ---- group: center to mid arc
crv_9 = Curve(ln_5)

# ---- group: center to mid line
crv_10 = Curve(Tree({0}: [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], {1}: [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], {2}: [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], {3}: [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], {4}: [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], {5}: [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]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))

# ---- group: center to mid arc
# geometries to bake, internalize, and copy to part 01
crv_11 = Curve(Tree({0}: [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], {1}: [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], {2}: [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], {3}: [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], {4}: [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], {5}: [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]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))

# ----
boundary = BoundarySurfaces(Edges=join_5)
join_6 = BrepJoin(Breps=flatten(boundary))  # -> Breps, Closed
# patterns
swatch = ColourSwatch(SwatchColor=RGB(255, 255, 255))
material_2 = CreateMaterial(
    Diffuse=ColourSwatch(SwatchColor=RGB(0, 0, 0)),
    Specular=RGB(255, 255, 255),
    Emission=RGB(0, 0, 0),
    Transparency=".5",
    Shine=0)
group = Group(Objects=crv_7)
group_2 = Group(Objects=crv_6)
group_3 = Group(Objects=crv_10)
group_4 = Group(Objects=crv_11)

# ---- group: other patterns / more triangular patterns
fillet_3 = Fillet(Curve=pline_2, Radius=number_slider_5)

# ----
merge_7 = Merge(Data1=group, Data2=group_2, Data3=group_3, Data4=group_4)

# ---- group: turn on to show component area
preview_7 = CustomPreview(Geometry=crv_3, Material=swatch)
preview_8 = CustomPreview(Geometry=join_6.Breps, Material=material_2)

# ----
# internalize and copy/paste to 01_ 2D cells to surface
group_5 = Group(Objects=merge_7)

# ---- group: build corresponding layer names structure
lng_2 = ListLength(List=crv_5)
lng_3 = ListLength(List=crv_4)
lng_4 = ListLength(List=crv_8)
lng_5 = ListLength(List=crv_9)
layer_names = Panel("""border demi-arcs
border demi-lines
center to mid line
center to mid arc""")
configuration_number = Panel("02")
merge_8 = Merge(Data1=lng_2, Data2=lng_3, Data3=lng_4, Data4=lng_5)
lng_6 = ListLength(List=flatten(lng_2))
concat = Concatenate(FragmentA=configuration_number, FragmentC="_", FragmentB=layer_names)
repeat = RepeatData(Data=graft(concat), Length=lng_6)
panel_3 = Panel(concat)
flip = FlipMatrix(Data=repeat)
repeat_2 = RepeatData(Data=simplify(graft(flip)), Length=simplify(graft(merge_8)))  # -> simplify(Data)
pshift_5 = ShiftPaths(Data=repeat_2, Offset=-1)

# ----
# baking
merge_9 = Merge(Data1=crv_5, Data2=crv_4, Data3=crv_8, Data4=crv_9)
bake = Button()
f_bakeatt = BakeAttributesEnhanced(obj=merge_9, layer=pshift_5, bake_iT=bake)  # -> info; inputs obj: GeometryBase, name: String, layer: String, color: Color, pWidth: Double, wires: Int32, group_n: Int32, group: Boolean, bake_iT: Boolean
#   port layer: Layer name for the object if the layer doesn't exist, it will be created
#   port bake_iT: Performs bake operation attach a button here and click to bake
# ---------- f_bakeatt: C# usings ----------
using System.IO;
using System.Linq;
using System.Data;
using System.Drawing;
using System.Reflection;
using System.Windows.Forms;
using System.Xml;
using System.Xml.Linq;
using System.Runtime.InteropServices;

using Rhino.DocObjects;
using Rhino.Collections;
using GH_IO;
using GH_IO.Serialization;
# ---------- f_bakeatt: C# ----------
                                                                            /*
    froGH - a sparse collection of (in)utilities for Grasshopper

    Bake Attributes ++
    Original Version Written by Giulio Piacentino - 2010 11 21 - for Grasshopper 0.8.002
    Enhanced by Co-de-iT (Alessio) - now bakes on chosen layer(s) and in groups

    froGH by Co-de-iT is licensed under a Creative Commons Attribution 4.0 International License.
    http://creativecommons.org/licenses/by/4.0/

    */

    initComp();

    if (bake_iT)
    {
      if(obj == null)
      {
        Print("No object to bake");
        return;
      }

      //Make new attribute to set name
      Rhino.DocObjects.ObjectAttributes att = new Rhino.DocObjects.ObjectAttributes();

      //Set object name
      if(!string.IsNullOrEmpty(name))
      {
        att.Name = name;
      }

      //Set color
      if(!color.IsEmpty)
      {
        att.ColorSource = Rhino.DocObjects.ObjectColorSource.ColorFromObject; //Make the color type "by object"
        att.ObjectColor = color;

        att.PlotColorSource = Rhino.DocObjects.ObjectPlotColorSource.PlotColorFromObject; //Make the plot color type "by object"
        att.PlotColor = color;
      }

      // Set group

      if(group)
      {
        doc.Groups.Add(Convert.ToString(group_n));
        att.AddToGroup(group_n);

      }

      //Set layer
      if(!string.IsNullOrEmpty(layer) && Rhino.DocObjects.Layer.IsValidName(layer))
      {
        //Get the current layer index
        Rhino.DocObjects.Tables.LayerTable layerTable = doc.Layers;
        int layerIndex = layerTable.FindByFullPath(layer, -1);
        //int layerIndex = layerTable.Find(layer, true);

        if(layerIndex < 0) //This layer does not exist, we add it
        {
          Rhino.DocObjects.Layer onlayer = new Rhino.DocObjects.Layer(); //Make a new layer
          onlayer.Name = layer;

          layerIndex = layerTable.Add(onlayer); //Add the layer to the layer table
          if (layerIndex > -1) //We managed to add a layer!
          {
            att.LayerIndex = layerIndex;
            Print("Added new layer to the document at position " + layerIndex + " named " + layer + ". ");
          } else
            Print("Layer did not add. Try cleaning up your layers."); //This never happened to me.
        }
        else
          att.LayerIndex = layerIndex; //We simply add to the existing layer
      }


      //Set plotweight
      if(pWidth > 0)
      {
        att.PlotWeightSource = Rhino.DocObjects.ObjectPlotWeightSource.PlotWeightFromObject;
        att.PlotWeight = pWidth;
      }


      //Set material
      bool materialByName = !string.IsNullOrEmpty(material as string);
      Rhino.Display.DisplayMaterial inMaterial = material as Rhino.Display.DisplayMaterial;
      if(material is Color)
      {
        inMaterial = new Rhino.Display.DisplayMaterial((Color) material);
      }
      if(material != null && inMaterial == null && !materialByName)
      {
        if(!(material is string))
        {
          try //We also resort to try with IConvertible
          {
            inMaterial = (Rhino.Display.DisplayMaterial) Convert.ChangeType(material, typeof(Rhino.Display.DisplayMaterial));
          }
          catch(InvalidCastException)
          {
          }
        }
      }
      if(inMaterial != null || materialByName)
      {
        string matName;

        if(!materialByName)
        {
          matName = string.Format("D:{0}-E:{2}-S:{3},{4}-T:{5}",
            //Format(inMaterial.Ambient),
            Format(inMaterial.Diffuse),
            Format(inMaterial.Emission),
            Format(inMaterial.Specular),
            inMaterial.Shine.ToString(),
            inMaterial.Transparency.ToString()
            );
        }
        else
        {
          matName = (string) material;
        }

        int materialIndex = doc.Materials.Find(matName, true);
        if(materialIndex < 0 && !materialByName) //Material does not exist and we have its specs
        {
          materialIndex = doc.Materials.Add(); //Let's add it
          if(materialIndex > -1)
          {
            Print("Added new material at position " + materialIndex + " named \"" + matName + "\". ");
            Rhino.DocObjects.Material m = doc.Materials[materialIndex];
            m.Name = matName;
            //m.AmbientColor = inMaterial.Ambient;
            m.DiffuseColor = inMaterial.Diffuse;
            m.EmissionColor = inMaterial.Emission;
            //m.ReflectionColor = no equivalent
            m.SpecularColor = inMaterial.Specular;
            m.Shine = inMaterial.Shine;
            m.Transparency = inMaterial.Transparency;
            //m.TransparentColor = no equivalent
            m.CommitChanges();

            att.MaterialSource = Rhino.DocObjects.ObjectMaterialSource.MaterialFromObject;
            att.MaterialIndex = materialIndex;
          }
          else
            Print("Material did not add. Try cleaning up your materials."); //This never happened to me.
        }
        else if(materialIndex < 0 && materialByName) //Material does not exist and we do not have its specs. We do nothing
        {
          Print("Warning: material name not found. I cannot set the source to this material name. Add a material with name: " + matName);
        }
        else
        {
          //If this material exists, we do not replace it!
          att.MaterialSource = Rhino.DocObjects.ObjectMaterialSource.MaterialFromObject;
          att.MaterialIndex = materialIndex;
        }
      }


      //Set wire density
      if(wires == -1 || wires > 0)
      {
        att.WireDensity = wires;
      }


      //Bake to the right type of object
      switch(obj.ObjectType)
      {
        case Rhino.DocObjects.ObjectType.Brep:
          doc.Objects.AddBrep(obj as Brep, att);
          break;
        case Rhino.DocObjects.ObjectType.Curve:
          doc.Objects.AddCurve(obj as Curve, att);
          break;
        case Rhino.DocObjects.ObjectType.Point:
          doc.Objects.AddPoint((obj as Rhino.Geometry.Point).Location, att);
          break;
        case Rhino.DocObjects.ObjectType.Surface:
          doc.Objects.AddSurface(obj as Surface, att);
          break;
        case Rhino.DocObjects.ObjectType.Mesh:
          doc.Objects.AddMesh(obj as Mesh, att);
          break;
        case Rhino.DocObjects.ObjectType.Extrusion:
          typeof(Rhino.DocObjects.Tables.ObjectTable).InvokeMember("AddExtrusion", BindingFlags.Instance | BindingFlags.InvokeMethod, null, doc.Objects, new object[]{obj, att});
          break;
        case Rhino.DocObjects.ObjectType.PointSet:
          doc.Objects.AddPointCloud(obj as Rhino.Geometry.PointCloud, att); //This is a speculative entry
          break;
        default:
          Print("The script does not know how to handle this type of geometry: " + obj.GetType().FullName);
          break;
      }
      Print("Added " + obj.GetType().Name);

    }
    else
    {
      Print("Inactive");
    }
    //obj_out = obj;
# ---------- f_bakeatt: C# additional code ----------
  void initComp(){

    Component.Name = "Bake Attributes Enhanced";
    Component.NickName = "f_BakeAtt++";
    Component.Description = "Bakes objects with attributes such as color, material, layer, object name, wire density. Option to bake in groups";
    Component.Params.Input[0].Name = "Object";
    Component.Params.Input[0].Description = "Object to bake";
    Component.Params.Input[1].Name = "Object name";
    Component.Params.Input[1].Description = "A custom name for the object";
    Component.Params.Input[2].Name = "Object Layer";
    Component.Params.Input[2].Description = "Layer name for the object\nif the layer doesn't exist, it will be created";
    Component.Params.Input[3].Name = "Object Color";
    Component.Params.Input[3].Description = "Color of baked object";
    Component.Params.Input[4].Name = "Print Width";
    Component.Params.Input[4].Description = "Print width";
    Component.Params.Input[5].Name = "Wire density";
    Component.Params.Input[5].Description = "Density of wires for display";
    Component.Params.Input[6].Name = "Material";
    Component.Params.Input[6].Description = "Object custom material";
    Component.Params.Input[7].Name = "Group Number";
    Component.Params.Input[7].Description = "Number of the group for the object\n(in case group option is active)";
    Component.Params.Input[8].Name = "Group Objects";
    Component.Params.Input[8].Description = "Bake objects in groups according to the group number for each object";
    Component.Params.Input[9].Name = "Bake it!";
    Component.Params.Input[9].Description = "Performs bake operation\nattach a button here and click to bake";
    Component.Params.Output[0].Name = "Info";
    Component.Params.Output[0].Description = "Info on the bake process/result";

  }

  static string Format(Color c)
  {
    return (new System.Text.StringBuilder("A")).Append(c.A.ToString()).Append("R").Append(c.R.ToString()).Append("G")
      .Append(c.G.ToString()).Append("B").Append(c.B.ToString()).ToString();
  }
# ---------- end f_bakeatt ----------

# ==== cluster SortPointsByAngle: Sorts a list of points by angle from their average point
plane = ClusterInput()  # reference Plane for sorting - leave empty for XY plane
points = ClusterInput()  # Ponts to sort
# froGH - a sparse collection of (in)utilities for Grasshopper
# 
#     froGH by Co-de-iT is licensed under a Creative Commons Attribution 4.0 International License.
#     http://creativecommons.org/licenses/by/4.0/
null = NullItem(Item=plane)  # -> NullFlags, InvalidFlags, Description
xy = XYPlane(Origin=Point(0, 0, 0))
expression = Expression(n=null.NullFlags, xy=xy, cp=plane, Expression="if(n,xy,cp)")
avr = Average(Input=points)
lng = ListLength(List=points)
deplane = DeconstructPlane(Plane=expression)  # -> Origin, XAxis, YAxis, ZAxis
vec2pt = Vector2Pt(PointA=avr, PointB=points, Unitize=False)  # -> Vector, Length
X = UnitX(Factor=1)
series = Series(Start=0, Step=1, Count=lng)
int = Integer(series)
f_vangsign = VectorAngleWithSign(V1=X, V2=vec2pt.Vector, Z=deplane.ZAxis)  # -> A; inputs V1: Vector3d, V2: Vector3d, Z: Vector3d
# ---------- f_vangsign: C# ----------
       /*
    froGH - a sparse collection of (in)utilities for Grasshopper

    Vector angle with Sign v 0.1
    code by Alessio Erioli

    froGH by Co-de-iT is licensed under a Creative Commons Attribution 4.0 International License.
    http://creativecommons.org/licenses/by/4.0/

    */
    initComp();
    // maps vector coordinates to the plane space
    if (Z.IsZero) Z = Vector3d.ZAxis;
    Plane p = new Plane(new Point3d(0, 0, 0), V1, Z);
    p.Rotate(-Math.PI * 0.5, V1);
    Point3d p1,p2;
    p.RemapToPlaneSpace((Point3d) V1, out p1);
    p.RemapToPlaneSpace((Point3d) V2, out p2);

    A = angSign((Vector3d) p1, (Vector3d) p2);
# ---------- f_vangsign: C# additional code ----------
  void initComp(){
    Component.Name = "Vector Angle with sign";
    Component.NickName = "f_VAngSign";
    Component.Description = "Computes angle between vectors with direction-dependent sign:\nclockwise is -, counter-clockwise is +";
    Component.Params.Input[0].Name = "Vector 1";
    Component.Params.Input[0].Description = "first vector";
    Component.Params.Input[1].Name = "Vector 2";
    Component.Params.Input[1].Description = "second vector";
    Component.Params.Input[2].Name = "Z axis";
    Component.Params.Input[2].Description = "Z axis of reference plane - keep empty for World Z";
    Component.Params.Output[0].Name = "Angle";
    Component.Params.Output[0].Description = "Angle (with sign) between vectors";
  }

  double angSign(Vector3d v1, Vector3d v2){
    v1.Unitize();
    v2.Unitize();
    return (System.Math.Atan2(v2.Y, v2.X) - System.Math.Atan2(v1.Y, v1.X));
  }
# ---------- end f_vangsign ----------
sort = SortList(Keys=f_vangsign, ValuesA=points, ValuesB=int)  # -> Keys, ValuesA, ValuesB
angles = ClusterOutput(sort.Keys)  # Sorted angles
points_2 = ClusterOutput(sort.ValuesA)  # Sorted points
points_indexes = ClusterOutput(sort.ValuesB)  # Sorted indexes
