# Grasshopper definition 01_2D cells to surfaces.gh (Grasshopper 1.0.7)
# Copyright: Co-de-iT
# plug-ins: MeshEdit Components

# Circle packing based system - 01
# 
# 2D cells to surfaces
# 
# © a3 2018 _ Creative Commons Attribution-NonCommercial-ShareAlike3.0 UnportedLicense.
# 00 - import curves to build sub-cells
case_studies = ValueList({"zero": 0, "one": 1}, selected="zero")

# ---- group: case 0
# data from 00_circle pack to 2D cells
group = Group(Objects=Tree({0}: [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], {1}: [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], {2}: [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], {3}: [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], {4}: [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], {5}: [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], {6}: [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], {7}: [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], {8}: [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], {9}: [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]))

# ---- group: case 1
group_2 = Group(Objects=Tree({0}: [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], {1}: [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], {2}: [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], {3}: [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], {4}: [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], {5}: [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]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))

# ---- group: border demi-lines
# curve from
# previous definition
crv = Curve(Tree({0}: [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], {1}: [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], {2}: [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], {3}: [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], {4}: [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], {5}: [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], {6}: [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], {7}: [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], {8}: [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], {9}: [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]))  # disabled

# ---- group: demi-arcs
crv_2 = Curve(Tree({0}: [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], {1}: [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], {2}: [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], {3}: [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], {4}: [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], {5}: [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], {6}: [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], {7}: [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], {8}: [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], {9}: [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]))  # disabled

# ---- group: center to mid line
crv_3 = Curve(Tree({0}: [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], {1}: [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], {2}: [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], {3}: [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], {4}: [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], {5}: [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], {6}: [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], {7}: [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], {8}: [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], {9}: [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]))  # disabled

# ---- group: center to mid arc
crv_4 = Curve(Tree({0}: [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], {1}: [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], {2}: [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], {3}: [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], {4}: [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], {5}: [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], {6}: [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], {7}: [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], {8}: [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], {9}: [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]))  # disabled

# ----
filter = StreamFilter(Gate=case_studies, Stream0=group, Stream1=group_2)
ungroup = Ungroup(Group=filter)  # -> simplify(Objects)
item = ListItem(List=ungroup, Index=0, Wrap=True)  # -> Item, Item1, Item2, Item3

# ---- group: all perimetral curves
merge = Merge(Data1=crv, Data2=crv_2)  # disabled

# ---- group: all internal curves
merge_2 = Merge(Data1=crv_3, Data2=crv_4)  # disabled

# ----
end = EndPoints(Curve=crv_4)  # -> Start, End; disabled
avr = Average(Input=end.Start)  # disabled

# ---- group: border demi-lines
ungroup_2 = Ungroup(Group=item.Item)  # -> simplify(Objects)

# ---- group: demi-arcs
ungroup_3 = Ungroup(Group=item.Item1)  # -> simplify(Objects)

# ---- group: center to mid line
ungroup_4 = Ungroup(Group=item.Item2)  # -> simplify(Objects)

# ---- group: center to mid arc
ungroup_5 = Ungroup(Group=item.Item3)  # -> simplify(Objects)

# ---- group: sort perimetral curves for each macro-cell
# compensation value to put index 0 on a straight line
curvepoint = PointOnCurve(crv_2, parameter=0.5)  # disabled
curvepoint_2 = PointOnCurve(merge, parameter=0.5)  # disabled
xy = XYPlane(Origin=Point(0, 0, 0))  # disabled
# If curves have generic orientation or have been manipulated in Rhino after the previous phase use these methods for sorting
f_ptsbyang = SortPointsByAngle(points=curvepoint_2, plane=xy)  # -> angles, points_2, points_indexes; disabled
item_2 = ListItem(List=curvepoint, Index=0, Wrap=True)  # disabled
number_slider = Slider(2, range=1..5)  # disabled
cp = ClosestPoint(Point=item_2, Cloud=f_ptsbyang.points_2)  # -> ClosestPoint, CPIndex, Distance; disabled
subtraction = Subtraction(A=cp.CPIndex, B=number_slider)  # disabled
shift = ShiftList(List=f_ptsbyang.points_indexes, Shift=subtraction, Wrap=True)  # disabled
item_3 = ListItem(List=merge, Index=shift, Wrap=True)  # disabled

# ----
shift_2 = ShiftList(List=ungroup_3, Shift="2", Wrap=True)  # -> simplify(List)
shift_3 = ShiftList(List=ungroup_5, Shift="1", Wrap=True)  # -> simplify(List)
# combine and sort curves
panel = Panel("""0
0
1
1""")
weave = Weave(Pattern=[0, 1], Stream0=ungroup_4, Stream1=shift_3, NullGaps=False)  # -> simplify(Weave)
weave_2 = Weave(Pattern=panel, Stream0=ungroup_2, Stream1=shift_2, NullGaps=False)
end_2 = EndPoints(Curve=weave)  # -> Start, End

# ---- group: reference point to sort internal curves
item_4 = ListItem(List=item_3, Index=0, Wrap=True)  # disabled
end_3 = EndPoints(Curve=item_4)  # -> Start, End; disabled
pt = Point(end_3.Start)  # disabled

# ---- group: sort internal curves according to perimetral curves
end_4 = EndPoints(Curve=merge_2)  # -> Start, End; disabled
xy_2 = XYPlane(Origin=Point(0, 0, 0))  # disabled
pt_2 = Point(end_4.End)  # disabled
f_ptsbyang_2 = SortPointsByAngle(points=pt_2, plane=xy_2)  # -> angles, points_2, points_indexes; disabled
cp_2 = ClosestPoint(Point=pt, Cloud=f_ptsbyang_2.points_2)  # -> ClosestPoint, CPIndex, Distance; disabled
shift_4 = ShiftList(List=f_ptsbyang_2.points_indexes, Shift=cp_2.CPIndex, Wrap=True)  # disabled
item_5 = ListItem(List=merge_2, Index=shift_4, Wrap=True)  # disabled
item_6 = ListItem(List=pt_2, Index=shift_4, Wrap=True)  # disabled

# ----
item_7 = ListItem(List=end_2.Start, Index=0, Wrap=True)

# ---- group: sorted perimetral curves
# sorted data
crv_5 = Curve(weave_2)

# ---- group: sorted internal curves
# not used here but they might be useful for something else
crv_6 = Curve(weave)

# ---- group: sorted midpoints
pt_3 = Point(end_2.End)

# ---- group: cells centers
pt_4 = Point(item_7)

# ---- group: sorted external curves
crv_7 = Curve(item_3)

# ---- group: sorted internal curves
crv_8 = Curve(item_5)

# ---- group: sorted mid points
pt_5 = Point(item_6)

# ---- group: cells centers
pt_6 = Point(avr)

# ---- group: attractor curve for height
crv_9 = Curve(<curve referenced from the Rhino model>)

# ----
dispatch = Dispatch(List=pt_3, DispatchPattern=[True, False])  # -> ListA, ListB

# ---- group: select straight demi-lines
# 01 - generate edge curves to make surfaces
panel_2 = Panel("""1
1
0
0""")
cull = CullPattern(List=crv_5, CullPattern=panel_2)

# ---- group: height for mid points on straight lines
height_close_to_the_curve = Slider(3.5, range=0..10)
height_far_from_the_curve = Slider(1.5, range=0..10)

crv_cp = CurveClosestPoint(Point=dispatch.ListA, Curve=crv_9)  # -> Point, Parameter, Distance
num = Number(crv_cp.Distance)
bnd = Bounds(Numbers=flatten(num))
dom = ConstructDomain(DomainStart=0, DomainEnd=1)
remap = RemapNumbers(Value=num, Source=bnd, Target=dom)  # -> Mapped, Clipped
graph = GraphMapper(remap.Mapped, x0=0, x1=1, y0=0, y1=1, container_name="Bezier", cpx=[0, 0.3573980629, 0.6609601378, 1], cpy=[0, 0, 1, 1])
dom_2 = ConstructDomain(DomainStart=height_close_to_the_curve, DomainEnd=height_far_from_the_curve)
remap_2 = RemapNumbers(Value=graph, Source=Domain(0, 1), Target=dom_2)  # -> Mapped, Clipped

# ---- group: sort them in couples
# h. push = 0.5
# v. push = 0
# "verticalness" = 0
# 
# approximates catenary
panel_3 = Panel("2")
partition = PartitionList(List=cull, Size=panel_3)

# ----
verticalness = Slider(0, range=0..1)
horizontal_push = Slider(0.5, range=0..1)
vertical_push = Slider(0, range=0..1)

perpendicularity = Slider(1, range=0..1)
tangent_strength = Slider(0.5, range=0..1)

vertical_push_2 = Slider(0.166, range=0..1)
# h. push = 0.5
# v. push = 0
# "verticalness" = 0
# 
# approximates catenary
horizontal_push_2 = Slider(0.727, range=0..1)
verticalness_2 = Slider(0, range=0..1)

len = Length(Curve=partition)
multiplication = Multiplication(A=len, B=horizontal_push)
Z = UnitZ(Factor=remap_2.Mapped)
end_5 = EndPoints(Curve=partition)  # -> Start, simplify(graft(End))
vec = Vector(partition)
pt_7 = Point(dispatch.ListB)

# ---- group: raised mid point
move = Move(Geometry=dispatch.ListA, Motion=Z)  # -> Geometry, Transform

# ----
amp = Amplitude(Vector=vec, Amplitude=multiplication)
vec2pt = Vector2Pt(PointA=pt_4, PointB=pt_7, Unitize=False)  # -> Vector, Length
multiplication_2 = Multiplication(A=vec2pt.Vector, B=horizontal_push_2)

# ---- group: duplicated to match other data trees
repeat = RepeatData(Data=graft(move.Geometry), Length="2")  # -> simplify(graft(Data))
repeat_2 = RepeatData(Data=graft(remap_2.Mapped), Length="2")  # -> simplify(graft(Data))

# ---- group: perp vector to edge
Z_2 = UnitZ(Factor=1)
item_8 = ListItem(List=vec, Index=0, Wrap=True)
xprod = CrossProduct(VectorA=item_8, VectorB=Z_2, Unitize=True)  # -> Vector, Length

# ---- group: pushed point along edge
move_2 = Move(Geometry=graft(move.Geometry), Motion=amp)  # -> simplify(graft(Geometry)), Transform

# ---- group: average raised point
avr_2 = Average(Input=move.Geometry)

# ----
move_3 = Move(Geometry=avr_2, Motion=multiplication_2)  # -> Geometry, Transform

# ---- group: interpolate direction between radial and perpendicular vector to modulate arc shape
vec2pt_2 = Vector2Pt(PointA=dispatch.ListA, PointB=pt_4, Unitize=False)  # -> simplify(Vector), Length
pshift = ShiftPaths(Data=xprod.Vector, Offset=-1)
unit = UnitVector(Vector=vec2pt_2.Vector)
merge_3 = Merge(Data1=graft(unit), Data2=graft(pshift))
interp = InterpolateData(Data=merge_3, Parameter=perpendicularity, Interpolation=2)
pshift_2 = ShiftPaths(Data=interp, Offset=-1)
multiplication_3 = Multiplication(A=vec2pt_2.Length, B="0.5")
unit_2 = UnitVector(Vector=pshift_2)
multiplication_4 = Multiplication(A=unit_2, B=multiplication_3, C=tangent_strength)
multiplication_5 = Multiplication(A=unit, B=multiplication_3, C=tangent_strength)
rev = Reverse(Vector=multiplication_5)

# ---- group: interpolate direction between diagonal and vertical Z vector to modulate arc shape
Z_3 = UnitZ(Factor=1)
vec2pt_3 = Vector2Pt(PointA=pt_7, PointB=move_3.Geometry, Unitize=True)  # -> Vector, Length
multiplication_6 = Multiplication(A=vec2pt_3.Vector, B="0")
addition = Addition(A=multiplication_6, B=Z_3)
merge_4 = Merge(Data1=graft(vec2pt_3.Vector), Data2=graft(addition))
interp_2 = InterpolateData(Data=merge_4, Parameter=verticalness_2, Interpolation=2)
pshift_3 = ShiftPaths(Data=interp_2, Offset=-1)
unit_3 = UnitVector(Vector=pshift_3)
pdecon = Deconstruct(Point=avr_2)  # -> XComponent, YComponent, ZComponent
multiplication_7 = Multiplication(A=unit_3, B=pdecon.ZComponent, C=vertical_push_2)

# ---- group: interpolate between diagonal and vertical vector at base points
vec2pt_4 = Vector2Pt(PointA=end_5.End, PointB=move_2.Geometry, Unitize=True)  # -> Vector, Length
multiplication_8 = Multiplication(A=vec2pt_4.Vector, B="0")
Z_4 = UnitZ(Factor=1)
addition_2 = Addition(A=multiplication_8, B=Z_4)
merge_5 = Merge(Data1=vec2pt_4.Vector, Data2=addition_2)
interp_3 = InterpolateData(Data=merge_5, Parameter=verticalness, Interpolation=2)
unit_4 = UnitVector(Vector=interp_3)
multiplication_9 = Multiplication(A=unit_4, B=repeat_2, C=vertical_push)

# ---- group: demi arcs
not = GateNot(A=panel_2)
cull_2 = CullPattern(List=crv_5, CullPattern=not)

# ----
vec_2 = Vector(graft(amp))

# ---- group: arcs rebuilt as NURBS curves to avoid getting BReps
divide = DivideCurve(Curve=cull_2, Count="3", Kinks=False)  # -> Points, Tangents, Parameters
intcrv = Interpolate(Vertices=divide.Points, Degree=3, Periodic=False, KnotStyle=1)  # -> Curve, Length, Domain
# 02 - generate and sort surfaces
pshift_4 = ShiftPaths(Data=intcrv.Curve, Offset=-1)

# ----
bzspan = BezierSpan(StartPoint=end_5.End, StartTangent=multiplication_9, EndPoint=repeat, EndTangent=vec_2)  # -> Curve, Length, Domain
bzspan_2 = BezierSpan(StartPoint=move.Geometry, StartTangent=multiplication_4, EndPoint=avr_2, EndTangent=rev)  # -> Curve, Length, Domain
bzspan_3 = BezierSpan(StartPoint=pt_7, StartTangent=multiplication_7, EndPoint=avr_2, EndTangent=multiplication_2)  # -> Curve, Length, Domain

# ---- group: curves on straight lines
pshift_5 = ShiftPaths(Data=bzspan.Curve, Offset="-2")

# ---- group: internal curves
weave_3 = Weave(Pattern=[0, 1], Stream0=bzspan_2.Curve, Stream1=bzspan_3.Curve, NullGaps=False)

# ---- group: creates 4 sided surfaces
item_9 = ListItem(List=simplify(pshift_4), Index=0, Wrap=True)  # -> Item, Item1, Item2, Item3, Item4, Item5
item_10 = ListItem(List=simplify(weave_3), Index=0, Wrap=True)  # -> Item, Item1, Item2, Item3, Item4, Item5
item_11 = ListItem(List=pshift_5, Index=0, Wrap=True)  # -> Item, Item1, Item2, Item3, Item4, Item5
merge_6 = Merge(Data1=item_9.Item, Data2=item_11.Item1, Data3=item_10.Item, Data4=item_10.Item1)
merge_7 = Merge(Data1=item_9.Item1, Data2=item_11.Item2, Data3=item_10.Item1, Data4=item_10.Item2)
merge_8 = Merge(Data1=item_9.Item2, Data2=item_11.Item3, Data3=item_10.Item2, Data4=item_10.Item3)
merge_9 = Merge(Data1=item_9.Item3, Data2=item_11.Item4, Data3=item_10.Item3, Data4=item_10.Item4)
merge_10 = Merge(Data1=item_9.Item4, Data2=item_11.Item5, Data3=item_10.Item4, Data4=item_10.Item5)
merge_11 = Merge(Data1=item_9.Item5, Data2=item_11.Item, Data3=item_10.Item5, Data4=item_10.Item)
item_12 = ListItem(List=merge_6, Index=0, Wrap=True)  # -> Item, Item1, Item2, Item3
item_13 = ListItem(List=merge_7, Index=0, Wrap=True)  # -> Item, Item1, Item2, Item3
item_14 = ListItem(List=merge_8, Index=0, Wrap=True)  # -> Item, Item1, Item2, Item3
item_15 = ListItem(List=merge_9, Index=0, Wrap=True)  # -> Item, Item1, Item2, Item3
item_16 = ListItem(List=merge_10, Index=0, Wrap=True)  # -> Item, Item1, Item2, Item3
item_17 = ListItem(List=merge_11, Index=0, Wrap=True)  # -> Item, Item1, Item2, Item3
edgesrf = EdgeSurface(CurveA=item_12.Item, CurveB=item_12.Item1, CurveC=item_12.Item2, CurveD=item_12.Item3)
edgesrf_2 = EdgeSurface(CurveA=item_13.Item, CurveB=item_13.Item1, CurveC=item_13.Item2, CurveD=item_13.Item3)
edgesrf_3 = EdgeSurface(CurveA=item_14.Item, CurveB=item_14.Item1, CurveC=item_14.Item2, CurveD=item_14.Item3)
edgesrf_4 = EdgeSurface(CurveA=item_15.Item, CurveB=item_15.Item1, CurveC=item_15.Item2, CurveD=item_15.Item3)
edgesrf_5 = EdgeSurface(CurveA=item_16.Item, CurveB=item_16.Item1, CurveC=item_16.Item2, CurveD=item_16.Item3)
edgesrf_6 = EdgeSurface(CurveA=item_17.Item, CurveB=item_17.Item1, CurveC=item_17.Item2, CurveD=item_17.Item3)
merge_12 = Merge(Data1=edgesrf, Data2=edgesrf_2, Data3=edgesrf_3, Data4=edgesrf_4, Data5=edgesrf_5, Data6=edgesrf_6)

# ----
srf = Surface(merge_12)
flip_direction = BooleanToggle(False)

# ---- group: adjusts surfaces UV orientation
sdivide = DivideSurface(Surface=srf, UCount="1", VCount="1")  # -> simplify(Points), Normals, Parameters
avr_3 = Average(Input=sdivide.Points)
pshift_6 = ShiftPaths(Data=avr_3, Offset=-1)
pdecon_2 = Deconstruct(Point=pshift_6)  # -> XComponent, YComponent, ZComponent
sort = SortList(Keys=pdecon_2.ZComponent)  # -> Keys, ValuesA
item_18 = ListItem(List=sort.Keys, Index=0, Wrap=True)
larger = LargerThan(FirstNumber=item_18, SecondNumber="0")  # -> LargerThan, OrEqualTo
pshift_7 = ShiftPaths(Data=larger.LargerThan, Offset=-1)
dispatch_2 = Dispatch(List=srf, DispatchPattern=pshift_7)  # -> ListA, ListB

# ---- group: adjusts surfaces UV orientation / swaps surface UV
uvswap = CSharpScript(S=dispatch_2.ListA, TooltipDescriptionOverride="Like I said", TooltipTextOverride="Swaps Surface UV")  # -> out, A; inputs S: Surface
# ---------- uvswap: C# ----------
    if (S == null) return;
    A = S.Transpose();
# ---------- end uvswap ----------

# ---- group: adjusts surfaces UV orientation (continued)
weave_4 = Weave(Pattern=pshift_7, Stream0=dispatch_2.ListB, Stream1=uvswap.A, NullGaps=False)

# ---- group: surfaces
srf_2 = Surface(reparameterize(weave_4))

# ----
sdivide_2 = DivideSurface(Surface=srf_2, UCount=Slider(18, range=1..20), VCount=Slider(13, range=1..20))  # -> simplify(Points), Normals, Parameters
join = BrepJoin(Breps=flatten(srf_2))  # -> Breps, Closed
path_mapper = PathMapper(sdivide_2.Points, source="{A;B;C}(i)", target="{A;B;i}(C)")
edges = BrepEdges(Brep=join.Breps)  # -> Naked, Interior, NonManifold
filter_2 = StreamFilter(Gate=flip_direction, Stream0=sdivide_2.Points, Stream1=path_mapper)
pline = PolyLine(Vertices=filter_2, Closed=False)
nurbs = NurbsCurve(Vertices=filter_2, Degree=3, Periodic=False)  # -> Curve, Length, Domain

# ---- group: display
preview = CustomPreview(Geometry=[edges.Naked, edges.Interior], Material=ColourSwatch(SwatchColor=RGB(255, 255, 255)))
preview_2 = CustomPreview(Geometry=srf_2, Material=ColourSwatch(SwatchColor=RGBA(0, 0, 0, 120)))
preview_3 = CustomPreview(Geometry=nurbs.Curve, Material=ColourSwatch(SwatchColor=RGB(168, 168, 168)))

# ---- group: generate a low-poly mesh
sdivide_3 = DivideSurface(Surface=srf_2, UCount="1", VCount="1")  # -> Points, Normals, Parameters
pshift_8 = ShiftPaths(Data=sdivide_3.Points, Offset=-1)
panel_4 = Panel("""0
1
3
2""")
item_19 = ListItem(List=pshift_8, Index=panel_4, Wrap=True)
conmesh = ConstructMesh(Vertices=item_19, Faces={A=0, B=1, C=2, D=3})
mjoin = MeshJoin(Meshes=flatten(conmesh))
weldvertices = MeshWeldVertices(Mesh=mjoin, Tolerance=0.01)  # -> RuntimeMessage, Mesh

# ----
unifynormals = MeshUnifyNormals(Mesh=weldvertices.Mesh)

# ---- group: generate a low-poly mesh (continued)
mesh = Mesh(unifynormals)

# ==== cluster SortPointsByAngle: Sorts a list of points by angle from their average point
plane = ClusterInput()  # reference Plane for sorting - leave empty for XY plane
points = ClusterInput()  # Ponts to sort
# froGH - a sparse collection of (in)utilities for Grasshopper
# 
#     froGH by Co-de-iT is licensed under a Creative Commons Attribution 4.0 International License.
#     http://creativecommons.org/licenses/by/4.0/
null = NullItem(Item=plane)  # -> NullFlags, InvalidFlags, Description
xy = XYPlane(Origin=Point(0, 0, 0))
expression = Expression(n=null.NullFlags, xy=xy, cp=plane, Expression="if(n,xy,cp)")
avr = Average(Input=points)
lng = ListLength(List=points)
deplane = DeconstructPlane(Plane=expression)  # -> Origin, XAxis, YAxis, ZAxis
vec2pt = Vector2Pt(PointA=avr, PointB=points, Unitize=False)  # -> Vector, Length
X = UnitX(Factor=1)
series = Series(Start=0, Step=1, Count=lng)
int = Integer(series)
f_vangsign = VectorAngleWithSign(V1=X, V2=vec2pt.Vector, Z=deplane.ZAxis)  # -> A; inputs V1: Vector3d, V2: Vector3d, Z: Vector3d
# ---------- f_vangsign: C# ----------
       /*
    froGH - a sparse collection of (in)utilities for Grasshopper

    Vector angle with Sign v 0.1
    code by Alessio Erioli

    froGH by Co-de-iT is licensed under a Creative Commons Attribution 4.0 International License.
    http://creativecommons.org/licenses/by/4.0/

    */
    initComp();
    // maps vector coordinates to the plane space
    if (Z.IsZero) Z = Vector3d.ZAxis;
    Plane p = new Plane(new Point3d(0, 0, 0), V1, Z);
    p.Rotate(-Math.PI * 0.5, V1);
    Point3d p1,p2;
    p.RemapToPlaneSpace((Point3d) V1, out p1);
    p.RemapToPlaneSpace((Point3d) V2, out p2);

    A = angSign((Vector3d) p1, (Vector3d) p2);
# ---------- f_vangsign: C# additional code ----------
  void initComp(){
    Component.Name = "Vector Angle with sign";
    Component.NickName = "f_VAngSign";
    Component.Description = "Computes angle between vectors with direction-dependent sign:\nclockwise is -, counter-clockwise is +";
    Component.Params.Input[0].Name = "Vector 1";
    Component.Params.Input[0].Description = "first vector";
    Component.Params.Input[1].Name = "Vector 2";
    Component.Params.Input[1].Description = "second vector";
    Component.Params.Input[2].Name = "Z axis";
    Component.Params.Input[2].Description = "Z axis of reference plane - keep empty for World Z";
    Component.Params.Output[0].Name = "Angle";
    Component.Params.Output[0].Description = "Angle (with sign) between vectors";
  }

  double angSign(Vector3d v1, Vector3d v2){
    v1.Unitize();
    v2.Unitize();
    return (System.Math.Atan2(v2.Y, v2.X) - System.Math.Atan2(v1.Y, v1.X));
  }
# ---------- end f_vangsign ----------
sort = SortList(Keys=f_vangsign, ValuesA=points, ValuesB=int)  # -> Keys, ValuesA, ValuesB
angles = ClusterOutput(sort.Keys)  # Sorted angles
points_2 = ClusterOutput(sort.ValuesA)  # Sorted points
points_indexes = ClusterOutput(sort.ValuesB)  # Sorted indexes
