# Grasshopper definition a3_cXX_curve tweening.gh (Grasshopper 1.0.7)
# Copyright: Co-de-iT

crv = Curve(<curve referenced from the Rhino model>)
crv_2 = Curve(<curve referenced from the Rhino model>)
# Curve tweening
# 
# © a3 2018 _ Creative Commons Attribution-NonCommercial-ShareAlike3.0 UnportedLicense.
cp = ControlPoints(Curve=crv_2)  # -> Points, Weights, Knots
cp_2 = ControlPoints(Curve=crv)  # -> Points, Weights, Knots
merge = Merge(Data1=graft(cp.Points), Data2=graft(cp_2.Points))
range = Range(Domain=Domain(0, 1), Steps=Slider(60, range=2..100))
pdecon = Deconstruct(Point=merge)  # -> XComponent, YComponent, ZComponent
# here, Z varies according to this graph. You can do the same for X and Y, or see what happens bypassing the graph
graph = GraphMapper(range, x0=0, x1=1, y0=0, y1=1, container_name="Bezier", cpx=[0, 0.3446686268, 0.5068841577, 1], cpy=[0, 0, 1, 1])
interp = InterpolateData(Data=pdecon.XComponent, Parameter=range, Interpolation=2)  # -> simplify(Value)
interp_2 = InterpolateData(Data=pdecon.YComponent, Parameter=range, Interpolation=2)  # -> simplify(Value)
interp_3 = InterpolateData(Data=pdecon.ZComponent, Parameter=graph, Interpolation=2)  # -> simplify(Value)
pt = ConstructPoint(XCoordinate=interp, YCoordinate=interp_2, ZCoordinate=interp_3)
flip = FlipMatrix(Data=pt)
item = ListItem(List=flip, Index=0, Wrap=True)  # -> flatten(Item)
f_dbshift = DoubleShift(L=item, W="false")  # -> Fw, Bw; inputs L: list, W: Boolean
# ---------- f_dbshift: C# ----------
                                        /*
    froGH - a sparse collection of (in)utilities for Grasshopper

    Double Shift
    code by Alessio Erioli

    froGH by Co-de-iT is licensed under a Creative Commons Attribution 4.0 International License.
    http://creativecommons.org/licenses/by/4.0/

    */

    initComp();

    if (L.Count > 0){

      List<object> fW = new List<object>(L);
      List<object> bW = new List<object>(L);


      fW.RemoveAt(L.Count - 1);
      bW.RemoveAt(0);

      if (W){
        fW.Insert(0, L[L.Count - 1]);
        bW.Add(L[0]);
      }

      Fw = fW;
      Bw = bW;
    }
# ---------- f_dbshift: C# additional code ----------
  void initComp(){
    Component.Name = "Double Shift";
    Component.NickName = "f_DbShift";
    Component.Description = "Performs a double shift on a list - with optional wrap";

    Component.Params.Input[0].Name = "List";
    Component.Params.Input[0].Description = "List to shift";
    Component.Params.Input[1].Name = "Wrap";
    Component.Params.Input[1].Description = "enable-disable wrap behavior";
    Component.Params.Output[0].Name = "Forward";
    Component.Params.Output[0].Description = "forward-shifted list";
    Component.Params.Output[1].Name = "Backward";
    Component.Params.Output[1].Description = "backward-shifted list";
  }
# ---------- end f_dbshift ----------
pline = PolyLine(Vertices=flip, Closed=False)
vec2pt = Vector2Pt(PointA=f_dbshift.Fw, PointB=f_dbshift.Bw, Unitize=False)  # -> Vector, Length
fillet = Fillet(Curve=pline, Radius=Slider(0.6, range=0..5))  # -> flatten(Curve)
multiplication = Multiplication(A=vec2pt.Vector, B=Slider(0.9, range=0..1))
extr = Extrude(Base=fillet, Direction=multiplication)
offset = OffsetSurface(Surface=extr, Distance=Slider(0.1, range=0..1), Retrim=True)
edges = BrepEdges(Brep=offset)  # -> Naked, Interior, NonManifold
edges_2 = BrepEdges(Brep=extr)  # -> Naked, Interior, NonManifold
join = JoinCurves(Curves=edges_2.Naked, Preserve=False)
join_2 = JoinCurves(Curves=edges.Naked, Preserve=False)
loft = Loft(Curves=[join, join_2], Options={Adjust=False, Closed=False, LoftEnds=0, LoftSimp=0, LoftType=0, Rebuild=10, Refit=0.01})  # -> simplify(Loft)
merge_2 = Merge(Data1=loft, Data2=simplify(graft(extr)), Data3=simplify(graft(offset)))
join_3 = BrepJoin(Breps=merge_2)  # -> Breps, Closed
