# Grasshopper definition a3_cXX_mesh tweening.gh (Grasshopper 1.0.7)
# Copyright: Co-de-iT

mesh = Mesh([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])
# 2 colored meshes
n_of_intermediate_meshes = Slider(1, range=1..100)
# multiple meshes
close_loop = BooleanToggle(True)
panel = Panel("""white
cyan
blue""")
demesh = DeconstructMesh(Mesh=mesh)  # -> simplify(Vertices), Faces, Colours, Normals
n_of_intermediate_meshes_2 = Slider(9, range=1..100)

# ---- group: end mesh
mesh_2 = Mesh(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)

# ---- group: start mesh
# 2 meshes
# NOTE: Meshes must have the same topology (same number of vertices and same array of faces).
# 
# The safest way to ensure this is that the end mesh is a copy of the start mesh that is then only deformed
mesh_3 = Mesh(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)

# NOTE: Meshes must have the same topology (same number of vertices and same array of faces).
# 
# The safest way to ensure this is that the end mesh is a copy of the start mesh that is then only deformed
mesh_4 = Mesh(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)

# ---- group: end mesh
mesh_5 = Mesh(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)

# ----
close_loop_2 = BooleanToggle(True)
not = GateNot(A=close_loop)
# Tween mesh
# 
# © a3 2018 _ Creative Commons Attribution-NonCommercial-ShareAlike3.0 UnportedLicense.
demesh_2 = DeconstructMesh(Mesh=mesh_3)  # -> Vertices, Faces, Colours, Normals
demesh_3 = DeconstructMesh(Mesh=mesh_2)  # -> Vertices, Faces, Colours, Normals
n_of_intermediate_meshes_3 = Slider(3, range=1..20)
n_of_intermediate_meshes_4 = Slider(5, range=1..100)
flip = FlipMatrix(Data=demesh.Vertices)
mcol = MeshColours(
    Mesh=mesh_4,
    Colours=[RGB(127, 255, 0), RGB(0, 100, 0), RGB(34, 139, 34), RGB(124, 252, 0), RGB(154, 205, 50), RGB(173, 255, 47), RGB(50, 205, 50), RGB(152, 251, 152)])
mcol_2 = MeshColours(Mesh=mesh_5, Colours=panel)
flip_2 = FlipMatrix(Data=demesh.Vertices)
lng = ListLength(List=mesh)
int = Integer(not)
range = Range(Domain=Domain(0, 1), Steps=expr("x+1", n_of_intermediate_meshes))
panel_2 = Panel("""0
-1""")
item = ListItem(List=flip_2, Index=0, Wrap=True)
expression = Expression(x=n_of_intermediate_meshes_2, y=lng, z=int, Expression="(x+1)*(y-z)")
merge = Merge(Data1=graft(demesh_2.Vertices), Data2=graft(demesh_3.Vertices))  # -> simplify(Result)
ln = Line(StartPoint=demesh_2.Vertices, EndPoint=demesh_3.Vertices)
list = ValueList({"single step": 0, "multiple steps": 1}, selected="multiple steps")
demesh_4 = DeconstructMesh(Mesh=mcol)  # -> Vertices, Faces, Colours, Normals
demesh_5 = DeconstructMesh(Mesh=mcol_2)  # -> Vertices, Faces, Colours, Normals
shift = ShiftList(List=flip, Shift="1", Wrap=close_loop_2)  # -> simplify(List)
shift_2 = ShiftList(List=flip, Shift="-1", Wrap=close_loop_2)  # -> simplify(List)
cull_i = CullIndex(List=range, Indices=panel_2, Wrap=True)
merge_2 = Merge(Data1=flip_2, Data2=item)
range_2 = Range(Domain=Domain(0, 1), Steps=expr("x+1", n_of_intermediate_meshes_3))
range_3 = Range(Domain=Domain(0, 1), Steps=expr("x+1", n_of_intermediate_meshes_4))
filter = StreamFilter(Gate=close_loop_2, Stream0=shift_2, Stream1=flip)
panel_3 = Panel("""0
-1""")
panel_4 = Panel("""0
-1""")
filter_2 = StreamFilter(Gate=close_loop, Stream0=flip_2, Stream1=merge_2)
dash = DashPattern(Curve=ln, Pattern="2")  # -> Dashes, Gaps
filter_3 = StreamFilter(Gate=list, Stream0=Slider(0, range=0..1), Stream1=cull_i)
merge_3 = Merge(Data1=graft(demesh_4.Colours), Data2=graft(demesh_5.Colours))  # -> simplify(Result)
merge_4 = Merge(Data1=graft(demesh_4.Vertices), Data2=graft(demesh_5.Vertices))  # -> simplify(Result)
ln_2 = Line(StartPoint=demesh_4.Vertices, EndPoint=demesh_5.Vertices)
list_2 = ValueList({"single step": 0, "multiple steps": 1}, selected="multiple steps")
list_3 = ValueList({"single step": 0, "multiple steps": 1}, selected="multiple steps")
cull_i_2 = CullIndex(List=range_2, Indices=panel_3, Wrap=True)
cull_i_3 = CullIndex(List=range_3, Indices=panel_4, Wrap=True)
merge_5 = Merge(Data1=graft(filter), Data2=graft(shift))
interpolation = ValueList({"linear": 0, "Catmull": 1}, selected="Catmull")
interp = InterpolateData(Data=merge, Parameter=filter_3, Interpolation=2)
filter_4 = StreamFilter(Gate=list_2, Stream0=Slider(0, range=0..1), Stream1=cull_i_2)
dash_2 = DashPattern(Curve=ln_2, Pattern="2")  # -> Dashes, Gaps
filter_5 = StreamFilter(Gate=list_3, Stream0=Slider(0, range=0..1), Stream1=cull_i_3)
pline = PolyLine(Vertices=filter_2, Closed=close_loop)
intcrv = Interpolate(Vertices=filter_2, Degree=3, Periodic=close_loop, KnotStyle=1)  # -> Curve, Length, Domain
flip_3 = FlipMatrix(Data=interp)
interp_2 = InterpolateData(Data=merge_5, Parameter=filter_4, Interpolation=2)
interp_3 = InterpolateData(Data=merge_4, Parameter=filter_5, Interpolation=2)
interp_4 = InterpolateData(Data=merge_3, Parameter=filter_5, Interpolation=2)
filter_6 = StreamFilter(Gate=interpolation, Stream0=pline, Stream1=intcrv.Curve)
conmesh = ConstructMesh(Vertices=flip_3, Faces=demesh_2.Faces)
# interpolate renumbers the branches, so we need to retrieve the right indexes. This component applies the branch indexes of G to the data tree T. T and G should obviously have the same number of branches
match = MatchTree(Tree=interp_2, Guide=merge_5)
flip_4 = FlipMatrix(Data=interp_3)
flip_5 = FlipMatrix(Data=interp_4)
medges = MeshEdges(Mesh=conmesh)  # -> NakedEdges, InteriorEdges, NonManifoldEdges
# A: index of the vertex
# B: index of the segment between meshes
# i: index of the step
path_mapper = PathMapper(match, source="{A;B}(i)", target="{B;i}(A)")
bang = ExplodeTree(Data=demesh.Faces)
bang_2 = ExplodeTree(Data=demesh.Faces)
divide = DivideCurve(Curve=filter_6, Count=expression, Kinks=False)  # -> simplify(Points), Tangents, Parameters
conmesh_2 = ConstructMesh(Vertices=flip_4, Faces=demesh_4.Faces, Colours=flip_5)
flip_6 = FlipMatrix(Data=divide.Points)
medges_2 = MeshEdges(Mesh=conmesh_2)  # -> NakedEdges, InteriorEdges, NonManifoldEdges
preview = CustomPreview(
    Geometry=conmesh_2,
    Material={diffuse=RGB(221, 160, 221), emission=RGB(66, 48, 66), shine=0.5, specular=RGB(255, 255, 255), transparency=0})
case = ValueList({"simple": 0, "complex": 1}, selected="simple")
viewer = ParamViewer(path_mapper)
conmesh_3 = ConstructMesh(Vertices=flip_6, Faces=bang)
conmesh_4 = ConstructMesh(Vertices=path_mapper, Faces=bang_2)
filter_7 = StreamFilter(Gate=case, Stream0=conmesh_3, Stream1=conmesh_4)
X = UnitX(Factor="-400")
move = Move(Geometry=filter_7, Motion=X)  # -> Geometry, Transform
medges_3 = MeshEdges(Mesh=move.Geometry)  # -> NakedEdges, InteriorEdges, NonManifoldEdges
preview_2 = CustomPreview(Geometry=move.Geometry, Material=ColourSwatch(SwatchColor=RGB(255, 255, 255)))
